# Grasshopper definition AutocalculateGFA_tjd.gh (Grasshopper 1.0.7)

get_geometry = GetGeometry(
    AtLeast=1,
    AtMost=5000,
    DeleteInput=False,
    Filter=1073741840,
    Prompt="Select flat, closed volumes (BREPS) for calculation (max. 5000)")
cluster = Cluster(input_geometry=get_geometry)  # -> flatten(gfa), measured_surfaces, flatten(footprints), flatten(footprint_surfaces), gfz, grz
txt = Text(cluster.gfa)
concat = Concatenate(FragmentA="Total gross area: ", FragmentB=txt)
concat_2 = Concatenate(FragmentA=concat, FragmentB="m2 (or Rhino units squared)")
context_print = ContextPrint(Text=concat_2)

# ==== cluster Cluster
input_geometry = ClusterInput()
plot_curve = ClusterInput()

# ---- group: find only base units
volume = Volume(Geometry=input_geometry)  # -> Volume, Centroid
pdecon = Deconstruct(Point=volume.Centroid)  # -> XComponent, YComponent, ZComponent
smaller = SmallerThan(FirstNumber=pdecon.ZComponent, SecondNumber="3")  # -> SmallerThan, OrEqualTo
cull = CullPattern(List=input_geometry, CullPattern=smaller.OrEqualTo)

# ----
area = Area(Geometry=plot_curve)  # -> Area, Centroid

# ---- group: Find bottom surface
debrep = DeconstructBrep(Brep=input_geometry)  # -> Faces, Edges, Vertices
area_2 = Area(Geometry=debrep.Faces)  # -> Area, Centroid
pdecon_2 = Deconstruct(Point=area_2.Centroid)  # -> XComponent, YComponent, ZComponent
sort = SortList(Keys=pdecon_2.ZComponent, ValuesA=debrep.Faces)  # -> Keys, ValuesA
item = ListItem(List=sort.ValuesA, Index=0, Wrap=True)
area_3 = Area(Geometry=item)  # -> Area, Centroid
trim = TrimTree(Tree=area_3.Area, Depth=1)
ma = MassAddition(Input=trim)  # -> Result, PartialResults

debrep_2 = DeconstructBrep(Brep=cull)  # -> Faces, Edges, Vertices
area_4 = Area(Geometry=debrep_2.Faces)  # -> Area, Centroid
pdecon_3 = Deconstruct(Point=area_4.Centroid)  # -> XComponent, YComponent, ZComponent
sort_2 = SortList(Keys=pdecon_3.ZComponent, ValuesA=debrep_2.Faces)  # -> Keys, ValuesA
item_2 = ListItem(List=sort_2.ValuesA, Index=0, Wrap=True)
area_5 = Area(Geometry=item_2)  # -> Area, Centroid
trim_2 = TrimTree(Tree=area_5.Area, Depth=1)
ma_2 = MassAddition(Input=trim_2)  # -> Result, PartialResults

# ----
division = Division(A=flatten(ma_2.Result), B=flatten(area.Area))
division_2 = Division(A=flatten(ma.Result), B=flatten(area.Area))
footprint_surfaces = ClusterOutput(item_2)
footprints = ClusterOutput(ma_2.Result)
measured_surfaces = ClusterOutput(item)
gfa = ClusterOutput(ma.Result)
gfz = ClusterOutput(division_2)
grz = ClusterOutput(division)
