# Grasshopper definition rain_analysis.gh (Grasshopper 1.0.7)
# plug-ins: Kangaroo2 Components

# ---- group: Number of Points
number_slider = Slider(22, range=0..100)
number_slider_2 = Slider(17, range=0..100)

# ---- group: Scale of Bounding Box
number_slider_3 = Slider(1.2, range=1..2.5)

# ----
geo = Geometry(<brep referenced from the Rhino model>)

# ---- group: Generating Points
bbox = BoundingBox(Content=geo, Plane=PlaneXY(0, 0, 0))  # -> Box, Box_2
debrep = DeconstructBrep(Brep=bbox.Box)  # -> Faces, Edges, Vertices
number_slider_4 = Slider(1.2, range=0..10)
item = ListItem(List=debrep.Faces, Index=5, Wrap=True)
area = Area(Geometry=item)  # -> Area, Centroid
scale = Scale(Geometry=item, Center=area.Centroid, Factor=number_slider_3)  # -> Geometry, Transform
sdivide = DivideSurface(Surface=scale.Geometry, UCount=number_slider, VCount=number_slider_2)  # -> Points, Normals, Parameters

# ---- group: Physics
Z = UnitZ(Factor=-0.0001)
spc = SolidPointCollide(Points=sdivide.Points, Solid=geo, Interior=False, Unidirectional=True, Strength=1)
show = Show(G=sdivide.Points)
load = Load(Point=sdivide.Points, ForceVector=Z, Weighting=1)

# ---- group: Solver
solver = Solver(GoalObjects=[spc, load, show], Reset=Button(), Threshold=1e-15, Tolerance=0.01, On=Toggle(False))  # -> I, graft(V), O
rec = DataRecorder(solver.V, DataLimit=-10, RecordData=True)
pline = PolyLine(Vertices=rec, Closed=False)
dot = DotDisplay(Point=solver.O)
