# Grasshopper definition OBWBaseFile_v3.0.gh (Grasshopper 1.0.7)
# plug-ins: LunchBox, Telepathy, Pufferfish

# ---- group: Generate Distance Areas
geo = Geometry([<brep referenced from the Rhino model> x102])
cluster = Cluster(
    input_geometry=geo,
    upper_floors_height=Slider(3, range=0..10),
    ground_floors_height=Slider(4.3, range=0..10),
    raised_ground_distance=Slider(0, range=0..3))  # -> building_footprints, grouped_building_footprints, distance_areas_curves, distance_areas_surfaces, conflicts
geo_2 = Geometry(cluster.distance_areas_curves)
preview = CustomPreview(Geometry=cluster.conflicts, Material=ColourSwatch(SwatchColor=RGB(255, 0, 0)))
preview_2 = CustomPreview(Geometry=cluster.distance_areas_curves, Material=ColourSwatch(SwatchColor=RGB(0, 98, 255)))
swatch = ColourSwatch(SwatchColor=RGB(255, 255, 255))
layer_name = Panel("Area")
swatch_2 = ColourSwatch(SwatchColor=RGB(255, 0, 0))
layer_name_2 = Panel("Conflict")
bake = ObjectBake(
    BakeToggle=Button(),
    GeometryObjects=cluster.distance_areas_curves,
    Layer=layer_name,
    ObjectName=layer_name,
    ObjectColor=swatch,
    LayerColor=swatch)
bake_2 = ObjectBake(
    BakeToggle=False,
    GeometryObjects=cluster.conflicts,
    Layer=layer_name_2,
    ObjectName=layer_name_2,
    ObjectColor=swatch_2,
    LayerColor=swatch_2)

# ---- group: Generate Pitched Roofs
height = Slider(2, range=1..3)  # disabled
roof = Slider(2, range=0..2)  # disabled
crv = Curve()  # disabled
explode = Explode(Curve=crv, Recursive=True)  # -> Segments, Vertices; disabled
Z = UnitZ(Factor=height)  # disabled
len = Length(Curve=explode.Segments)  # disabled
extr = Extrude(Base=crv, Direction=Z)  # disabled
sort = SortList(Keys=len, ValuesA=explode.Segments)  # -> Keys, ValuesA; disabled
item = ListItem(List=sort.ValuesA, Index=0, Wrap=True)  # disabled
item_2 = ListItem(List=sort.ValuesA, Index=1, Wrap=True)  # disabled
cap = CapHoles(Brep=extr)  # disabled
midpt = CurveMiddle(Curve=item)  # disabled
midpt_2 = CurveMiddle(Curve=item_2)  # disabled
Z_2 = UnitZ(Factor=roof)  # disabled
end = EndPoints(Curve=item)  # -> Start, End; disabled
move = Move(Geometry=midpt, Motion=Z_2)  # -> Geometry, Transform; disabled
ln = Line(StartPoint=midpt, EndPoint=midpt_2)  # disabled
pt = Point([end.Start, move.Geometry, end.End])  # disabled
pline = PolyLine(Vertices=pt, Closed=False)  # disabled
clscrv = CloseCurve(Curve=pline, CloseType=0, Bulge=0.5, Tolerance=0)  # -> Closed, R; disabled
extrcrv = ExtrudeAlong(Base=clscrv.Closed, Curve=ln)  # disabled
Z_3 = UnitZ(Factor=height)  # disabled
cap_2 = CapHoles(Brep=extrcrv)  # disabled
move_2 = Move(Geometry=cap_2, Motion=Z_3)  # -> Geometry, Transform; disabled
geo_3 = Geometry(flatten([cap, move_2.Geometry]))  # disabled
sunion = SolidUnion(Breps=geo_3)  # disabled

# ---- group: Primary GFA Calculation / Locate Geometry
panel = Panel("plot1_")  # disabled
# OBW Base File 3.0: Tom Dufficy 2023
# 
# Dependencies:
# LunchBox
# Pufferfish
panel_2 = Panel("""A1
A2
A5
A6
A7
A8.1
A8.2
A9
A10
A11
A12
A18
A19
A22
A26.1
A26.2
A27
A30.1
A30.2
A31
A32
A33
A34
A36
B1
B2
B3
B4
B5.1
B5.2
B6
B7.1
B7.2
B8
B9.1
B10
B11
B12
B13
B14
B15
B16
B17
B18
B19
B20
B21
B22
B23
B24
B25
C1
C2
C3
C4
C5
C6
C7
C8.1
C8.2
C9
C10
C11
C12.1
C12.2
C13
C14
C15
C16
C17
C18
C19
C20
G1.1
G1.2
G2.1
G2.2
G3.1
G3.2
G4.1
G4.2
G5.1
G5.2
G6.1
G6.2
G7
G8
G9.1
G9.2
G10
G11
G12
G13.1
G13.2
G14
G15
G16
G17
G18
P1
P2.1
P2.2
P3.1
P5
P6
P6.1
P7
P7.1
P8
P10
P13
P14.1
P14.2""")  # disabled
reset = Button(ExpressionNormal="True", ExpressionPressed="False")  # disabled
concat = Concatenate(FragmentA=panel, FragmentB=panel_2)  # disabled
panel_3 = Panel(concat)  # disabled
panel_4 = Panel("_2")  # disabled
layer_ref = LayerReference(ReferenceToggle=reset, LayerName=panel_2)  # -> Geometry, Name, UserStrings, GUID; disabled
layer_ref_2 = LayerReference(ReferenceToggle=reset, LayerName=concat)  # -> Geometry, Name, UserStrings, GUID; disabled
concat_2 = Concatenate(FragmentA=concat, FragmentB=panel_4)  # disabled
panel_5 = Panel(concat_2)  # disabled
unset = RemoteSender(layer_ref.Geometry)  # disabled
unset_2 = RemoteSender(layer_ref_2.Geometry)  # disabled
layer_ref_3 = LayerReference(ReferenceToggle=reset, LayerName=concat_2)  # -> Geometry, Name, UserStrings, GUID; disabled
cluster_2 = Cluster_2(input_geometry=layer_ref.Geometry, plot_curve=layer_ref_2.Geometry)  # -> flatten(gfa), measured_surfaces, flatten(footprints), footprint_surfaces, gfz, grz; disabled
area = Area(Geometry=layer_ref_2.Geometry)  # -> flatten(Area), Centroid; disabled
area_2 = Area(Geometry=layer_ref_3.Geometry)  # -> flatten(Area), Centroid; disabled

# ---- group: Primary GFA Calculation
boolean_toggle = BooleanToggle(True)  # disabled
number = Number(cluster_2.gfz)  # disabled
before = Slider(1, range=0..5)  # disabled
after = Slider(2, range=0..5)  # disabled
ghpython_script = GhPythonScript(active=boolean_toggle, L=number, before=before, after=after)  # -> out, R, active; inputs L: list, before: Int32, after: Int32; disabled
# ---------- ghpython_script: Python ----------
if active:

    L = [(eval("'{:0" + str(before+after+1) + "." + str(after) +"f}'.format(float(" + str(num) + "))")) for num in L]

    R = L

    active = True
else:
    active = False
# ---------- end ghpython_script ----------
panel_6 = Panel(ghpython_script.R)  # disabled

boolean_toggle_2 = BooleanToggle(True)  # disabled
number_2 = Number(cluster_2.grz)  # disabled
before_2 = Slider(1, range=0..5)  # disabled
after_2 = Slider(2, range=0..5)  # disabled
ghpython_script_2 = GhPythonScript(active=boolean_toggle_2, L=number_2, before=before_2, after=after_2)  # -> out, R, active; inputs L: list, before: Int32, after: Int32; disabled; same code as ghpython_script
panel_7 = Panel(ghpython_script_2.R)  # disabled

# ----
wheel = ColourWheel(
    ColourGrips_Style=10,
    ColourGrips_Grip=[3.639586234, 2.094395102, 4.188790205, 3.141592654],
    ColourGrips_Lum=[0.1, 0.5],
    ColourGrips_Range=[0.2617993878, 0.2617993878, 0.2617993878, 0.2617993878],
    ColourGrips_Sat=[0.2, 0.6])

# ---- group: Primary GFA Calculation / max gfz check
panel_8 = Panel("""1.2
1.2
1.2
1.2
1.2
1.2
1.2
1.2
2
1.2
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""")  # disabled
smaller = SmallerThan(FirstNumber=ghpython_script.R, SecondNumber=panel_8)  # -> SmallerThan, OrEqualTo; disabled
swatch_3 = ColourSwatch(SwatchColor=RGB(93, 173, 59))  # disabled
swatch_4 = ColourSwatch(SwatchColor=RGB(173, 59, 59))  # disabled

# ---- group: Primary GFA Calculation / max grz check
panel_9 = Panel("""0.4
0.4
0.4
0.4
0.4
0.4
0.4
0.4
0.8
0.4
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""")  # disabled
smaller_2 = SmallerThan(FirstNumber=ghpython_script_2.R, SecondNumber=panel_9)  # -> SmallerThan, OrEqualTo; disabled
swatch_5 = ColourSwatch(SwatchColor=RGB(93, 173, 59))  # disabled
swatch_6 = ColourSwatch(SwatchColor=RGB(173, 59, 59))  # disabled

# ---- group: Primary GFA Calculation
remote_receiver = RemoteReceiver(unset_2)  # disabled
swatch_7 = ColourSwatch(SwatchColor=RGB(255, 255, 255))  # disabled

area_3 = Area(Geometry=remote_receiver)  # -> Area, Centroid; disabled

remote_receiver_2 = RemoteReceiver(unset)  # disabled
remote_receiver_3 = RemoteReceiver(unset)  # disabled
entwine = Entwine(
    Branch00=panel_2,
    Branch01=area_2.Area,
    Branch02=area.Area,
    Branch03=cluster_2.footprints,
    Branch04=cluster_2.gfa,
    Branch05=ghpython_script_2.R,
    Branch06=panel_9,
    Branch07=ghpython_script.R,
    Branch08=panel_8,
    FlattenInputs=True)  # disabled

# ---- group: Primary GFA Calculation / max gfz check (continued)
group = Group(Objects=remote_receiver_3)  # -> flatten(Group); disabled
dispatch = Dispatch(List=group, DispatchPattern=smaller.OrEqualTo)  # -> ListA, ListB; disabled
preview_3 = CustomPreview(Geometry=dispatch.ListA, Material=swatch_3)  # disabled
preview_4 = CustomPreview(Geometry=dispatch.ListB, Material=swatch_4)  # disabled

# ---- group: Primary GFA Calculation / max grz check (continued)
group_2 = Group(Objects=remote_receiver_2)  # -> flatten(Group); disabled
dispatch_2 = Dispatch(List=group_2, DispatchPattern=smaller_2.OrEqualTo)  # -> ListA, ListB; disabled
preview_5 = CustomPreview(Geometry=dispatch_2.ListA, Material=swatch_5)  # disabled
preview_6 = CustomPreview(Geometry=dispatch_2.ListB, Material=swatch_6)  # disabled

# ---- group: Primary GFA Calculation
panel_10 = Panel("""Name: 
Baufeld Gesamt: 
Baufeld ohne Privatweg: 
Grundfläche: 
BGF: 
GRZ: 
GRZ Max: 
GFZ: 
GFZ Max: """)  # disabled
unset_3 = RemoteSender(panel_10)  # disabled
unset_4 = RemoteSender(entwine)  # disabled
toggle = BooleanToggle(False)  # disabled
path = FilePath("\\ADEPT-FIL\Projects\2017_285_Oberbillwerder planning\2 Phase - Functionplan\04_Project_Material\RHINO\Area Reduction\20210216_areareduction_tjd.xlsx")  # disabled
excelwrite = ExcelWrite(
    WriteExcelData=toggle,
    WorkbookPath=path,
    WorksheetName="Sheet1",
    ColumnHeadings=panel_10,
    Data=entwine,
    ClearSheet=False)  # disabled

panel_11 = Panel(excelwrite)  # disabled

remote_receiver_4 = RemoteReceiver(unset_4)  # disabled
remote_receiver_5 = RemoteReceiver(unset_3)  # disabled
concat_3 = Concatenate(FragmentA=graft(remote_receiver_5), FragmentB=remote_receiver_4)  # disabled
flip = FlipMatrix(Data=concat_3)  # disabled
rev = ReverseList(List=flip)  # disabled

lng = ListLength(List=remote_receiver_5)  # disabled
Z_4 = UnitZ(Factor=lng)  # disabled
arrlinear = LinearArray(Geometry=area_3.Centroid, Direction=Z_4, Count=lng)  # -> Geometry, Transform; disabled

tag = TextTag(Location=arrlinear.Geometry, Text=rev, Colour=swatch_7)  # disabled

# ==== cluster Cluster

raised_ground_distance = ClusterInput()
ground_floors_height = ClusterInput()
upper_floors_height = ClusterInput()
input_geometry = ClusterInput()

# ---- group: Find bottom surface
debrep = DeconstructBrep(Brep=input_geometry)  # -> Faces, Edges, Vertices
area = Area(Geometry=debrep.Faces)  # -> Area, Centroid
pdecon = Deconstruct(Point=area.Centroid)  # -> XComponent, YComponent, ZComponent
sort = SortList(Keys=pdecon.ZComponent, ValuesA=debrep.Faces)  # -> Keys, ValuesA
item = ListItem(List=sort.ValuesA, Index=0, Wrap=True)
area_2 = Area(Geometry=item)  # -> Area, Centroid
flatten = FlattenTree(Tree=area_2.Centroid, Path="{0}")

# ---- group: find only base units
volume = Volume(Geometry=input_geometry)  # -> Volume, Centroid
pdecon_2 = Deconstruct(Point=volume.Centroid)  # -> XComponent, YComponent, ZComponent
smaller = SmallerThan(FirstNumber=pdecon_2.ZComponent, SecondNumber="3")  # -> SmallerThan, OrEqualTo
cull = CullPattern(List=input_geometry, CullPattern=smaller.OrEqualTo)

# ---- group: Find bottom surface
debrep_2 = DeconstructBrep(Brep=cull)  # -> Faces, Edges, Vertices
area_3 = Area(Geometry=debrep_2.Faces)  # -> Area, Centroid
pdecon_3 = Deconstruct(Point=area_3.Centroid)  # -> XComponent, YComponent, ZComponent
sort_2 = SortList(Keys=pdecon_3.ZComponent, ValuesA=debrep_2.Faces)  # -> Keys, ValuesA
item_2 = ListItem(List=sort_2.ValuesA, Index=0, Wrap=True)
area_4 = Area(Geometry=item_2)  # -> Area, Centroid
flatten_2 = FlattenTree(Tree=area_4.Centroid, Path="{0}")

# ----
pgroups = PointGroups(Points=flatten, Distance=Slider(4.5, range=0..10))  # -> Groups, Indices
pdecon_4 = Deconstruct(Point=pgroups.Groups)  # -> XComponent, YComponent, ZComponent
sort_3 = SortList(Keys=pdecon_4.ZComponent, ValuesA=pgroups.Groups)  # -> Keys, ValuesA
lng = ListLength(List=sort_3.ValuesA)  # -> flatten(Length)
item_3 = ListItem(List=sort_3.ValuesA, Index=0, Wrap=True)  # -> flatten(Item)
mindex = MemberIndex(Set=flatten_2, Member=item_3)  # -> flatten(Index), Count
sort_4 = SortList(Keys=mindex.Index, ValuesA=lng)  # -> Keys, ValuesA
eval = Evaluate(F="(((x-1)*y)+z+u)*0.4", x=sort_4.ValuesA, y=upper_floors_height, z=ground_floors_height, u=raised_ground_distance)

# ---- group: Grouping touching buildings (curves that make up one combined building)
trim = TrimTree(Tree=item_2, Depth=1)
graft = GraftTree(Tree=eval, IncludeEmptyLists=True, IncludeNullItems=True)
join = JoinCurves(Curves=trim, Preserve=False)
c_script = CSharpScript(enable=Toggle(True), cList=join, branch=Slider(-1, range=-1..200))  # -> out, DucatiumAmamusDumSpiramus, clustersIndicesTree, demoContentList; inputs enable: Boolean, cList: list of Curve, branch: Int32
# ---------- c_script: C# ----------
    // by The Lord of Darkness due to critical Vodka starvation issues

    if(!enable) return;

    cList = cList.Where(x => x != null && x is Curve).ToList();
    if(!cList.Any())return;

    System.Diagnostics.Stopwatch sw = new System.Diagnostics.Stopwatch();
    sw.Start();

    double tol = RhinoDoc.ActiveDoc.ModelAbsoluteTolerance;
    DataTree<int> conn = new DataTree<int>();
    ClusterCcx(cList, tol, ref conn);
    clustersIndicesTree = conn;  //>> out

    Print(" ");
    Print("Made: {0} clusters [{1} items]", conn.BranchCount, cList.Count);
    Print(" ");

    if(branch != -1){
      if(branch >= conn.BranchCount) branch = conn.BranchCount - 1;
      List<int> indices = conn.Branch(branch);
      List<Curve> cDemo = new List<Curve>();
      foreach(int index in indices) cDemo.Add(cList[index]);
      demoContentList = cDemo;  //>> out
    }
    else Print("Demo is disabled (branch = -1)");

    sw.Stop();
    DucatiumAmamusDumSpiramus = (string.Format("Elapsed: {0}ms", sw.Elapsed.TotalMilliseconds));
# ---------- c_script: C# additional code ----------
  public void  ClusterCcx(List <Curve> cList, double tol, ref DataTree < int > conn){

    bool[] Sampled = new bool[cList.Count];
    int branch = 0;

    for (int i = 0; i < cList.Count; i++){
      if(Sampled[i]) continue;
      List<int> clusterIndices = new List<int>();
      clusterIndices.Add(i);
      conn.Add(i, new GH_Path(branch));
      //  curveClusters.Add(cList[i], new GH_Path(branch));
      Sampled[i] = true;
      do{
        for (int j = 0; j < cList.Count; j++){
          if (j != clusterIndices[0] && !Sampled[j]){
            var ccx = Rhino.Geometry.Intersect.Intersection.CurveCurve(cList[clusterIndices[0]], cList[j], tol, 0);
            if (ccx.Count > 0){
              clusterIndices.Add(j);
              conn.Add(j, new GH_Path(branch));
              // curveClusters.Add(cList[j], new GH_Path(branch));
              Sampled[j] = true;
            }
          }
        }
        clusterIndices.RemoveAt(0);
      }while (clusterIndices.Count > 0);
      branch++;
    }
  }
# ---------- end c_script ----------
flatten_3 = FlattenTree(Tree=graft, Path="{0}")
item_4 = ListItem(List=join, Index=c_script.clustersIndicesTree, Wrap=True)
item_5 = ListItem(List=flatten_3, Index=c_script.clustersIndicesTree, Wrap=True)
simplify = SimplifyTree(Tree=item_4, Front=False)
graft_2 = GraftTree(Tree=item_5, IncludeEmptyLists=True, IncludeNullItems=True)
edges = BrepEdges(Brep=simplify)  # -> Naked, Interior, NonManifold
lng_2 = ListLength(List=edges.Naked)
dup = DuplicateData(Data=graft_2, Number=lng_2, Order=True)
trim_2 = TrimTree(Tree=dup, Depth=1)
offcrv = OffsetCurve(Curve=edges.Naked, Plane=PlaneXY(0, 0, 0), Distance=trim_2, BothSides=False, Kinks=0, CapType=1)
simplify_2 = SimplifyTree(Tree=item_4, Front=False)
trim_3 = TrimTree(Tree=offcrv, Depth=1)
trim_4 = TrimTree(Tree=trim_3, Depth=1)
merge = Merge(Data1=trim_4, Data2=simplify_2)
geo = Geometry(merge)
runion = RegionUnion(Curves=geo)
boundary = BoundarySurfaces(Edges=runion)  # -> flatten(Surfaces)

# ---- group: checking and highlighting conflicts
crv = Curve(boundary)
runion_2 = RegionUnion(Curves=crv)
boundary_2 = BoundarySurfaces(Edges=runion_2)  # -> simplify(Surfaces)
srfsplit = SurfaceSplit(Surface=boundary_2, Curves=crv)  # -> simplify(Fragments)
pcen = PolygonCenter(Polyline=srfsplit)  # -> CenterV, CenterE, CenterA
srf_cp = SurfaceClosestPoint(Point=pcen.CenterE, Surface=srfsplit)  # -> Point, UVPoint, Distance
evalsrf = EvaluateSurface(Surface=srfsplit, Point=srf_cp.UVPoint)  # -> Point, Normal, UDirection, VDirection, Frame
line = LineSDL(Start=evalsrf.Point, Direction=evalsrf.Normal, Length=10)  # -> flatten(Line)
srf = Surface(simplify(flatten(boundary)))
scx = SurfaceCurve(Surface=srf, Curve=graft(line))  # -> Curves, Points, UVPoints, Normals, Parameters, Tangents
srf_2 = Surface(flatten(srfsplit))
pshift = ShiftPaths(Data=scx.Points, Offset=-1)
lng_3 = ListLength(List=pshift)
larger = LargerThan(FirstNumber=lng_3, SecondNumber="1")  # -> LargerThan, OrEqualTo
dispatch = Dispatch(List=graft(srf_2), DispatchPattern=larger.LargerThan)  # -> ListA, ListB
srf_3 = Surface(dispatch.ListA)
preview = CustomPreview(Geometry=srf_3, Shader=ColourSwatch(SwatchColor=RGB(255, 0, 0)))
area_5 = Area(Geometry=srf_3)  # -> Area, Centroid
circle = CircleCNR(Center=area_5.Centroid, Normal=Vector(0, 0, 1), Radius=Slider(30, range=0..100))

# ----
geo_2 = Geometry(flatten(runion))

distance_areas_curves = ClusterOutput(geo_2)
building_footprints = ClusterOutput(item_2)
grouped_building_footprints = ClusterOutput(simplify)
distance_areas_surfaces = ClusterOutput(boundary)
conflicts = ClusterOutput([srf_3, circle])

# ==== cluster Cluster_2
input_geometry = ClusterInput()
plot_curve = ClusterInput()

# ---- group: find only base units
volume = Volume(Geometry=input_geometry)  # -> Volume, Centroid
pdecon = Deconstruct(Point=volume.Centroid)  # -> XComponent, YComponent, ZComponent
smaller = SmallerThan(FirstNumber=pdecon.ZComponent, SecondNumber="3")  # -> SmallerThan, OrEqualTo
cull = CullPattern(List=input_geometry, CullPattern=smaller.OrEqualTo)

# ----
area = Area(Geometry=plot_curve)  # -> Area, Centroid

# ---- group: Find bottom surface
debrep = DeconstructBrep(Brep=input_geometry)  # -> Faces, Edges, Vertices
area_2 = Area(Geometry=debrep.Faces)  # -> Area, Centroid
pdecon_2 = Deconstruct(Point=area_2.Centroid)  # -> XComponent, YComponent, ZComponent
sort = SortList(Keys=pdecon_2.ZComponent, ValuesA=debrep.Faces)  # -> Keys, ValuesA
item = ListItem(List=sort.ValuesA, Index=0, Wrap=True)
area_3 = Area(Geometry=item)  # -> Area, Centroid
trim = TrimTree(Tree=area_3.Area, Depth=1)
ma = MassAddition(Input=trim)  # -> Result, PartialResults

debrep_2 = DeconstructBrep(Brep=cull)  # -> Faces, Edges, Vertices
area_4 = Area(Geometry=debrep_2.Faces)  # -> Area, Centroid
pdecon_3 = Deconstruct(Point=area_4.Centroid)  # -> XComponent, YComponent, ZComponent
sort_2 = SortList(Keys=pdecon_3.ZComponent, ValuesA=debrep_2.Faces)  # -> Keys, ValuesA
item_2 = ListItem(List=sort_2.ValuesA, Index=0, Wrap=True)
area_5 = Area(Geometry=item_2)  # -> Area, Centroid
trim_2 = TrimTree(Tree=area_5.Area, Depth=1)
ma_2 = MassAddition(Input=trim_2)  # -> Result, PartialResults

# ----
division = Division(A=flatten(ma_2.Result), B=flatten(area.Area))
division_2 = Division(A=flatten(ma.Result), B=flatten(area.Area))
footprint_surfaces = ClusterOutput(item_2)
footprints = ClusterOutput(ma_2.Result)
measured_surfaces = ClusterOutput(item)
gfa = ClusterOutput(ma.Result)
gfz = ClusterOutput(division_2)
grz = ClusterOutput(division)
