# Grasshopper definition Solar Analysis Example File.gh (Grasshopper 1.0.7)

# ---- group: Time of Analysis
starting_month = Slider(3, range=1..12)
ending_month = Slider(3, range=1..12)
ending_hour = Slider(17, range=0..23)
starting_day = Slider(20, range=1..31)
starting_hour = Slider(9, range=0..23)
ending_day = Slider(20, range=1..31)

# ---- group: Analysis Settings
analysis_grid_size = Slider(1, range=0.1..5)

# ---- group: Optional Settings
scale_of_sunpath = Slider(2, range=1..20)

# ----
run_simulation = BooleanToggle(True)

# ---- group: Weather File
# Step 1: 1. Right click
# 2. Choose 'Select one existing file'
# 3. Navigate to and select your .epw file
path = FilePath("R:\05_ELEMENTS\3D Elements\04_RHINOCEROS\09_SCRIPTS\Solar Analysis\Weather File\DEU_Hamburg.101470_IWEC.epw")

# ---- group: Analysis
analysisperiod = LBAnalysisPeriod(
    start_month=starting_month,
    start_day=starting_day,
    start_hour=starting_hour,
    end_month=ending_month,
    end_day=ending_day,
    end_hour=ending_hour)  # -> period, hoys, dates; plug-in component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
importloc = LBImportLocation(epw_file=path)  # -> location; plug-in component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
pipeline = GeometryPipeline(
    GroupByLayer=False,
    GroupByType=False,
    IncludeHidden=True,
    IncludeLocked=True,
    LayerFilter="Analysis Geometry BREPs",
    NameFilter="*",
    SublayerFiltering=True,
    TypeFilter=1073741848)
pipeline_2 = GeometryPipeline(
    GroupByLayer=False,
    GroupByType=False,
    IncludeHidden=True,
    IncludeLocked=True,
    LayerFilter="Context Geometry BREPs",
    NameFilter="*",
    SublayerFiltering=True,
    TypeFilter=1073741848)
sunpath = LBSunPath(location=importloc, hoys=analysisperiod.hoys, scale=scale_of_sunpath)  # -> report, vectors, altitudes, azimuths, hoys, sun_pts, analemma, daily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; plug-in component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
directsunhours = LBDirectSunHours(
    vectors=flatten(sunpath.vectors),
    geometry=flatten(pipeline),
    context=flatten(pipeline_2),
    grid_size=analysis_grid_size,
    run=run_simulation)  # -> report, points, results, mesh, legend, title, int_mtx; plug-in component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
mesh = Mesh(directsunhours.mesh)
