# Grasshopper definition HoopSnake_nbody.gh (Grasshopper 0.8.66)

# ---- group: Initial Trajectories
line = Line([Line((14.8, 6, 8), (5, 1, 4)), Line((3, -7, 16), (29, -15, 15)), Line((-23.5, -8, -5), (-33, -2, 0))])

# ----
end = EndPoints(Curve=flatten(hs.Feedback))  # -> Start, End

# ---- group: Other Points
pt = Point(end.End)
lng = ListLength(List=pt)
series = Series(Start=0, Step=1, Count=lng)
replace = ListReplace(List=pt, Indices=graft(series), Wrap=False)
clean = CleanTree(Data=replace, CleanInvalid=True, CleanEmpty=False)

# ---- group: Next Position
otherpt = Point(clean)
startpt = Point(end.Start)
endpt = Point(end.End)
vec2pt = Vector2Pt(PointA=graft(endpt), PointB=otherpt, Unitize=False)  # -> Vector, Length
vec2pt_2 = Vector2Pt(PointA=startpt, PointB=endpt, Unitize=False)  # -> Vector, Length
pt_2 = Point(endpt)

# ----
unit = UnitVector(Vector=vec2pt.Vector)
sqr = Square(Value=vec2pt.Length)
multiplication = Multiplication(A=unit, B=sqr)

# ---- group: Next Position (continued)
ma = MassAddition(Input=multiplication)  # -> Result, PartialResults
multiplication_2 = Multiplication(A=ma.Result, B=Slider(0.00019, range=0..0.001))  # -> flatten(Result)
addition = Addition(A=vec2pt_2.Vector, B=multiplication_2)
addition_2 = Addition(A=pt_2, B=addition)
ln = Line(StartPoint=pt_2, EndPoint=addition_2)

# ----
hs = HoopSnake(
    StartingData=line,
    Data=graft(ln),
    TerminationCondition=smaller.SmallerThan,
    Hoopsnake_Data_dataLimit=2147483647,
    Hoopsnake_Data_resetCounter=True,
    Hoopsnake_Data_updateView=True,
    Hoopsnake_Data_autoUpdate=False)  # -> Feedback, FeedbackHistory, LoopsCounter, IterationsCounter
smaller = SmallerThan(FirstNumber=hs.IterationsCounter, SecondNumber=Slider(360, range=0..1000))  # -> SmallerThan, OrEqualTo

# ---- group: Post
flip = FlipMatrix(Data=hs.FeedbackHistory)
end_2 = EndPoints(Curve=flip)  # -> Start, End
crv = Curve(Vertices=end_2.End, Degree=3, Periodic=False)  # -> Curve, Length, Domain
pipe_slow = Pipe(Curve=crv.Curve, Radius=Slider(1, range=0..1), Caps=0)  # disabled
