# Grasshopper definition HoopSnake_tree.gh (Grasshopper 0.8.66)

line = Line(Line((6, 0, 0), (6, 0, 4)))

# ---- group: Branching
separation = Slider(0.351, range=0..1)
distance = Slider(0.893, range=0..1)
end = EndPoints(Curve=hs22.Feedback)  # -> Start, End
vec2pt = Vector2Pt(PointA=end.Start, PointB=end.End, Unitize=False)  # -> Vector, Length
multiplication = Multiplication(A=vec2pt.Length, B=separation)
circle = CircleCNR(Center=end.End, Normal=vec2pt.Vector, Radius=multiplication)
multiplication_2 = Multiplication(A=vec2pt.Vector, B=distance)
move = Move(Geometry=circle, Motion=multiplication_2)  # -> graft(Geometry), Transform
lng = ListLength(List=move.Geometry)
random = Random(Range=Domain(0, 0.5), Number=lng, Seed=hs22.IterationsCounter_2, Integers=False)
_0_5 = Addition(A=random, B=0.5)
eval = EvaluateLength(Curve=move.Geometry, Length=[random, _0_5], Normalized=True)  # -> Point, Tangent, Parameter
ln = Line(StartPoint=graft(end.End), EndPoint=eval.Point)

# ----
hs22 = HoopSnake(
    StartingData=line,
    Data=ln,
    Hoopsnake_Data_dataLimit=2147483647,
    Hoopsnake_Data_resetCounter=True,
    Hoopsnake_Data_updateView=False,
    Hoopsnake_Data_autoUpdate=False)  # -> Feedback, LoopsCounter, IterationsCounter, IterationsCounter_2

pipe = Pipe(Curve=[hs22.LoopsCounter, ln], Radius=Slider(0.06, range=0..1), Caps=0)  # disabled
