# Grasshopper definition HoopSnake_tree_attractor.gh (Grasshopper 0.8.66)

line = Line(Line((6, 0, 0), (6, 0, 4)))

# ---- group: Attractor
pt = Point(Point(6, 1, 13))

# ---- group: Branching
end = EndPoints(Curve=hs22.Feedback)  # -> Start, End
vec2pt = Vector2Pt(PointA=end.Start, PointB=end.End, Unitize=False)  # -> Vector, Length
multiplication = Multiplication(A=vec2pt.Length, B=Slider(0.332, range=0..1))
circle = CircleCNR(Center=end.End, Normal=vec2pt.Vector, Radius=multiplication)
multiplication_2 = Multiplication(A=vec2pt.Vector, B=Slider(0.855, range=0..1))
move = Move(Geometry=circle, Motion=multiplication_2)  # -> graft(Geometry), Transform
lng = ListLength(List=move.Geometry)
random = Random(Range=Domain(0, 0.5), Number=lng, Seed=hs22.IterationsCounter_2, Integers=False)
_0_5 = Addition(A=random, B=0.5)
eval = EvaluateLength(Curve=move.Geometry, Length=[random, _0_5], Normalized=True)  # -> Point, Tangent, Parameter

# ---- group: Attractor (continued)
dist = Distance(PointA=pt, PointB=eval.Point)
vec2pt_2 = Vector2Pt(PointA=pt, PointB=eval.Point, Unitize=True)  # -> Vector, Length
one_over_x = OneOverX(Value=dist)
multiplication_3 = Multiplication(A=vec2pt_2.Vector, B=Slider(11.569, range=0..40))
sqr = Square(Value=one_over_x)
multiplication_4 = Multiplication(A=multiplication_3, B=sqr)
move_2 = Move(Geometry=eval.Point, Motion=multiplication_4)  # -> Geometry, Transform

# ----
ln = Line(StartPoint=graft(end.End), EndPoint=move_2.Geometry)
hs22 = HoopSnake(
    StartingData=line,
    Data=ln,
    Hoopsnake_Data_dataLimit=2147483647,
    Hoopsnake_Data_resetCounter=True,
    Hoopsnake_Data_updateView=False,
    Hoopsnake_Data_autoUpdate=False)  # -> Feedback, LoopsCounter, IterationsCounter, IterationsCounter_2

pipe = Pipe(Curve=[hs22.LoopsCounter, ln], Radius=Slider(0.06, range=0..1), Caps=0)  # disabled
