# Grasshopper definition colourbynumberstoreys.gh (Grasshopper 1.0.7)

storey_colours_v1_0 = Panel("Tom Dufficy 2023")

geometry = Brep([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])
preview = CustomPreview(Geometry=geometry, Shader=ColourSwatch(SwatchColor=RGB(255, 255, 255)))

# ---- group: Group Vertically Aligned Volumes
geo = Geometry(geometry)
volume = Volume(Geometry=geo)  # -> Volume, Centroid
pdecon = Deconstruct(Point=volume.Centroid)  # -> XComponent, YComponent, ZComponent
pt = ConstructPoint(XCoordinate=pdecon.XComponent, YCoordinate=pdecon.YComponent, ZCoordinate="0")
cset = CreateSet(List=pt)  # -> Set, Map
sort = SortList(Keys=cset.Map, ValuesA=geo)  # -> Keys, ValuesA
mindex = MemberIndex(Set=pt, Member=cset.Set)  # -> Index, Count
partition = PartitionList(List=sort.ValuesA, Size=mindex.Count)
volume_2 = Volume(Geometry=partition)  # -> Volume, Centroid
pdecon_2 = Deconstruct(Point=volume_2.Centroid)  # -> XComponent, YComponent, ZComponent
sort_2 = SortList(Keys=pdecon_2.ZComponent, ValuesA=partition)  # -> Keys, ValuesA
brep = Brep(sort_2.ValuesA)

# ----
lng = ListLength(List=brep)  # -> flatten(Length)
bnd = Bounds(Numbers=lng)
dedomain = DeconstructDomain(Domain=bnd)  # -> Start, End
gradient = Gradient(
    LowerLimit=dedomain.End,
    UpperLimit=dedomain.Start,
    Parameter=lng,
    stops=[0.15: RGB(255, 130, 160), 0.85: RGB(220, 0, 40)])
preview_2 = CustomPreview(Geometry=brep, Shader=graft(gradient))
