# Grasshopper definition createhatches_v1.1.gh (Grasshopper 1.0.7)
# plug-ins: Human

# Generate Hatches v1.1: Tom Dufficy 2023
# 
# Required plugins: Human
geo = Geometry([<brep referenced from the Rhino model> x13])

# ---- group: Hatch Names Reference
hatchtable = HatchTable(Update=True)
panel = Panel(hatchtable)

# ----
objatts = ObjectAttributes(ObjectOrAttributes=geo)  # -> Name, graft(LayerName), LayerFullPath, Color, MaterialName, LinetypeName, GroupIndices, PlotWeight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
debrep = DeconstructBrep(Brep=geo)  # -> Faces, Edges, Vertices
area = Area(Geometry=debrep.Faces)  # -> Area, Centroid
pdecon = Deconstruct(Point=area.Centroid)  # -> XComponent, YComponent, ZComponent
sort = SortList(Keys=pdecon.ZComponent, ValuesA=debrep.Faces)  # -> Keys, ValuesA
item = ListItem(List=sort.ValuesA, Index=0, Wrap=True)
debrep_2 = DeconstructBrep(Brep=item)  # -> Faces, Edges, Vertices
button = Button()
join = JoinCurves(Curves=debrep_2.Edges, Preserve=False)
createatts = CreateAttributes(LayerName=objatts.LayerName, enableFullPath=False)
trim = TrimTree(Tree=join, Depth=2)
crv = Curve(trim)
deg = Degrees(Radians="45")
createhatch = CreateHatch(Bake=button, Curves=crv, HatchPatternName="Hatch1", HatchScale="2", HatchRotation=deg, Attributes=createatts)  # -> HatchGeometry, HatchObjects
bake = BakeGeometry(Bake=button, Geometry=crv, Attributes=createatts, DeleteOldBakes=False, PreserveTrees=False)
