# Grasshopper definition makewindowmullions.gh (Grasshopper 1.0.7)

crv = Curve([<curve referenced from the Rhino model> x4])
divlength = DivideLength(Curve=crv, Length=Slider(2, range=0..10))  # -> Points, Tangents, Parameters
number_slider = Slider(4, range=0..10)
Z = UnitZ(Factor=1)
pt = Point(divlength.Points)
line = LineSDL(Start=pt, Direction=Z, Length=number_slider)
hframe = HorizontalFrame(Curve=graft(crv), Parameter=divlength.Parameters)
number_slider_2 = Slider(0.02, range=0..0.1)
division = Division(A=number_slider, B=2)
Z_2 = UnitZ(Factor=division)
box = CenterBox(Base=hframe, X=number_slider_2, Y=number_slider_2, Z=division)
move = Move(Geometry=box, Motion=Z_2)  # -> Geometry, Transform
