# Grasshopper definition projectroadonsurface.gh (Grasshopper 1.0.7)

crv = Curve(<curve referenced from the Rhino model>)
srf = Surface(<surface referenced from the Rhino model>)
project = Project(Curve=crv, Brep=srf, Direction=Vector(0, 0, 1))
Z = UnitZ(Factor=Slider(1, range=0..10))
move = Move(Geometry=project, Motion=Z)  # -> Geometry, Transform
divide = DivideCurve(Curve=move.Geometry, Count=Slider(25, range=0..100), Kinks=False)  # -> Points, Tangents, Parameters
hframe = HorizontalFrame(Curve=project, Parameter=divide.Parameters)
number_slider = Slider(2.5, range=0..10)
deplane = DeconstructPlane(Plane=hframe)  # -> Origin, XAxis, YAxis, ZAxis
rectangle = Rectangle(Plane=hframe, XSize=Domain(-1, 1), YSize=Domain(-2, 2), Radius=0)  # -> Rectangle, Length
neg = Negative(Value=number_slider)
line = LineSDL(Start=deplane.Origin, Direction=deplane.YAxis, Length=neg)
line_2 = LineSDL(Start=deplane.Origin, Direction=deplane.YAxis, Length=number_slider)
Z_2 = UnitZ(Factor=Slider(1, range=0..10))
join = JoinCurves(Curves=[line_2, line], Preserve=False)
extr = Extrude(Base=join, Direction=Z_2)
loft = Loft(Curves=extr, Options={Adjust=False, Closed=False, LoftEnds=0, LoftSimp=0, LoftType=0, Rebuild=10, Refit=0.01})
cap = CapHoles(Brep=loft)
