# Grasshopper definition quickfacadegenerator.gh (Grasshopper 1.0.7)

number_slider = Slider(3.75, range=0..10)
crv = Curve(<curve referenced from the Rhino model>)
divide = DivideCurve(Curve=crv, Count=Slider(66, range=0..100), Kinks=False)  # -> Points, Tangents, Parameters
Z = UnitZ(Factor=1)
line = LineSDL(Start=divide.Points, Direction=expr("-x", Z), Length=number_slider)
shatter = Shatter(Curve=crv, Parameters=divide.Parameters)
Z_2 = UnitZ(Factor=number_slider)
pipe = Pipe(Curve=line, Radius=Slider(0.05, range=0..0.1), Caps=0)
neg = Negative(Value=Z_2)
extr = Extrude(Base=shatter, Direction=neg)
