# Grasshopper definition Abstandsflaechen_tjd.gh (Grasshopper 1.0.7)
# plug-ins: Pufferfish

# ---- group: Input Here
factor = Slider(0.4, range=0..1)  # disabled
geometry_input = Geometry([<brep referenced from the Rhino model> x19])  # disabled

# ----
abstandsflaechen_factor = Slider(0.4, range=0..1)  # disabled
minimum_value = Slider(2.5, range=0..20)  # disabled
geometry = Brep([<brep referenced from the Rhino model> x16])  # disabled

number_slider = Slider(0.4, range=0..1)  # disabled
brep = Brep([<brep referenced from the Rhino model> x65])  # disabled

number_slider_2 = Slider(0.4, range=0..1)  # disabled
geometry_2 = Brep([<brep referenced from the Rhino model> x312])  # disabled

geometry_3 = Geometry(geometry_input)  # disabled
sunion = SolidUnion(Breps=geometry_3)  # disabled
merge_faces = MergeFaces(Brep=sunion)  # -> Breps, Before, After; disabled

# ---- group: Group Vertically Aligned Volumes
geo = Geometry(brep)  # disabled
volume = Volume(Geometry=geo)  # -> Volume, Centroid; disabled
pdecon = Deconstruct(Point=volume.Centroid)  # -> XComponent, YComponent, ZComponent; disabled
panel = Panel("0")  # disabled
pt = ConstructPoint(XCoordinate=pdecon.XComponent, YCoordinate=pdecon.YComponent, ZCoordinate=panel)  # disabled
cset = CreateSet(List=pt)  # -> Set, Map; disabled
sort = SortList(Keys=cset.Map, ValuesA=geo)  # -> Keys, ValuesA; disabled
mindex = MemberIndex(Set=pt, Member=cset.Set)  # -> Index, Count; disabled
partition = PartitionList(List=sort.ValuesA, Size=mindex.Count)  # disabled
volume_2 = Volume(Geometry=partition)  # -> Volume, Centroid; disabled
pdecon_2 = Deconstruct(Point=volume_2.Centroid)  # -> XComponent, YComponent, ZComponent; disabled
sort_2 = SortList(Keys=pdecon_2.ZComponent, ValuesA=partition)  # -> Keys, ValuesA; disabled
brep_2 = Brep(sort_2.ValuesA)  # disabled

geo_2 = Geometry(geometry_2)  # disabled
volume_3 = Volume(Geometry=geo_2)  # -> Volume, Centroid; disabled
pdecon_3 = Deconstruct(Point=volume_3.Centroid)  # -> XComponent, YComponent, ZComponent; disabled
panel_2 = Panel("0")  # disabled
pt_2 = ConstructPoint(XCoordinate=pdecon_3.XComponent, YCoordinate=pdecon_3.YComponent, ZCoordinate=panel_2)  # disabled
cset_2 = CreateSet(List=pt_2)  # -> Set, Map; disabled
sort_3 = SortList(Keys=cset_2.Map, ValuesA=geo_2)  # -> Keys, ValuesA; disabled
mindex_2 = MemberIndex(Set=pt_2, Member=cset_2.Set)  # -> Index, Count; disabled
partition_2 = PartitionList(List=sort_3.ValuesA, Size=mindex_2.Count)  # disabled
volume_4 = Volume(Geometry=partition_2)  # -> Volume, Centroid; disabled
pdecon_4 = Deconstruct(Point=volume_4.Centroid)  # -> XComponent, YComponent, ZComponent; disabled
sort_4 = SortList(Keys=pdecon_4.ZComponent, ValuesA=partition_2)  # -> Keys, ValuesA; disabled
brep_3 = Brep(sort_4.ValuesA)  # disabled

# ----
deconstruct_brep = DeconstructBrep(Brep=merge_faces.Breps)  # -> Faces, Edges, Vertices; disabled
brep_edges = BrepEdges(Brep=deconstruct_brep.Faces)  # -> Naked, Interior, NonManifold; disabled
curve_middle = CurveMiddle(Curve=brep_edges.Naked)  # disabled
deconstruct = Deconstruct(Point=curve_middle)  # -> XComponent, YComponent, ZComponent; disabled
sort_list = SortList(Keys=deconstruct.ZComponent, ValuesValuesA=curve_middle)  # -> Keys, ValuesValuesA; disabled
list_item = ListItem(List=sort_list.Keys, Index=0, Wrap=True)  # disabled
expression = Expression(x=list_item, Expression="Format(\"{0:0}\",x)")  # disabled
panel_3 = Panel("0")  # disabled
equality = Equality(FirstNumber=expression, SecondNumber=panel_3)  # -> Equality, Inequality; disabled
trim_tree = TrimTree(Tree=equality.Equality, Depth=1)  # disabled
dispatch = Dispatch(List=deconstruct_brep.Faces, DispatchPattern=trim_tree)  # -> ListA, ListB; disabled
geometry_4 = Geometry(dispatch.ListA)  # disabled

abstandsflaechen_factor_2 = Slider(0.4, range=0..1)
minimum_value_2 = Slider(2.5, range=0..20)
geometry_5 = Brep([<brep referenced from the Rhino model> x117])

# ---- group: Group Vertically Aligned Volumes
geo_3 = Geometry(geometry)  # disabled
volume_5 = Volume(Geometry=geo_3)  # -> Volume, Centroid; disabled
pdecon_5 = Deconstruct(Point=volume_5.Centroid)  # -> XComponent, YComponent, ZComponent; disabled
panel_4 = Panel("0")  # disabled
pt_3 = ConstructPoint(XCoordinate=pdecon_5.XComponent, YCoordinate=pdecon_5.YComponent, ZCoordinate=panel_4)  # disabled
cset_3 = CreateSet(List=pt_3)  # -> Set, Map; disabled
sort_5 = SortList(Keys=cset_3.Map, ValuesA=geo_3)  # -> Keys, ValuesA; disabled
mindex_3 = MemberIndex(Set=pt_3, Member=cset_3.Set)  # -> Index, Count; disabled
partition_3 = PartitionList(List=sort_5.ValuesA, Size=mindex_3.Count)  # disabled
volume_6 = Volume(Geometry=partition_3)  # -> Volume, Centroid; disabled
pdecon_6 = Deconstruct(Point=volume_6.Centroid)  # -> XComponent, YComponent, ZComponent; disabled
sort_6 = SortList(Keys=pdecon_6.ZComponent, ValuesA=partition_3)  # -> Keys, ValuesA; disabled
brep_4 = Brep(sort_6.ValuesA)  # disabled

geo_4 = Geometry(geometry_5)
volume_7 = Volume(Geometry=geo_4)  # -> Volume, Centroid
pdecon_7 = Deconstruct(Point=volume_7.Centroid)  # -> XComponent, YComponent, ZComponent
pt_4 = ConstructPoint(XCoordinate=pdecon_7.XComponent, YCoordinate=pdecon_7.YComponent, ZCoordinate="0")
cset_4 = CreateSet(List=pt_4)  # -> Set, Map
sort_7 = SortList(Keys=cset_4.Map, ValuesA=geo_4)  # -> Keys, ValuesA
mindex_4 = MemberIndex(Set=pt_4, Member=cset_4.Set)  # -> Index, Count
partition_4 = PartitionList(List=sort_7.ValuesA, Size=mindex_4.Count)
volume_8 = Volume(Geometry=partition_4)  # -> Volume, Centroid
pdecon_8 = Deconstruct(Point=volume_8.Centroid)  # -> XComponent, YComponent, ZComponent
sort_8 = SortList(Keys=pdecon_8.ZComponent, ValuesA=partition_4)  # -> Keys, ValuesA
brep_5 = Brep(sort_8.ValuesA)

# ---- group: Get top and bottom surface
lastdex = LastIndex(List=brep_3)  # disabled
item = ListItem(List=brep_3, Index=0, Wrap=True)  # disabled
item_2 = ListItem(List=brep_3, Index=lastdex, Wrap=True)  # disabled
debrep = DeconstructBrep(Brep=item)  # -> Faces, Edges, Vertices; disabled
debrep_2 = DeconstructBrep(Brep=item_2)  # -> Faces, Edges, Vertices; disabled
area = Area(Geometry=debrep.Faces)  # -> Area, Centroid; disabled
area_2 = Area(Geometry=debrep_2.Faces)  # -> Area, Centroid; disabled
pdecon_9 = Deconstruct(Point=area.Centroid)  # -> XComponent, YComponent, ZComponent; disabled
pdecon_10 = Deconstruct(Point=area_2.Centroid)  # -> XComponent, YComponent, ZComponent; disabled
sort_9 = SortList(Keys=pdecon_9.ZComponent, ValuesA=debrep.Faces)  # -> Keys, ValuesA; disabled
sort_10 = SortList(Keys=pdecon_10.ZComponent, ValuesA=debrep_2.Faces)  # -> Keys, ValuesA; disabled
item_3 = ListItem(List=reverse(sort_10.ValuesA), Index=0, Wrap=True)  # disabled
item_4 = ListItem(List=sort_9.ValuesA, Index=0, Wrap=True)  # disabled
flatten = FlattenTree(Tree=item_3, Path="{0}")  # disabled
flatten_2 = FlattenTree(Tree=item_4, Path="{0}")  # disabled
join = JoinCurves(Curves=flatten, Preserve=False)  # disabled
join_2 = JoinCurves(Curves=flatten_2, Preserve=False)  # disabled

lastdex_2 = LastIndex(List=brep_2)  # disabled
item_5 = ListItem(List=brep_2, Index=0, Wrap=True)  # disabled
item_6 = ListItem(List=brep_2, Index=lastdex_2, Wrap=True)  # disabled
debrep_3 = DeconstructBrep(Brep=item_5)  # -> Faces, Edges, Vertices; disabled
debrep_4 = DeconstructBrep(Brep=item_6)  # -> Faces, Edges, Vertices; disabled
area_3 = Area(Geometry=debrep_3.Faces)  # -> Area, Centroid; disabled
area_4 = Area(Geometry=debrep_4.Faces)  # -> Area, Centroid; disabled
pdecon_11 = Deconstruct(Point=area_3.Centroid)  # -> XComponent, YComponent, ZComponent; disabled
pdecon_12 = Deconstruct(Point=area_4.Centroid)  # -> XComponent, YComponent, ZComponent; disabled
sort_11 = SortList(Keys=pdecon_11.ZComponent, ValuesA=debrep_3.Faces)  # -> Keys, ValuesA; disabled
sort_12 = SortList(Keys=pdecon_12.ZComponent, ValuesA=debrep_4.Faces)  # -> Keys, ValuesA; disabled
item_7 = ListItem(List=reverse(sort_12.ValuesA), Index=0, Wrap=True)  # disabled
item_8 = ListItem(List=sort_11.ValuesA, Index=0, Wrap=True)  # disabled
flatten_3 = FlattenTree(Tree=item_7, Path="{0}")  # disabled
flatten_4 = FlattenTree(Tree=item_8, Path="{0}")  # disabled
join_3 = JoinCurves(Curves=flatten_3, Preserve=False)  # disabled
join_4 = JoinCurves(Curves=flatten_4, Preserve=False)  # disabled

# ---- group: separate sides from bottom
deconstruct_brep_2 = DeconstructBrep(Brep=geometry_4)  # -> Faces, Edges, Vertices; disabled
trim_tree_2 = TrimTree(Tree=deconstruct_brep_2.Faces, Depth=1)  # disabled
area_5 = Area(Geometry=trim_tree_2)  # -> Area, Centroid; disabled
deconstruct_2 = Deconstruct(Point=area_5.Centroid)  # -> XComponent, YComponent, ZComponent; disabled
expression_2 = Expression(x=deconstruct_2.ZComponent, Expression="Format(\"{0:0}\",x)")  # disabled
panel_5 = Panel("0")  # disabled
equality_2 = Equality(FirstNumber=expression_2, SecondNumber=panel_5)  # -> Equality, Inequality; disabled
dispatch_2 = Dispatch(List=trim_tree_2, DispatchPattern=equality_2.Equality)  # -> ListA, ListB; disabled
side_faces = Geometry(dispatch_2.ListB)  # disabled

# ---- group: Get top and bottom surface
lastdex_3 = LastIndex(List=brep_4)  # disabled
item_9 = ListItem(List=brep_4, Index=0, Wrap=True)  # disabled
item_10 = ListItem(List=brep_4, Index=lastdex_3, Wrap=True)  # disabled
debrep_5 = DeconstructBrep(Brep=item_9)  # -> Faces, Edges, Vertices; disabled
debrep_6 = DeconstructBrep(Brep=item_10)  # -> Faces, Edges, Vertices; disabled
area_6 = Area(Geometry=debrep_5.Faces)  # -> Area, Centroid; disabled
area_7 = Area(Geometry=debrep_6.Faces)  # -> Area, Centroid; disabled
pdecon_13 = Deconstruct(Point=area_6.Centroid)  # -> XComponent, YComponent, ZComponent; disabled
pdecon_14 = Deconstruct(Point=area_7.Centroid)  # -> XComponent, YComponent, ZComponent; disabled
sort_13 = SortList(Keys=pdecon_13.ZComponent, ValuesA=debrep_5.Faces)  # -> Keys, ValuesA; disabled
sort_14 = SortList(Keys=pdecon_14.ZComponent, ValuesA=debrep_6.Faces)  # -> Keys, ValuesA; disabled
item_11 = ListItem(List=reverse(sort_14.ValuesA), Index=0, Wrap=True)  # disabled
item_12 = ListItem(List=sort_13.ValuesA, Index=0, Wrap=True)  # disabled
flatten_5 = FlattenTree(Tree=item_11, Path="{0}")  # disabled
flatten_6 = FlattenTree(Tree=item_12, Path="{0}")  # disabled
join_5 = JoinCurves(Curves=flatten_5, Preserve=False)  # disabled
join_6 = JoinCurves(Curves=flatten_6, Preserve=False)  # disabled

lastdex_4 = LastIndex(List=brep_5)
item_13 = ListItem(List=brep_5, Index=0, Wrap=True)
item_14 = ListItem(List=brep_5, Index=lastdex_4, Wrap=True)
debrep_7 = DeconstructBrep(Brep=item_13)  # -> Faces, Edges, Vertices
debrep_8 = DeconstructBrep(Brep=item_14)  # -> Faces, Edges, Vertices
area_8 = Area(Geometry=debrep_7.Faces)  # -> Area, Centroid
area_9 = Area(Geometry=debrep_8.Faces)  # -> Area, Centroid
pdecon_15 = Deconstruct(Point=area_8.Centroid)  # -> XComponent, YComponent, ZComponent
pdecon_16 = Deconstruct(Point=area_9.Centroid)  # -> XComponent, YComponent, ZComponent
sort_15 = SortList(Keys=pdecon_15.ZComponent, ValuesA=debrep_7.Faces)  # -> Keys, ValuesA
sort_16 = SortList(Keys=pdecon_16.ZComponent, ValuesA=debrep_8.Faces)  # -> Keys, ValuesA
item_15 = ListItem(List=reverse(sort_16.ValuesA), Index=0, Wrap=True)
item_16 = ListItem(List=sort_15.ValuesA, Index=0, Wrap=True)
flatten_7 = FlattenTree(Tree=item_15, Path="{0}")
flatten_8 = FlattenTree(Tree=item_16, Path="{0}")
join_7 = JoinCurves(Curves=flatten_7, Preserve=False)
join_8 = JoinCurves(Curves=flatten_8, Preserve=False)

# ---- group: Group touching buildings
number_slider_3 = Slider(-1, range=-1..200)  # disabled
toggle = BooleanToggle(True)  # disabled
c_script = CSharpScript(enable=toggle, cList=join_2, branch=number_slider_3)  # -> out, DucatiumAmamusDumSpiramus, clustersIndicesTree, demoContentList; inputs enable: Boolean, cList: list of Curve, branch: Int32; disabled
# ---------- c_script: C# usings ----------
using System.IO;
using System.Linq;
using System.Data;
using System.Drawing;
using System.Reflection;
using System.Windows.Forms;
using System.Xml;
using System.Xml.Linq;
using System.Runtime.InteropServices;

using Rhino.DocObjects;
using Rhino.Collections;
using GH_IO;
using GH_IO.Serialization;
# ---------- c_script: C# ----------
    // by The Lord of Darkness due to critical Vodka starvation issues

    if(!enable) return;

    cList = cList.Where(x => x != null && x is Curve).ToList();
    if(!cList.Any())return;

    System.Diagnostics.Stopwatch sw = new System.Diagnostics.Stopwatch();
    sw.Start();

    double tol = RhinoDoc.ActiveDoc.ModelAbsoluteTolerance;
    DataTree<int> conn = new DataTree<int>();
    ClusterCcx(cList, tol, ref conn);
    clustersIndicesTree = conn;  //>> out

    Print(" ");
    Print("Made: {0} clusters [{1} items]", conn.BranchCount, cList.Count);
    Print(" ");

    if(branch != -1){
      if(branch >= conn.BranchCount) branch = conn.BranchCount - 1;
      List<int> indices = conn.Branch(branch);
      List<Curve> cDemo = new List<Curve>();
      foreach(int index in indices) cDemo.Add(cList[index]);
      demoContentList = cDemo;  //>> out
    }
    else Print("Demo is disabled (branch = -1)");

    sw.Stop();
    DucatiumAmamusDumSpiramus = (string.Format("Elapsed: {0}ms", sw.Elapsed.TotalMilliseconds));
# ---------- c_script: C# additional code ----------
  public void  ClusterCcx(List <Curve> cList, double tol, ref DataTree < int > conn){

    bool[] Sampled = new bool[cList.Count];
    int branch = 0;

    for (int i = 0; i < cList.Count; i++){
      if(Sampled[i]) continue;
      List<int> clusterIndices = new List<int>();
      clusterIndices.Add(i);
      conn.Add(i, new GH_Path(branch));
      //  curveClusters.Add(cList[i], new GH_Path(branch));
      Sampled[i] = true;
      do{
        for (int j = 0; j < cList.Count; j++){
          if (j != clusterIndices[0] && !Sampled[j]){
            var ccx = Rhino.Geometry.Intersect.Intersection.CurveCurve(cList[clusterIndices[0]], cList[j], tol, 0);
            if (ccx.Count > 0){
              clusterIndices.Add(j);
              conn.Add(j, new GH_Path(branch));
              // curveClusters.Add(cList[j], new GH_Path(branch));
              Sampled[j] = true;
            }
          }
        }
        clusterIndices.RemoveAt(0);
      }while (clusterIndices.Count > 0);
      branch++;
    }
  }
# ---------- end c_script ----------
item_17 = ListItem(List=join_2, Index=c_script.clustersIndicesTree, Wrap=True)  # disabled
item_18 = ListItem(List=join, Index=c_script.clustersIndicesTree, Wrap=True)  # disabled

number_slider_4 = Slider(-1, range=-1..200)  # disabled
toggle_2 = BooleanToggle(True)  # disabled
c_script_2 = CSharpScript(enable=toggle_2, cList=join_4, branch=number_slider_4)  # -> out, DucatiumAmamusDumSpiramus, clustersIndicesTree, demoContentList; inputs enable: Boolean, cList: list of Curve, branch: Int32; disabled; same code as c_script
item_19 = ListItem(List=join_4, Index=c_script_2.clustersIndicesTree, Wrap=True)  # disabled
item_20 = ListItem(List=join_3, Index=c_script_2.clustersIndicesTree, Wrap=True)  # disabled

number_slider_5 = Slider(-1, range=-1..200)  # disabled
toggle_3 = BooleanToggle(True)  # disabled
c_script_3 = CSharpScript(enable=toggle_3, cList=join_6, branch=number_slider_5)  # -> out, DucatiumAmamusDumSpiramus, clustersIndicesTree, demoContentList; inputs enable: Boolean, cList: list of Curve, branch: Int32; disabled; same code as c_script
item_21 = ListItem(List=join_6, Index=c_script_3.clustersIndicesTree, Wrap=True)  # disabled
item_22 = ListItem(List=join_5, Index=c_script_3.clustersIndicesTree, Wrap=True)  # disabled

# ---- group: Calculate Distance
area_10 = Area(Geometry=item_18)  # -> Area, Centroid; disabled
area_11 = Area(Geometry=item_17)  # -> Area, Centroid; disabled
dist = Distance(PointA=area_10.Centroid, PointB=area_11.Centroid)  # disabled
multiplication = Multiplication(A=dist, B=number_slider_2)  # disabled

# ---- group: Offset and merge surfaces
crv = Curve(item_17)  # disabled
explode = Explode(Curve=crv, Recursive=True)  # -> Segments, Vertices; disabled
srf = Surface(crv)  # disabled
trim = TrimTree(Tree=explode.Segments, Depth=1)  # disabled
offset = OffsetCurve(Curve=trim, Distance=multiplication, Corners=0)  # disabled
trim_2 = TrimTree(Tree=offset, Depth=1)  # disabled
midpt = CurveMiddle(Curve=trim)  # disabled
midpt_2 = CurveMiddle(Curve=trim_2)  # disabled
vec2pt = Vector2Pt(PointA=midpt, PointB=midpt_2, Unitize=False)  # -> Vector, Length; disabled
extr = Extrude(Base=trim, Direction=vec2pt.Vector)  # disabled
vdisex = VectorDisplayEx(Point=midpt, Vector=vec2pt.Vector, Colour=RGB(0, 0, 0), Width=2)  # disabled
sunion_2 = SolidUnion(Breps=[extr, srf])  # disabled
fmerge = MergeFaces(Brep=sunion_2)  # -> Breps, Before, After; disabled
srf_2 = Surface(fmerge.Breps)  # disabled

# ---- group: Get bottom face
deconstruct_brep_3 = DeconstructBrep(Brep=side_faces)  # -> Faces, Edges, Vertices; disabled
curve_middle_2 = CurveMiddle(Curve=deconstruct_brep_3.Edges)  # disabled
deconstruct_3 = Deconstruct(Point=curve_middle_2)  # -> XComponent, YComponent, ZComponent; disabled
expression_3 = Expression(x=deconstruct_3.ZComponent, Expression="Format(\"{0:0}\",x)")  # disabled
panel_6 = Panel("0")  # disabled
equality_3 = Equality(FirstNumber=expression_3, SecondNumber=panel_6)  # -> Equality, Inequality; disabled
dispatch_3 = Dispatch(List=deconstruct_brep_3.Edges, DispatchPattern=equality_3.Equality)  # -> ListA, ListB; disabled
trim_tree_3 = TrimTree(Tree=dispatch_3.ListA, Depth=1)  # disabled

# ---- group: Group touching buildings
c_script_4 = CSharpScript(enable=Toggle(True), cList=join_8, branch=Slider(-1, range=-1..200))  # -> out, DucatiumAmamusDumSpiramus, clustersIndicesTree, demoContentList; inputs enable: Boolean, cList: list of Curve, branch: Int32; same code as c_script
item_23 = ListItem(List=join_8, Index=c_script_4.clustersIndicesTree, Wrap=True)
item_24 = ListItem(List=join_7, Index=c_script_4.clustersIndicesTree, Wrap=True)

# ---- group: Calculate Distance
area_12 = Area(Geometry=item_20)  # -> Area, Centroid; disabled
area_13 = Area(Geometry=item_19)  # -> Area, Centroid; disabled
dist_2 = Distance(PointA=area_12.Centroid, PointB=area_13.Centroid)  # disabled
multiplication_2 = Multiplication(A=dist_2, B=number_slider)  # disabled

# ---- group: Offset and join surfaces
crv_2 = Curve(item_19)  # disabled
explode_2 = Explode(Curve=crv_2, Recursive=True)  # -> Segments, Vertices; disabled
srf_3 = Surface(crv_2)  # disabled
trim_3 = TrimTree(Tree=explode_2.Segments, Depth=1)  # disabled
offset_2 = OffsetCurve(Curve=trim_3, Distance=multiplication_2, Corners=0)  # disabled
trim_4 = TrimTree(Tree=offset_2, Depth=2)  # disabled
midpt_3 = CurveMiddle(Curve=trim_3)  # disabled
midpt_4 = CurveMiddle(Curve=trim_4)  # disabled
vec2pt_2 = Vector2Pt(PointA=midpt_3, PointB=midpt_4, Unitize=False)  # -> Vector, Length; disabled
vdisex_2 = VectorDisplayEx(Point=midpt_3, Vector=vec2pt_2.Vector, Colour=RGB(0, 0, 0), Width=2)  # disabled
extr_2 = Extrude(Base=trim_3, Direction=vec2pt_2.Vector)  # disabled
sunion_3 = SolidUnion(Breps=[extr_2, srf_3])  # disabled
fmerge_2 = MergeFaces(Brep=sunion_3)  # -> Breps, Before, After; disabled
pln = Plane(fmerge_2.Breps)  # disabled

# ---- group: Calculate Distance
area_14 = Area(Geometry=item_22)  # -> Area, Centroid; disabled
area_15 = Area(Geometry=item_21)  # -> Area, Centroid; disabled
dist_3 = Distance(PointA=area_14.Centroid, PointB=area_15.Centroid)  # disabled
multiplication_3 = Multiplication(A=dist_3, B=abstandsflaechen_factor)  # disabled
num = Number(minimum_value)  # disabled
expression_4 = Expression(x=multiplication_3, y=num, Expression="if(x<y,y,x)")  # disabled

# ---- group: Offset and merge surfaces
crv_3 = Curve(item_21)  # disabled
explode_3 = Explode(Curve=crv_3, Recursive=True)  # -> Segments, Vertices; disabled
srf_4 = Surface(crv_3)  # disabled
graft = GraftTree(Tree=expression_4, IncludeEmptyLists=True, IncludeNullItems=True)  # disabled
simplify = SimplifyTree(Tree=explode_3.Segments, Front=False)  # disabled
simplify_2 = SimplifyTree(Tree=graft, Front=False)  # disabled
offset_3 = OffsetCurve(Curve=simplify, Distance=simplify_2, Corners=0)  # disabled
trim_5 = TrimTree(Tree=offset_3, Depth=1)  # disabled
midpt_5 = CurveMiddle(Curve=simplify)  # disabled
midpt_6 = CurveMiddle(Curve=trim_5)  # disabled
vec2pt_3 = Vector2Pt(PointA=midpt_5, PointB=midpt_6, Unitize=False)  # -> Vector, Length; disabled
extr_3 = Extrude(Base=simplify, Direction=vec2pt_3.Vector)  # disabled
vdisex_3 = VectorDisplayEx(Point=midpt_5, Vector=vec2pt_3.Vector, Colour=RGB(0, 0, 0), Width=2)  # disabled
trim_6 = TrimTree(Tree=extr_3, Depth=1)  # disabled
sunion_4 = SolidUnion(Breps=[srf_4, trim_6])  # disabled
debrep_9 = DeconstructBrep(Brep=sunion_4)  # -> Faces, Edges, Vertices; disabled
join_9 = BrepJoin(Breps=debrep_9.Faces)  # -> Breps, Closed; disabled
fmerge_3 = MergeFaces(Brep=join_9.Breps)  # -> Breps, Before, After; disabled
srf_5 = Surface(fmerge_3.Breps)  # disabled

# ----
srf_6 = Surface(srf_2)  # disabled

srf_7 = Surface(srf_5)  # disabled
brep_edges_2 = BrepEdges(Brep=srf_7)  # -> Naked, Interior, NonManifold; disabled
join_curves = JoinCurves(Curves=brep_edges_2.Naked, Preserve=False)  # disabled
curve = Curve(join_curves)  # disabled
surface_split = SurfaceSplit(Surface=flatten(srf_7), Curves=flatten(curve))  # -> flatten(Fragments); disabled
area_16 = Area(Geometry=surface_split)  # -> Area, Centroid; disabled
pt_5 = Point(area_16.Centroid)  # disabled
pdecon_17 = Deconstruct(Point=pt_5)  # -> XComponent, YComponent, ZComponent; disabled
number_slider_6 = Slider(2, range=0..10)  # disabled
number_slider_7 = Slider(2, range=0..10)  # disabled
number_slider_8 = Slider(2, range=0..10)  # disabled
eval = Evaluate(F="round(x,y)", x=pdecon_17.ZComponent, y=number_slider_6)  # disabled
eval_2 = Evaluate(F="round(x,y)", x=pdecon_17.YComponent, y=number_slider_7)  # disabled
eval_3 = Evaluate(F="round(x,y)", x=pdecon_17.XComponent, y=number_slider_8)  # disabled
pt_6 = ConstructPoint(XCoordinate=eval_3, YCoordinate=eval_2, ZCoordinate=eval)  # disabled
pt_7 = Point(pt_6)  # disabled
cset_5 = CreateSet(List=pt_7)  # -> Set, Map; disabled
index = ItemIndex(List=pt_7, Item=cset_5.Set)  # disabled
cull_i = CullIndex(List=surface_split, Indices=index, Wrap=True)  # disabled
overlapping_areas = Geometry(cull_i)  # disabled

geo_5 = Geometry(overlapping_areas)  # disabled
area_17 = Area(Geometry=geo_5)  # -> Area, Centroid; disabled
swatch = ColourSwatch(SwatchColor=RGB(255, 66, 66))  # disabled
swatch_2 = ColourSwatch(SwatchColor=RGB(204, 0, 0))  # disabled
preview = CustomPreview(Geometry=geo_5, Shader=swatch)  # disabled
tag = TextTag(Location=area_17.Centroid, Text="Conflict", Colour=swatch_2)  # disabled

srf_8 = Surface(srf_5)  # disabled
swatch_3 = ColourSwatch(SwatchColor=RGBA(148, 200, 255, 129))  # disabled
preview_2 = CustomPreview(Geometry=srf_8, Shader=swatch_3)  # disabled

number_slider_9 = Slider(0.4, range=0..1)  # disabled
brep_6 = Brep([<brep referenced from the Rhino model> x54])  # disabled

# ---- group: Group Vertically Aligned Volumes
geo_6 = Geometry(brep_6)  # disabled
volume_9 = Volume(Geometry=geo_6)  # -> Volume, Centroid; disabled
pdecon_18 = Deconstruct(Point=volume_9.Centroid)  # -> XComponent, YComponent, ZComponent; disabled
panel_7 = Panel("0")  # disabled
pt_8 = ConstructPoint(XCoordinate=pdecon_18.XComponent, YCoordinate=pdecon_18.YComponent, ZCoordinate=panel_7)  # disabled
cset_6 = CreateSet(List=pt_8)  # -> Set, Map; disabled
sort_17 = SortList(Keys=cset_6.Map, ValuesA=geo_6)  # -> Keys, ValuesA; disabled
mindex_5 = MemberIndex(Set=pt_8, Member=cset_6.Set)  # -> Index, Count; disabled
partition_5 = PartitionList(List=sort_17.ValuesA, Size=mindex_5.Count)  # disabled
volume_10 = Volume(Geometry=partition_5)  # -> Volume, Centroid; disabled
pdecon_19 = Deconstruct(Point=volume_10.Centroid)  # -> XComponent, YComponent, ZComponent; disabled
sort_18 = SortList(Keys=pdecon_19.ZComponent, ValuesA=partition_5)  # -> Keys, ValuesA; disabled
brep_7 = Brep(sort_18.ValuesA)  # disabled

# ---- group: Get top and bottom surface
lastdex_5 = LastIndex(List=brep_7)  # disabled
item_25 = ListItem(List=brep_7, Index=0, Wrap=True)  # disabled
item_26 = ListItem(List=brep_7, Index=lastdex_5, Wrap=True)  # disabled
debrep_10 = DeconstructBrep(Brep=item_25)  # -> Faces, Edges, Vertices; disabled
debrep_11 = DeconstructBrep(Brep=item_26)  # -> Faces, Edges, Vertices; disabled
area_18 = Area(Geometry=debrep_10.Faces)  # -> Area, Centroid; disabled
area_19 = Area(Geometry=debrep_11.Faces)  # -> Area, Centroid; disabled
pdecon_20 = Deconstruct(Point=area_18.Centroid)  # -> XComponent, YComponent, ZComponent; disabled
pdecon_21 = Deconstruct(Point=area_19.Centroid)  # -> XComponent, YComponent, ZComponent; disabled
sort_19 = SortList(Keys=pdecon_20.ZComponent, ValuesA=debrep_10.Faces)  # -> Keys, ValuesA; disabled
sort_20 = SortList(Keys=pdecon_21.ZComponent, ValuesA=debrep_11.Faces)  # -> Keys, ValuesA; disabled
item_27 = ListItem(List=reverse(sort_20.ValuesA), Index=0, Wrap=True)  # disabled
item_28 = ListItem(List=sort_19.ValuesA, Index=0, Wrap=True)  # disabled
flatten_9 = FlattenTree(Tree=item_27, Path="{0}")  # disabled
flatten_10 = FlattenTree(Tree=item_28, Path="{0}")  # disabled
area_20 = Area(Geometry=flatten_9)  # -> Area, Centroid; disabled
area_21 = Area(Geometry=flatten_10)  # -> Area, Centroid; disabled

# ---- group: Group touching buildings
number_slider_10 = Slider(-1, range=-1..200)  # disabled
toggle_4 = BooleanToggle(True)  # disabled
join_10 = JoinCurves(Curves=flatten_10, Preserve=False)  # disabled
c_script_5 = CSharpScript(enable=toggle_4, cList=join_10, branch=number_slider_10)  # -> out, DucatiumAmamusDumSpiramus, clustersIndicesTree, demoContentList; inputs enable: Boolean, cList: list of Curve, branch: Int32; disabled; same code as c_script
item_29 = ListItem(List=join_10, Index=c_script_5.clustersIndicesTree, Wrap=True)  # disabled
bottom_surfaces = Curve(item_29)  # disabled

# ---- group: sort lists to make consistent
area_22 = Area(Geometry=bottom_surfaces)  # -> Area, Centroid; disabled
pdecon_22 = Deconstruct(Point=area_22.Centroid)  # -> XComponent, YComponent, ZComponent; disabled
panel_8 = Panel("0")  # disabled
pt_9 = ConstructPoint(XCoordinate=pdecon_22.XComponent, YCoordinate=pdecon_22.YComponent, ZCoordinate=panel_8)  # disabled
sort_21 = SortList(Keys=pt_9, ValuesA=bottom_surfaces)  # -> Keys, ValuesA; disabled

# ----
panel_9 = Panel(sort_21.ValuesA)  # disabled

# ---- group: Offset base curves and merge
dist_4 = Distance(PointA=area_20.Centroid, PointB=area_21.Centroid)  # disabled
partition_6 = PartitionList(List=dist_4, Size=[3, 2])  # disabled
multiplication_4 = Multiplication(A=dist_4, B=number_slider_9)  # disabled
offset_4 = OffsetCurve(Curve=sort_21.ValuesA, Distance=multiplication_4, Corners=1)  # disabled
trim_7 = TrimTree(Tree=offset_4, Depth=1)  # disabled
runion = RegionUnion(Curves=trim_7)  # disabled

# ----
number_slider_11 = Slider(2, range=0..10)  # disabled
number_slider_12 = Slider(2, range=0..10)  # disabled
number_slider_13 = Slider(2, range=0..10)  # disabled
geo_7 = Geometry(dispatch_2.ListA)  # disabled

deconstruct_brep_4 = DeconstructBrep(Brep=side_faces)  # -> Faces, Edges, Vertices; disabled
brep_edges_3 = BrepEdges(Brep=deconstruct_brep_4.Faces)  # -> Naked, Interior, NonManifold; disabled
curve_middle_3 = CurveMiddle(Curve=brep_edges_3.Naked)  # disabled
deconstruct_4 = Deconstruct(Point=curve_middle_3)  # -> XComponent, YComponent, ZComponent; disabled
sort_list_2 = SortList(Keys=deconstruct_4.ZComponent, ValuesValuesA=curve_middle_3, ValuesA=brep_edges_3.Naked)  # -> Keys, ValuesValuesA, ValuesA; disabled
list_item_2 = ListItem(List=sort_list_2.ValuesValuesA, Index=0, Wrap=True)  # disabled
list_item_3 = ListItem(List=sort_list_2.ValuesA, Index=0, Wrap=True)  # disabled

trim_8 = TrimTree(Tree=list_item_2, Depth=2)  # disabled

pt_10 = Point(trim_8)  # disabled

crv_4 = Curve(trim_tree_3)  # disabled
join_11 = JoinCurves(Curves=crv_4, Preserve=False)  # disabled
area_23 = Area(Geometry=join_11)  # -> Area, Centroid; disabled
sort_22 = SortList(Keys=area_23.Area, ValuesA=join_11)  # -> Keys, ValuesA; disabled
rev = ReverseList(List=sort_22.ValuesA)  # disabled
item_30 = ListItem(List=rev, Index=0, Wrap=True)  # disabled
panel_10 = Panel("1")  # disabled
incurve = PointInCurve(Point=pt_10, Curve=item_30)  # -> Relationship, Point; disabled
equals = Equality(FirstNumber=incurve.Relationship, SecondNumber=panel_10)  # -> Equality, Inequality; disabled
dispatch_4 = Dispatch(List=side_faces, DispatchPattern=equals.Equality)  # -> ListA, ListB; disabled
geo_8 = Geometry(dispatch_4.ListA)  # disabled

# ---- group: Get sides and their respective bottom edge
geo_9 = Geometry(geo_8)  # disabled
deconstruct_brep_5 = DeconstructBrep(Brep=geo_9)  # -> Faces, Edges, Vertices; disabled
brep_edges_4 = BrepEdges(Brep=deconstruct_brep_5.Faces)  # -> Naked, Interior, NonManifold; disabled
curve_middle_4 = CurveMiddle(Curve=brep_edges_4.Naked)  # disabled
deconstruct_5 = Deconstruct(Point=curve_middle_4)  # -> XComponent, YComponent, ZComponent; disabled
sort_list_3 = SortList(Keys=deconstruct_5.ZComponent, ValuesValuesA=brep_edges_4.Naked)  # -> Keys, ValuesValuesA; disabled
list_item_4 = ListItem(List=sort_list_3.ValuesValuesA, Index=0, Wrap=True)  # disabled
trim_9 = TrimTree(Tree=list_item_4, Depth=2)  # disabled
join_12 = JoinCurves(Curves=trim_9, Preserve=False)  # disabled
simplify_3 = SimplifyCurve(Curve=join_12)  # -> Curve, Simplified; disabled
explode_4 = Explode(Curve=simplify_3.Curve, Recursive=True)  # -> Segments, Vertices; disabled
crv_5 = Curve(explode_4.Segments)  # disabled
geo_10 = Geometry(geo_9)  # disabled

# ---- group: Fold Down Sides
trim_10 = TrimTree(Tree=crv_5, Depth=2)  # disabled
geo_11 = Geometry(geo_10)  # disabled
crv_6 = Curve(trim_10)  # disabled
midpt_7 = CurveMiddle(Curve=crv_6)  # disabled
surface_closest_point = SurfaceClosestPoint(Point=midpt_7, Surface=geo_11)  # -> Point, UVPoint, Distance; disabled
evaluate_surface = EvaluateSurface(Surface=geo_11, Point=surface_closest_point.UVPoint)  # -> Point, Normal, UDirection, VDirection, Frame; disabled
pln_2 = Plane(evaluate_surface.Frame)  # disabled
deplane = DeconstructPlane(Plane=pln_2)  # -> Origin, XAxis, YAxis, ZAxis; disabled
rot3d = Rotate3D(Geometry=pln_2, Angle=1.570796327, Center=deplane.Origin, Axis=deplane.YAxis)  # -> Geometry, Transform; disabled
rotate = Rotate(Geometry=geo_11, Angle=1.570796327, Plane=rot3d.Geometry)  # -> Geometry, Transform; disabled

# ---- group: Scale folded down sides
number = Number(factor)  # disabled
scale_nu = ScaleNU(Geometry=rotate.Geometry, Plane=pln_2, ScaleX=1, ScaleY=1, ScaleZ=number)  # -> Geometry, Transform; disabled

# ----
trim_11 = TrimTree(Tree=scale_nu.Geometry, Depth=1)  # disabled
geo_12 = Geometry(trim_11)  # disabled

# ---- group: Combined surfaces
geo_13 = Geometry([geo_7, geo_12])  # disabled
join_13 = BrepJoin(Breps=geo_13)  # -> Breps, Closed; disabled
geo_14 = Geometry(join_13.Breps)  # disabled
merge_faces_2 = MergeFaces(Brep=geo_14)  # -> Breps, Before, After; disabled
geo_15 = Geometry(merge_faces_2.Breps)  # disabled
edges = BrepEdges(Brep=geo_15)  # -> Naked, Interior, NonManifold; disabled
join_14 = JoinCurves(Curves=edges.Naked, Preserve=False)  # disabled
crv_7 = Curve(join_14)  # disabled

# ---- group: Finding intersecting and overlapping areas
brep_edges_5 = BrepEdges(Brep=geo_15)  # -> Naked, Interior, NonManifold; disabled
join_curves_2 = JoinCurves(Curves=brep_edges_5.Naked, Preserve=False)  # disabled
curve_2 = Curve(join_curves_2)  # disabled
surface_split_2 = SurfaceSplit(Surface=flatten(geo_15), Curves=flatten(curve_2))  # -> flatten(Fragments); disabled
area_24 = Area(Geometry=surface_split_2)  # -> Area, Centroid; disabled
pt_11 = Point(area_24.Centroid)  # disabled
pdecon_23 = Deconstruct(Point=pt_11)  # -> XComponent, YComponent, ZComponent; disabled
number_slider_14 = Slider(2, range=0..10)  # disabled
number_slider_15 = Slider(2, range=0..10)  # disabled
number_slider_16 = Slider(2, range=0..10)  # disabled
eval_4 = Evaluate(F="round(x,y)", x=pdecon_23.ZComponent, y=number_slider_14)  # disabled
eval_5 = Evaluate(F="round(x,y)", x=pdecon_23.YComponent, y=number_slider_15)  # disabled
eval_6 = Evaluate(F="round(x,y)", x=pdecon_23.XComponent, y=number_slider_16)  # disabled
pt_12 = ConstructPoint(XCoordinate=eval_6, YCoordinate=eval_5, ZCoordinate=eval_4)  # disabled
pt_13 = Point(pt_12)  # disabled
cset_7 = CreateSet(List=pt_13)  # -> Set, Map; disabled
index_2 = ItemIndex(List=pt_13, Item=cset_7.Set)  # disabled
cull_i_2 = CullIndex(List=surface_split_2, Indices=index_2, Wrap=True)  # disabled
overlapping_areas_2 = Geometry(cull_i_2)  # disabled

# ----
area_25 = Area(Geometry=surface_split_2)  # -> Area, Centroid; disabled
pt_14 = Point(area_25.Centroid)  # disabled
pdecon_24 = Deconstruct(Point=pt_14)  # -> XComponent, YComponent, ZComponent; disabled
eval_7 = Evaluate(F="round(x,y)", x=pdecon_24.ZComponent, y=number_slider_11)  # disabled
eval_8 = Evaluate(F="round(x,y)", x=pdecon_24.YComponent, y=number_slider_12)  # disabled
eval_9 = Evaluate(F="round(x,y)", x=pdecon_24.XComponent, y=number_slider_13)  # disabled
pt_15 = ConstructPoint(XCoordinate=eval_9, YCoordinate=eval_8, ZCoordinate=eval_7)  # disabled
pt_16 = Point(pt_15)  # disabled
cset_8 = CreateSet(List=pt_16)  # -> Set, Map; disabled
index_3 = ItemIndex(List=pt_16, Item=cset_8.Set)  # disabled
cull_i_3 = CullIndex(List=surface_split_2, Indices=index_3, Wrap=True)  # disabled

surface_areas = Geometry(geo_15)  # disabled
boundary_curves = Curve(crv_7)  # disabled
conflict_areas = Geometry(overlapping_areas_2)  # disabled

# ---- group: Display
swatch_4 = ColourSwatch(SwatchColor=RGB(255, 255, 255))  # disabled
swatch_5 = ColourSwatch(SwatchColor=RGB(255, 66, 66))  # disabled
swatch_6 = ColourSwatch(SwatchColor=RGB(204, 0, 0))  # disabled
area_26 = Area(Geometry=conflict_areas)  # -> Area, Centroid; disabled
preview_3 = CustomPreview(Geometry=[boundary_curves, surface_areas], Shader=swatch_4)  # disabled
preview_4 = CustomPreview(Geometry=conflict_areas, Shader=swatch_5)  # disabled
tag_2 = TextTag(Location=area_26.Centroid, Text="Conflict", Colour=swatch_6)  # disabled

# ---- group: Calculate Distance
area_27 = Area(Geometry=item_24)  # -> Area, Centroid
area_28 = Area(Geometry=item_23)  # -> Area, Centroid
dist_5 = Distance(PointA=area_27.Centroid, PointB=area_28.Centroid)
multiplication_5 = Multiplication(A=dist_5, B=abstandsflaechen_factor_2)
num_2 = Number(minimum_value_2)
expression_5 = Expression(x=multiplication_5, y=num_2, Expression="if(x<y,y,x)")
graft_2 = GraftTree(Tree=expression_5, IncludeEmptyLists=True, IncludeNullItems=True)

# ---- group: Offset and merge surfaces
crv_8 = Curve(item_23)
explode_5 = Explode(Curve=crv_8, Recursive=True)  # -> Segments, Vertices
srf_9 = Surface(crv_8)

# ----
trim_12 = TrimTree(Tree=explode_5.Segments, Depth=1)

# ---- group: Calculate Distance (continued)
lng = ListLength(List=explode_5.Segments)
dup = DuplicateData(Data=graft_2, Number=lng, Order=True)

# ----
crv_9 = Curve(trim_12)
trim_13 = TrimTree(Tree=dup, Depth=1)

# ---- group: Offset and merge surfaces (continued)
offset_5 = OffsetCurve(Curve=explode_5.Segments, Distance=trim_13, Corners=0)
trim_14 = TrimTree(Tree=offset_5, Depth=2)
midpt_8 = CurveMiddle(Curve=crv_9)
midpt_9 = CurveMiddle(Curve=trim_14)
vec2pt_4 = Vector2Pt(PointA=midpt_8, PointB=midpt_9, Unitize=False)  # -> Vector, Length
extr_4 = Extrude(Base=crv_9, Direction=vec2pt_4.Vector)
vdisex_4 = VectorDisplayEx(Point=midpt_8, Vector=vec2pt_4.Vector, Colour=RGB(0, 0, 0), Width=2)
sunion_5 = SolidUnion(Breps=[extr_4, srf_9])
debrep_12 = DeconstructBrep(Brep=sunion_5)  # -> Faces, Edges, Vertices
join_15 = BrepJoin(Breps=debrep_12.Faces)  # -> Breps, Closed
fmerge_4 = MergeFaces(Brep=join_15.Breps)  # -> Breps, Before, After
srf_10 = Surface(fmerge_4.Breps)

# ----
srf_11 = Surface(srf_10)
brep_edges_6 = BrepEdges(Brep=srf_11)  # -> Naked, Interior, NonManifold
join_curves_3 = JoinCurves(Curves=brep_edges_6.Naked, Preserve=False)
curve_3 = Curve(join_curves_3)
surface_split_3 = SurfaceSplit(Surface=flatten(srf_11), Curves=flatten(curve_3))  # -> flatten(Fragments)
area_29 = Area(Geometry=surface_split_3)  # -> Area, Centroid
pt_17 = Point(area_29.Centroid)
pdecon_25 = Deconstruct(Point=pt_17)  # -> XComponent, YComponent, ZComponent
eval_10 = Evaluate(F="round(x,y)", x=pdecon_25.ZComponent, y=Slider(2, range=0..10))
eval_11 = Evaluate(F="round(x,y)", x=pdecon_25.YComponent, y=Slider(2, range=0..10))
eval_12 = Evaluate(F="round(x,y)", x=pdecon_25.XComponent, y=Slider(2, range=0..10))
pt_18 = ConstructPoint(XCoordinate=eval_12, YCoordinate=eval_11, ZCoordinate=eval_10)
pt_19 = Point(pt_18)
cset_9 = CreateSet(List=pt_19)  # -> Set, Map
index_4 = ItemIndex(List=pt_19, Item=cset_9.Set)
cull_i_4 = CullIndex(List=surface_split_3, Indices=index_4, Wrap=True)
overlapping_areas_3 = Geometry(cull_i_4)

geo_16 = Geometry(overlapping_areas_3)
area_30 = Area(Geometry=geo_16)  # -> Area, Centroid
preview_5 = CustomPreview(Geometry=geo_16, Shader=ColourSwatch(SwatchColor=RGB(255, 66, 66)))
tag_3 = TextTag(Location=area_30.Centroid, Text="Conflict", Colour=ColourSwatch(SwatchColor=RGB(204, 0, 0)))

srf_12 = Surface(srf_10)
preview_6 = CustomPreview(Geometry=srf_12, Shader=ColourSwatch(SwatchColor=RGBA(148, 200, 255, 129)))
