# Grasshopper definition Abstandsflaechen_v3.0.gh (Grasshopper 1.0.7)
# plug-ins: Pufferfish

# Add other version (eg folding down method) and other geometries to show how it works and make it a more complete solution)
abstandsflachen_v3_0 = Panel("Tom Dufficy 2023")

abstandsflaechen_factor = Slider(0.4, range=0..1)
minimum_value = Slider(2.5, range=0..20)
geometry = Brep([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])
preview = CustomPreview(Geometry=geometry, Shader=ColourSwatch(SwatchColor=RGB(255, 255, 255)))

# ---- group: Group Vertically Aligned Volumes
geo = Geometry(geometry)
volume = Volume(Geometry=geo)  # -> Volume, Centroid
pdecon = Deconstruct(Point=volume.Centroid)  # -> XComponent, YComponent, ZComponent
pt = ConstructPoint(XCoordinate=pdecon.XComponent, YCoordinate=pdecon.YComponent, ZCoordinate="0")
cset = CreateSet(List=pt)  # -> Set, Map
sort = SortList(Keys=cset.Map, ValuesA=geo)  # -> Keys, ValuesA
mindex = MemberIndex(Set=pt, Member=cset.Set)  # -> Index, Count
partition = PartitionList(List=sort.ValuesA, Size=mindex.Count)
volume_2 = Volume(Geometry=partition)  # -> Volume, Centroid
pdecon_2 = Deconstruct(Point=volume_2.Centroid)  # -> XComponent, YComponent, ZComponent
sort_2 = SortList(Keys=pdecon_2.ZComponent, ValuesA=partition)  # -> Keys, ValuesA
brep = Brep(sort_2.ValuesA)

# ---- group: Get top and bottom surface
lastdex = LastIndex(List=brep)
item = ListItem(List=brep, Index=0, Wrap=True)
item_2 = ListItem(List=brep, Index=lastdex, Wrap=True)
debrep = DeconstructBrep(Brep=item)  # -> Faces, Edges, Vertices
debrep_2 = DeconstructBrep(Brep=item_2)  # -> Faces, Edges, Vertices
area = Area(Geometry=debrep.Faces)  # -> Area, Centroid
area_2 = Area(Geometry=debrep_2.Faces)  # -> Area, Centroid
pdecon_3 = Deconstruct(Point=area.Centroid)  # -> XComponent, YComponent, ZComponent
pdecon_4 = Deconstruct(Point=area_2.Centroid)  # -> XComponent, YComponent, ZComponent
sort_3 = SortList(Keys=pdecon_3.ZComponent, ValuesA=debrep.Faces)  # -> Keys, ValuesA
sort_4 = SortList(Keys=pdecon_4.ZComponent, ValuesA=debrep_2.Faces)  # -> Keys, ValuesA
item_3 = ListItem(List=reverse(sort_4.ValuesA), Index=0, Wrap=True)
item_4 = ListItem(List=sort_3.ValuesA, Index=0, Wrap=True)
flatten = FlattenTree(Tree=item_3, Path="{0}")
flatten_2 = FlattenTree(Tree=item_4, Path="{0}")
join = JoinCurves(Curves=flatten, Preserve=False)
join_2 = JoinCurves(Curves=flatten_2, Preserve=False)

# ---- group: Group touching buildings
c_script = CSharpScript(enable=Toggle(True), cList=join_2, branch=Slider(-1, range=-1..200))  # -> out, DucatiumAmamusDumSpiramus, clustersIndicesTree, demoContentList; inputs enable: Boolean, cList: list of Curve, branch: Int32
# ---------- c_script: C# usings ----------
using System.IO;
using System.Linq;
using System.Data;
using System.Drawing;
using System.Reflection;
using System.Windows.Forms;
using System.Xml;
using System.Xml.Linq;
using System.Runtime.InteropServices;

using Rhino.DocObjects;
using Rhino.Collections;
using GH_IO;
using GH_IO.Serialization;
# ---------- c_script: C# ----------
    // by The Lord of Darkness due to critical Vodka starvation issues

    if(!enable) return;

    cList = cList.Where(x => x != null && x is Curve).ToList();
    if(!cList.Any())return;

    System.Diagnostics.Stopwatch sw = new System.Diagnostics.Stopwatch();
    sw.Start();

    double tol = RhinoDoc.ActiveDoc.ModelAbsoluteTolerance;
    DataTree<int> conn = new DataTree<int>();
    ClusterCcx(cList, tol, ref conn);
    clustersIndicesTree = conn;  //>> out

    Print(" ");
    Print("Made: {0} clusters [{1} items]", conn.BranchCount, cList.Count);
    Print(" ");

    if(branch != -1){
      if(branch >= conn.BranchCount) branch = conn.BranchCount - 1;
      List<int> indices = conn.Branch(branch);
      List<Curve> cDemo = new List<Curve>();
      foreach(int index in indices) cDemo.Add(cList[index]);
      demoContentList = cDemo;  //>> out
    }
    else Print("Demo is disabled (branch = -1)");

    sw.Stop();
    DucatiumAmamusDumSpiramus = (string.Format("Elapsed: {0}ms", sw.Elapsed.TotalMilliseconds));
# ---------- c_script: C# additional code ----------
  public void  ClusterCcx(List <Curve> cList, double tol, ref DataTree < int > conn){

    bool[] Sampled = new bool[cList.Count];
    int branch = 0;

    for (int i = 0; i < cList.Count; i++){
      if(Sampled[i]) continue;
      List<int> clusterIndices = new List<int>();
      clusterIndices.Add(i);
      conn.Add(i, new GH_Path(branch));
      //  curveClusters.Add(cList[i], new GH_Path(branch));
      Sampled[i] = true;
      do{
        for (int j = 0; j < cList.Count; j++){
          if (j != clusterIndices[0] && !Sampled[j]){
            var ccx = Rhino.Geometry.Intersect.Intersection.CurveCurve(cList[clusterIndices[0]], cList[j], tol, 0);
            if (ccx.Count > 0){
              clusterIndices.Add(j);
              conn.Add(j, new GH_Path(branch));
              // curveClusters.Add(cList[j], new GH_Path(branch));
              Sampled[j] = true;
            }
          }
        }
        clusterIndices.RemoveAt(0);
      }while (clusterIndices.Count > 0);
      branch++;
    }
  }
# ---------- end c_script ----------
item_5 = ListItem(List=join_2, Index=c_script.clustersIndicesTree, Wrap=True)
item_6 = ListItem(List=join, Index=c_script.clustersIndicesTree, Wrap=True)

# ---- group: Calculate Distance
area_3 = Area(Geometry=item_6)  # -> Area, Centroid
area_4 = Area(Geometry=item_5)  # -> Area, Centroid
dist = Distance(PointA=area_3.Centroid, PointB=area_4.Centroid)
multiplication = Multiplication(A=dist, B=abstandsflaechen_factor)
num = Number(minimum_value)
expression = Expression(x=multiplication, y=num, Expression="if(x<y,y,x)")

# ---- group: offset and merge surfaces
crv = Curve(item_5)
explode = Explode(Curve=crv, Recursive=True)  # -> Segments, Vertices
srf = Surface(crv)
lng = ListLength(List=explode.Segments)
simplify = SimplifyTree(Tree=expression, Front=False)
trim = TrimTree(Tree=lng, Depth=1)
trim_2 = TrimTree(Tree=explode.Segments, Depth=1)
stack = StackData(Data=simplify, Stack=trim)
offset = OffsetCurve(Curve=trim_2, Distance=stack, Corners=0)
trim_3 = TrimTree(Tree=offset, Depth=1)
midpt = CurveMiddle(Curve=trim_2)
midpt_2 = CurveMiddle(Curve=trim_3)
vec2pt = Vector2Pt(PointA=midpt, PointB=midpt_2, Unitize=False)  # -> Vector, Length
extr = Extrude(Base=trim_2, Direction=vec2pt.Vector)
vdisex = VectorDisplayEx(Point=midpt, Vector=vec2pt.Vector, Colour=RGB(0, 0, 0), Width=2)
runion = RegionUnion(Curves=[extr, srf])

# ----
boundary = BoundarySurfaces(Edges=runion)

# ---- group: offset and merge surfaces (continued)
srf_2 = Surface(boundary)

# ----
srf_3 = Surface(srf_2)
brep_edges = BrepEdges(Brep=srf_3)  # -> Naked, Interior, NonManifold
join_curves = JoinCurves(Curves=brep_edges.Naked, Preserve=False)
curve = Curve(join_curves)
surface_split = SurfaceSplit(Surface=flatten(srf_3), Curves=flatten(curve))  # -> flatten(Fragments)
area_5 = Area(Geometry=surface_split)  # -> Area, Centroid
pt_2 = Point(area_5.Centroid)
pdecon_5 = Deconstruct(Point=pt_2)  # -> XComponent, YComponent, ZComponent
eval = Evaluate(F="round(x,y)", x=pdecon_5.ZComponent, y=Slider(2, range=0..10))
eval_2 = Evaluate(F="round(x,y)", x=pdecon_5.YComponent, y=Slider(2, range=0..10))
eval_3 = Evaluate(F="round(x,y)", x=pdecon_5.XComponent, y=Slider(2, range=0..10))
pt_3 = ConstructPoint(XCoordinate=eval_3, YCoordinate=eval_2, ZCoordinate=eval)
pt_4 = Point(pt_3)
cset_2 = CreateSet(List=pt_4)  # -> Set, Map
index = ItemIndex(List=pt_4, Item=cset_2.Set)
cull_i = CullIndex(List=surface_split, Indices=index, Wrap=True)
overlapping_areas = Geometry(cull_i)

srf_4 = Surface(srf_2)
flatten_3 = FlattenTree(Tree=srf_4, Path="{0}")
lng_2 = ListLength(List=flatten_3)
wheel = ColourWheel(
    lng_2,
    ColourGrips_Style=10,
    ColourGrips_Grip=[3.639586234, 2.094395102, 4.188790205, 3.141592654],
    ColourGrips_Lum=[0.1, 0.5],
    ColourGrips_Range=[0.2617993878, 0.2617993878, 0.2617993878, 0.2617993878],
    ColourGrips_Sat=[0.2, 0.6])
preview_2 = CustomPreview(Geometry=flatten_3, Material=wheel)

geo_2 = Geometry(overlapping_areas)
area_6 = Area(Geometry=geo_2)  # -> Area, Centroid
preview_3 = CustomPreview(Geometry=geo_2, Shader=ColourSwatch(SwatchColor=RGB(255, 66, 66)))
tag = TextTag(Location=area_6.Centroid, Text="Conflict", Colour=ColourSwatch(SwatchColor=RGB(204, 0, 0)))
