# Grasshopper definition WIP_abstandsflaechen_folddownmethod.gh (Grasshopper 1.0.7)
# plug-ins: Pufferfish

# ---- group: Input Here
factor = Slider(0.4, range=0..1)  # disabled
geometry_input = Geometry([<brep referenced from the Rhino model> x19])  # disabled

# ----
abstandsflaechen_factor = Slider(0.4, range=0..1)  # disabled
minimum_value = Slider(2.5, range=0..20)  # disabled
geometry = Brep([<brep referenced from the Rhino model> x117])  # disabled

number_slider = Slider(0.4, range=0..1)  # disabled
brep = Brep([<brep referenced from the Rhino model> x65])  # disabled

number_slider_2 = Slider(0.4, range=0..1)  # disabled
geometry_2 = Brep([<brep referenced from the Rhino model> x117])  # disabled

geometry_3 = Geometry(geometry_input)  # disabled
sunion = SolidUnion(Breps=geometry_3)  # disabled
merge_faces = MergeFaces(Brep=sunion)  # -> Breps, Before, After; disabled

# ---- group: Group Vertically Aligned Volumes
geo = Geometry(brep)  # disabled
volume = Volume(Geometry=geo)  # -> Volume, Centroid; disabled
pdecon = Deconstruct(Point=volume.Centroid)  # -> XComponent, YComponent, ZComponent; disabled
panel = Panel("0")  # disabled
pt = ConstructPoint(XCoordinate=pdecon.XComponent, YCoordinate=pdecon.YComponent, ZCoordinate=panel)  # disabled
cset = CreateSet(List=pt)  # -> Set, Map; disabled
sort = SortList(Keys=cset.Map, ValuesA=geo)  # -> Keys, ValuesA; disabled
mindex = MemberIndex(Set=pt, Member=cset.Set)  # -> Index, Count; disabled
partition = PartitionList(List=sort.ValuesA, Size=mindex.Count)  # disabled
volume_2 = Volume(Geometry=partition)  # -> Volume, Centroid; disabled
pdecon_2 = Deconstruct(Point=volume_2.Centroid)  # -> XComponent, YComponent, ZComponent; disabled
sort_2 = SortList(Keys=pdecon_2.ZComponent, ValuesA=partition)  # -> Keys, ValuesA; disabled
brep_2 = Brep(sort_2.ValuesA)  # disabled

# ----
abstandsflaechen_factor_2 = Slider(0.4, range=0..1)
minimum_value_2 = Slider(2.5, range=0..20)
geometry_4 = Brep([<brep referenced from the Rhino model> x445])

# ---- group: Group Vertically Aligned Volumes
geo_2 = Geometry(geometry_2)  # disabled
volume_3 = Volume(Geometry=geo_2)  # -> Volume, Centroid; disabled
pdecon_3 = Deconstruct(Point=volume_3.Centroid)  # -> XComponent, YComponent, ZComponent; disabled
panel_2 = Panel("0")  # disabled
pt_2 = ConstructPoint(XCoordinate=pdecon_3.XComponent, YCoordinate=pdecon_3.YComponent, ZCoordinate=panel_2)  # disabled
cset_2 = CreateSet(List=pt_2)  # -> Set, Map; disabled
sort_3 = SortList(Keys=cset_2.Map, ValuesA=geo_2)  # -> Keys, ValuesA; disabled
mindex_2 = MemberIndex(Set=pt_2, Member=cset_2.Set)  # -> Index, Count; disabled
partition_2 = PartitionList(List=sort_3.ValuesA, Size=mindex_2.Count)  # disabled
volume_4 = Volume(Geometry=partition_2)  # -> Volume, Centroid; disabled
pdecon_4 = Deconstruct(Point=volume_4.Centroid)  # -> XComponent, YComponent, ZComponent; disabled
sort_4 = SortList(Keys=pdecon_4.ZComponent, ValuesA=partition_2)  # -> Keys, ValuesA; disabled
brep_3 = Brep(sort_4.ValuesA)  # disabled

# ----
abstandsflaechen_factor_3 = Slider(0.4, range=0..1)  # disabled
minimum_value_3 = Slider(2.5, range=0..20)  # disabled
geometry_5 = Brep([<brep referenced from the Rhino model> x15])  # disabled

deconstruct_brep = DeconstructBrep(Brep=merge_faces.Breps)  # -> Faces, Edges, Vertices; disabled
brep_edges = BrepEdges(Brep=deconstruct_brep.Faces)  # -> Naked, Interior, NonManifold; disabled
curve_middle = CurveMiddle(Curve=brep_edges.Naked)  # disabled
deconstruct = Deconstruct(Point=curve_middle)  # -> XComponent, YComponent, ZComponent; disabled
sort_list = SortList(Keys=deconstruct.ZComponent, ValuesValuesA=curve_middle)  # -> Keys, ValuesValuesA; disabled
list_item = ListItem(List=sort_list.Keys, Index=0, Wrap=True)  # disabled
expression = Expression(x=list_item, Expression="Format(\"{0:0}\",x)")  # disabled
panel_3 = Panel("0")  # disabled
equality = Equality(FirstNumber=expression, SecondNumber=panel_3)  # -> Equality, Inequality; disabled
trim_tree = TrimTree(Tree=equality.Equality, Depth=1)  # disabled
dispatch = Dispatch(List=deconstruct_brep.Faces, DispatchPattern=trim_tree)  # -> ListA, ListB; disabled
geometry_6 = Geometry(dispatch.ListA)  # disabled

abstandsflaechen_factor_4 = Slider(0.4, range=0..1)  # disabled
minimum_value_4 = Slider(2.5, range=0..20)  # disabled
geometry_7 = Brep([<brep referenced from the Rhino model> x117])  # disabled

abstandsflaechen_factor_5 = Slider(0.4, range=0..1)  # disabled
minimum_value_5 = Slider(2.5, range=0..20)  # disabled
geometry_8 = Brep([<brep referenced from the Rhino model> x26])  # disabled

# ---- group: Group Vertically Aligned Volumes
geo_3 = Geometry(geometry_4)
volume_5 = Volume(Geometry=geo_3)  # -> Volume, Centroid
pdecon_5 = Deconstruct(Point=volume_5.Centroid)  # -> XComponent, YComponent, ZComponent
pt_3 = ConstructPoint(XCoordinate=pdecon_5.XComponent, YCoordinate=pdecon_5.YComponent, ZCoordinate="0")
cset_3 = CreateSet(List=pt_3)  # -> Set, Map
sort_5 = SortList(Keys=cset_3.Map, ValuesA=geo_3)  # -> Keys, ValuesA
mindex_3 = MemberIndex(Set=pt_3, Member=cset_3.Set)  # -> Index, Count
partition_3 = PartitionList(List=sort_5.ValuesA, Size=mindex_3.Count)
volume_6 = Volume(Geometry=partition_3)  # -> Volume, Centroid
pdecon_6 = Deconstruct(Point=volume_6.Centroid)  # -> XComponent, YComponent, ZComponent
sort_6 = SortList(Keys=pdecon_6.ZComponent, ValuesA=partition_3)  # -> Keys, ValuesA
brep_4 = Brep(sort_6.ValuesA)

geo_4 = Geometry(geometry_5)  # disabled
volume_7 = Volume(Geometry=geo_4)  # -> Volume, Centroid; disabled
pdecon_7 = Deconstruct(Point=volume_7.Centroid)  # -> XComponent, YComponent, ZComponent; disabled
panel_4 = Panel("0")  # disabled
pt_4 = ConstructPoint(XCoordinate=pdecon_7.XComponent, YCoordinate=pdecon_7.YComponent, ZCoordinate=panel_4)  # disabled
cset_4 = CreateSet(List=pt_4)  # -> Set, Map; disabled
sort_7 = SortList(Keys=cset_4.Map, ValuesA=geo_4)  # -> Keys, ValuesA; disabled
mindex_4 = MemberIndex(Set=pt_4, Member=cset_4.Set)  # -> Index, Count; disabled
partition_4 = PartitionList(List=sort_7.ValuesA, Size=mindex_4.Count)  # disabled
volume_8 = Volume(Geometry=partition_4)  # -> Volume, Centroid; disabled
pdecon_8 = Deconstruct(Point=volume_8.Centroid)  # -> XComponent, YComponent, ZComponent; disabled
sort_8 = SortList(Keys=pdecon_8.ZComponent, ValuesA=partition_4)  # -> Keys, ValuesA; disabled
brep_5 = Brep(sort_8.ValuesA)  # disabled

geo_5 = Geometry(geometry)  # disabled
volume_9 = Volume(Geometry=geo_5)  # -> Volume, Centroid; disabled
pdecon_9 = Deconstruct(Point=volume_9.Centroid)  # -> XComponent, YComponent, ZComponent; disabled
panel_5 = Panel("0")  # disabled
pt_5 = ConstructPoint(XCoordinate=pdecon_9.XComponent, YCoordinate=pdecon_9.YComponent, ZCoordinate=panel_5)  # disabled
cset_5 = CreateSet(List=pt_5)  # -> Set, Map; disabled
sort_9 = SortList(Keys=cset_5.Map, ValuesA=geo_5)  # -> Keys, ValuesA; disabled
mindex_5 = MemberIndex(Set=pt_5, Member=cset_5.Set)  # -> Index, Count; disabled
partition_5 = PartitionList(List=sort_9.ValuesA, Size=mindex_5.Count)  # disabled
volume_10 = Volume(Geometry=partition_5)  # -> Volume, Centroid; disabled
pdecon_10 = Deconstruct(Point=volume_10.Centroid)  # -> XComponent, YComponent, ZComponent; disabled
sort_10 = SortList(Keys=pdecon_10.ZComponent, ValuesA=partition_5)  # -> Keys, ValuesA; disabled
brep_6 = Brep(sort_10.ValuesA)  # disabled

geo_6 = Geometry(geometry_8)  # disabled
volume_11 = Volume(Geometry=geo_6)  # -> Volume, Centroid; disabled
pdecon_11 = Deconstruct(Point=volume_11.Centroid)  # -> XComponent, YComponent, ZComponent; disabled
panel_6 = Panel("0")  # disabled
pt_6 = ConstructPoint(XCoordinate=pdecon_11.XComponent, YCoordinate=pdecon_11.YComponent, ZCoordinate=panel_6)  # disabled
cset_6 = CreateSet(List=pt_6)  # -> Set, Map; disabled
sort_11 = SortList(Keys=cset_6.Map, ValuesA=geo_6)  # -> Keys, ValuesA; disabled
mindex_6 = MemberIndex(Set=pt_6, Member=cset_6.Set)  # -> Index, Count; disabled
partition_6 = PartitionList(List=sort_11.ValuesA, Size=mindex_6.Count)  # disabled
volume_12 = Volume(Geometry=partition_6)  # -> Volume, Centroid; disabled
pdecon_12 = Deconstruct(Point=volume_12.Centroid)  # -> XComponent, YComponent, ZComponent; disabled
sort_12 = SortList(Keys=pdecon_12.ZComponent, ValuesA=partition_6)  # -> Keys, ValuesA; disabled
brep_7 = Brep(sort_12.ValuesA)  # disabled

geo_7 = Geometry(geometry_7)  # disabled
volume_13 = Volume(Geometry=geo_7)  # -> Volume, Centroid; disabled
pdecon_13 = Deconstruct(Point=volume_13.Centroid)  # -> XComponent, YComponent, ZComponent; disabled
panel_7 = Panel("0")  # disabled
pt_7 = ConstructPoint(XCoordinate=pdecon_13.XComponent, YCoordinate=pdecon_13.YComponent, ZCoordinate=panel_7)  # disabled
cset_7 = CreateSet(List=pt_7)  # -> Set, Map; disabled
sort_13 = SortList(Keys=cset_7.Map, ValuesA=geo_7)  # -> Keys, ValuesA; disabled
mindex_7 = MemberIndex(Set=pt_7, Member=cset_7.Set)  # -> Index, Count; disabled
partition_7 = PartitionList(List=sort_13.ValuesA, Size=mindex_7.Count)  # disabled
volume_14 = Volume(Geometry=partition_7)  # -> Volume, Centroid; disabled
pdecon_14 = Deconstruct(Point=volume_14.Centroid)  # -> XComponent, YComponent, ZComponent; disabled
sort_14 = SortList(Keys=pdecon_14.ZComponent, ValuesA=partition_7)  # -> Keys, ValuesA; disabled
brep_8 = Brep(sort_14.ValuesA)  # disabled

# ---- group: Get top and bottom surface
lastdex = LastIndex(List=brep_3)  # disabled
item = ListItem(List=brep_3, Index=0, Wrap=True)  # disabled
item_2 = ListItem(List=brep_3, Index=lastdex, Wrap=True)  # disabled
debrep = DeconstructBrep(Brep=item)  # -> Faces, Edges, Vertices; disabled
debrep_2 = DeconstructBrep(Brep=item_2)  # -> Faces, Edges, Vertices; disabled
area = Area(Geometry=debrep.Faces)  # -> Area, Centroid; disabled
area_2 = Area(Geometry=debrep_2.Faces)  # -> Area, Centroid; disabled
pdecon_15 = Deconstruct(Point=area.Centroid)  # -> XComponent, YComponent, ZComponent; disabled
pdecon_16 = Deconstruct(Point=area_2.Centroid)  # -> XComponent, YComponent, ZComponent; disabled
sort_15 = SortList(Keys=pdecon_15.ZComponent, ValuesA=debrep.Faces)  # -> Keys, ValuesA; disabled
sort_16 = SortList(Keys=pdecon_16.ZComponent, ValuesA=debrep_2.Faces)  # -> Keys, ValuesA; disabled
item_3 = ListItem(List=reverse(sort_16.ValuesA), Index=0, Wrap=True)  # disabled
item_4 = ListItem(List=sort_15.ValuesA, Index=0, Wrap=True)  # disabled
flatten = FlattenTree(Tree=item_3, Path="{0}")  # disabled
flatten_2 = FlattenTree(Tree=item_4, Path="{0}")  # disabled
join = JoinCurves(Curves=flatten, Preserve=False)  # disabled
join_2 = JoinCurves(Curves=flatten_2, Preserve=False)  # disabled

lastdex_2 = LastIndex(List=brep_2)  # disabled
item_5 = ListItem(List=brep_2, Index=0, Wrap=True)  # disabled
item_6 = ListItem(List=brep_2, Index=lastdex_2, Wrap=True)  # disabled
debrep_3 = DeconstructBrep(Brep=item_5)  # -> Faces, Edges, Vertices; disabled
debrep_4 = DeconstructBrep(Brep=item_6)  # -> Faces, Edges, Vertices; disabled
area_3 = Area(Geometry=debrep_3.Faces)  # -> Area, Centroid; disabled
area_4 = Area(Geometry=debrep_4.Faces)  # -> Area, Centroid; disabled
pdecon_17 = Deconstruct(Point=area_3.Centroid)  # -> XComponent, YComponent, ZComponent; disabled
pdecon_18 = Deconstruct(Point=area_4.Centroid)  # -> XComponent, YComponent, ZComponent; disabled
sort_17 = SortList(Keys=pdecon_17.ZComponent, ValuesA=debrep_3.Faces)  # -> Keys, ValuesA; disabled
sort_18 = SortList(Keys=pdecon_18.ZComponent, ValuesA=debrep_4.Faces)  # -> Keys, ValuesA; disabled
item_7 = ListItem(List=reverse(sort_18.ValuesA), Index=0, Wrap=True)  # disabled
item_8 = ListItem(List=sort_17.ValuesA, Index=0, Wrap=True)  # disabled
flatten_3 = FlattenTree(Tree=item_7, Path="{0}")  # disabled
flatten_4 = FlattenTree(Tree=item_8, Path="{0}")  # disabled
join_3 = JoinCurves(Curves=flatten_3, Preserve=False)  # disabled
join_4 = JoinCurves(Curves=flatten_4, Preserve=False)  # disabled

lastdex_3 = LastIndex(List=brep_4)
item_9 = ListItem(List=brep_4, Index=0, Wrap=True)
item_10 = ListItem(List=brep_4, Index=lastdex_3, Wrap=True)
debrep_5 = DeconstructBrep(Brep=item_9)  # -> Faces, Edges, Vertices
debrep_6 = DeconstructBrep(Brep=item_10)  # -> Faces, Edges, Vertices
area_5 = Area(Geometry=debrep_5.Faces)  # -> Area, Centroid
area_6 = Area(Geometry=debrep_6.Faces)  # -> Area, Centroid
pdecon_19 = Deconstruct(Point=area_5.Centroid)  # -> XComponent, YComponent, ZComponent
pdecon_20 = Deconstruct(Point=area_6.Centroid)  # -> XComponent, YComponent, ZComponent
sort_19 = SortList(Keys=pdecon_19.ZComponent, ValuesA=debrep_5.Faces)  # -> Keys, ValuesA
sort_20 = SortList(Keys=pdecon_20.ZComponent, ValuesA=debrep_6.Faces)  # -> Keys, ValuesA
item_11 = ListItem(List=reverse(sort_20.ValuesA), Index=0, Wrap=True)
item_12 = ListItem(List=sort_19.ValuesA, Index=0, Wrap=True)
flatten_5 = FlattenTree(Tree=item_11, Path="{0}")
flatten_6 = FlattenTree(Tree=item_12, Path="{0}")
join_5 = JoinCurves(Curves=flatten_5, Preserve=False)
join_6 = JoinCurves(Curves=flatten_6, Preserve=False)

lastdex_4 = LastIndex(List=brep_5)  # disabled
item_13 = ListItem(List=brep_5, Index=0, Wrap=True)  # disabled
item_14 = ListItem(List=brep_5, Index=lastdex_4, Wrap=True)  # disabled
debrep_7 = DeconstructBrep(Brep=item_13)  # -> Faces, Edges, Vertices; disabled
debrep_8 = DeconstructBrep(Brep=item_14)  # -> Faces, Edges, Vertices; disabled
area_7 = Area(Geometry=debrep_7.Faces)  # -> Area, Centroid; disabled
area_8 = Area(Geometry=debrep_8.Faces)  # -> Area, Centroid; disabled
pdecon_21 = Deconstruct(Point=area_7.Centroid)  # -> XComponent, YComponent, ZComponent; disabled
pdecon_22 = Deconstruct(Point=area_8.Centroid)  # -> XComponent, YComponent, ZComponent; disabled
sort_21 = SortList(Keys=pdecon_21.ZComponent, ValuesA=debrep_7.Faces)  # -> Keys, ValuesA; disabled
sort_22 = SortList(Keys=pdecon_22.ZComponent, ValuesA=debrep_8.Faces)  # -> Keys, ValuesA; disabled
item_15 = ListItem(List=reverse(sort_22.ValuesA), Index=0, Wrap=True)  # disabled
item_16 = ListItem(List=sort_21.ValuesA, Index=0, Wrap=True)  # disabled
flatten_7 = FlattenTree(Tree=item_15, Path="{0}")  # disabled
flatten_8 = FlattenTree(Tree=item_16, Path="{0}")  # disabled
join_7 = JoinCurves(Curves=flatten_7, Preserve=False)  # disabled
join_8 = JoinCurves(Curves=flatten_8, Preserve=False)  # disabled

# ---- group: separate sides from bottom
deconstruct_brep_2 = DeconstructBrep(Brep=geometry_6)  # -> Faces, Edges, Vertices; disabled
trim_tree_2 = TrimTree(Tree=deconstruct_brep_2.Faces, Depth=1)  # disabled
area_9 = Area(Geometry=trim_tree_2)  # -> Area, Centroid; disabled
deconstruct_2 = Deconstruct(Point=area_9.Centroid)  # -> XComponent, YComponent, ZComponent; disabled
expression_2 = Expression(x=deconstruct_2.ZComponent, Expression="Format(\"{0:0}\",x)")  # disabled
panel_8 = Panel("0")  # disabled
equality_2 = Equality(FirstNumber=expression_2, SecondNumber=panel_8)  # -> Equality, Inequality; disabled
dispatch_2 = Dispatch(List=trim_tree_2, DispatchPattern=equality_2.Equality)  # -> ListA, ListB; disabled
side_faces = Geometry(dispatch_2.ListB)  # disabled

# ---- group: Get top and bottom surface
lastdex_5 = LastIndex(List=brep_6)  # disabled
item_17 = ListItem(List=brep_6, Index=0, Wrap=True)  # disabled
item_18 = ListItem(List=brep_6, Index=lastdex_5, Wrap=True)  # disabled
debrep_9 = DeconstructBrep(Brep=item_17)  # -> Faces, Edges, Vertices; disabled
debrep_10 = DeconstructBrep(Brep=item_18)  # -> Faces, Edges, Vertices; disabled
area_10 = Area(Geometry=debrep_9.Faces)  # -> Area, Centroid; disabled
area_11 = Area(Geometry=debrep_10.Faces)  # -> Area, Centroid; disabled
pdecon_23 = Deconstruct(Point=area_10.Centroid)  # -> XComponent, YComponent, ZComponent; disabled
pdecon_24 = Deconstruct(Point=area_11.Centroid)  # -> XComponent, YComponent, ZComponent; disabled
sort_23 = SortList(Keys=pdecon_23.ZComponent, ValuesA=debrep_9.Faces)  # -> Keys, ValuesA; disabled
sort_24 = SortList(Keys=pdecon_24.ZComponent, ValuesA=debrep_10.Faces)  # -> Keys, ValuesA; disabled
item_19 = ListItem(List=reverse(sort_24.ValuesA), Index=0, Wrap=True)  # disabled
item_20 = ListItem(List=sort_23.ValuesA, Index=0, Wrap=True)  # disabled
flatten_9 = FlattenTree(Tree=item_19, Path="{0}")  # disabled
flatten_10 = FlattenTree(Tree=item_20, Path="{0}")  # disabled
join_9 = JoinCurves(Curves=flatten_9, Preserve=False)  # disabled
join_10 = JoinCurves(Curves=flatten_10, Preserve=False)  # disabled

lastdex_6 = LastIndex(List=brep_7)  # disabled
item_21 = ListItem(List=brep_7, Index=0, Wrap=True)  # disabled
item_22 = ListItem(List=brep_7, Index=lastdex_6, Wrap=True)  # disabled
debrep_11 = DeconstructBrep(Brep=item_21)  # -> Faces, Edges, Vertices; disabled
debrep_12 = DeconstructBrep(Brep=item_22)  # -> Faces, Edges, Vertices; disabled
area_12 = Area(Geometry=debrep_11.Faces)  # -> Area, Centroid; disabled
area_13 = Area(Geometry=debrep_12.Faces)  # -> Area, Centroid; disabled
pdecon_25 = Deconstruct(Point=area_12.Centroid)  # -> XComponent, YComponent, ZComponent; disabled
pdecon_26 = Deconstruct(Point=area_13.Centroid)  # -> XComponent, YComponent, ZComponent; disabled
sort_25 = SortList(Keys=pdecon_25.ZComponent, ValuesA=debrep_11.Faces)  # -> Keys, ValuesA; disabled
sort_26 = SortList(Keys=pdecon_26.ZComponent, ValuesA=debrep_12.Faces)  # -> Keys, ValuesA; disabled
item_23 = ListItem(List=reverse(sort_26.ValuesA), Index=0, Wrap=True)  # disabled
item_24 = ListItem(List=sort_25.ValuesA, Index=0, Wrap=True)  # disabled
flatten_11 = FlattenTree(Tree=item_23, Path="{0}")  # disabled
flatten_12 = FlattenTree(Tree=item_24, Path="{0}")  # disabled
join_11 = JoinCurves(Curves=flatten_11, Preserve=False)  # disabled
join_12 = JoinCurves(Curves=flatten_12, Preserve=False)  # disabled

lastdex_7 = LastIndex(List=brep_8)  # disabled
item_25 = ListItem(List=brep_8, Index=0, Wrap=True)  # disabled
item_26 = ListItem(List=brep_8, Index=lastdex_7, Wrap=True)  # disabled
debrep_13 = DeconstructBrep(Brep=item_25)  # -> Faces, Edges, Vertices; disabled
debrep_14 = DeconstructBrep(Brep=item_26)  # -> Faces, Edges, Vertices; disabled
area_14 = Area(Geometry=debrep_13.Faces)  # -> Area, Centroid; disabled
area_15 = Area(Geometry=debrep_14.Faces)  # -> Area, Centroid; disabled
pdecon_27 = Deconstruct(Point=area_14.Centroid)  # -> XComponent, YComponent, ZComponent; disabled
pdecon_28 = Deconstruct(Point=area_15.Centroid)  # -> XComponent, YComponent, ZComponent; disabled
sort_27 = SortList(Keys=pdecon_27.ZComponent, ValuesA=debrep_13.Faces)  # -> Keys, ValuesA; disabled
sort_28 = SortList(Keys=pdecon_28.ZComponent, ValuesA=debrep_14.Faces)  # -> Keys, ValuesA; disabled
item_27 = ListItem(List=reverse(sort_28.ValuesA), Index=0, Wrap=True)  # disabled
item_28 = ListItem(List=sort_27.ValuesA, Index=0, Wrap=True)  # disabled
flatten_13 = FlattenTree(Tree=item_27, Path="{0}")  # disabled
flatten_14 = FlattenTree(Tree=item_28, Path="{0}")  # disabled
join_13 = JoinCurves(Curves=flatten_13, Preserve=False)  # disabled
join_14 = JoinCurves(Curves=flatten_14, Preserve=False)  # disabled

# ---- group: Group touching buildings
number_slider_3 = Slider(-1, range=-1..200)  # disabled
toggle = BooleanToggle(True)  # disabled
c_script = CSharpScript(enable=toggle, cList=join_2, branch=number_slider_3)  # -> out, DucatiumAmamusDumSpiramus, clustersIndicesTree, demoContentList; inputs enable: Boolean, cList: list of Curve, branch: Int32; disabled
# ---------- c_script: C# usings ----------
using System.IO;
using System.Linq;
using System.Data;
using System.Drawing;
using System.Reflection;
using System.Windows.Forms;
using System.Xml;
using System.Xml.Linq;
using System.Runtime.InteropServices;

using Rhino.DocObjects;
using Rhino.Collections;
using GH_IO;
using GH_IO.Serialization;
# ---------- c_script: C# ----------
    // by The Lord of Darkness due to critical Vodka starvation issues

    if(!enable) return;

    cList = cList.Where(x => x != null && x is Curve).ToList();
    if(!cList.Any())return;

    System.Diagnostics.Stopwatch sw = new System.Diagnostics.Stopwatch();
    sw.Start();

    double tol = RhinoDoc.ActiveDoc.ModelAbsoluteTolerance;
    DataTree<int> conn = new DataTree<int>();
    ClusterCcx(cList, tol, ref conn);
    clustersIndicesTree = conn;  //>> out

    Print(" ");
    Print("Made: {0} clusters [{1} items]", conn.BranchCount, cList.Count);
    Print(" ");

    if(branch != -1){
      if(branch >= conn.BranchCount) branch = conn.BranchCount - 1;
      List<int> indices = conn.Branch(branch);
      List<Curve> cDemo = new List<Curve>();
      foreach(int index in indices) cDemo.Add(cList[index]);
      demoContentList = cDemo;  //>> out
    }
    else Print("Demo is disabled (branch = -1)");

    sw.Stop();
    DucatiumAmamusDumSpiramus = (string.Format("Elapsed: {0}ms", sw.Elapsed.TotalMilliseconds));
# ---------- c_script: C# additional code ----------
  public void  ClusterCcx(List <Curve> cList, double tol, ref DataTree < int > conn){

    bool[] Sampled = new bool[cList.Count];
    int branch = 0;

    for (int i = 0; i < cList.Count; i++){
      if(Sampled[i]) continue;
      List<int> clusterIndices = new List<int>();
      clusterIndices.Add(i);
      conn.Add(i, new GH_Path(branch));
      //  curveClusters.Add(cList[i], new GH_Path(branch));
      Sampled[i] = true;
      do{
        for (int j = 0; j < cList.Count; j++){
          if (j != clusterIndices[0] && !Sampled[j]){
            var ccx = Rhino.Geometry.Intersect.Intersection.CurveCurve(cList[clusterIndices[0]], cList[j], tol, 0);
            if (ccx.Count > 0){
              clusterIndices.Add(j);
              conn.Add(j, new GH_Path(branch));
              // curveClusters.Add(cList[j], new GH_Path(branch));
              Sampled[j] = true;
            }
          }
        }
        clusterIndices.RemoveAt(0);
      }while (clusterIndices.Count > 0);
      branch++;
    }
  }
# ---------- end c_script ----------
item_29 = ListItem(List=join_2, Index=c_script.clustersIndicesTree, Wrap=True)  # disabled
item_30 = ListItem(List=join, Index=c_script.clustersIndicesTree, Wrap=True)  # disabled

number_slider_4 = Slider(-1, range=-1..200)  # disabled
toggle_2 = BooleanToggle(True)  # disabled
c_script_2 = CSharpScript(enable=toggle_2, cList=join_4, branch=number_slider_4)  # -> out, DucatiumAmamusDumSpiramus, clustersIndicesTree, demoContentList; inputs enable: Boolean, cList: list of Curve, branch: Int32; disabled; same code as c_script
item_31 = ListItem(List=join_4, Index=c_script_2.clustersIndicesTree, Wrap=True)  # disabled
item_32 = ListItem(List=join_3, Index=c_script_2.clustersIndicesTree, Wrap=True)  # disabled

c_script_3 = CSharpScript(enable=Toggle(True), cList=join_6, branch=Slider(-1, range=-1..200))  # -> out, DucatiumAmamusDumSpiramus, clustersIndicesTree, demoContentList; inputs enable: Boolean, cList: list of Curve, branch: Int32; same code as c_script
item_33 = ListItem(List=join_6, Index=c_script_3.clustersIndicesTree, Wrap=True)
item_34 = ListItem(List=join_5, Index=c_script_3.clustersIndicesTree, Wrap=True)

number_slider_5 = Slider(-1, range=-1..200)  # disabled
toggle_3 = BooleanToggle(True)  # disabled
c_script_4 = CSharpScript(enable=toggle_3, cList=join_8, branch=number_slider_5)  # -> out, DucatiumAmamusDumSpiramus, clustersIndicesTree, demoContentList; inputs enable: Boolean, cList: list of Curve, branch: Int32; disabled; same code as c_script
item_35 = ListItem(List=join_8, Index=c_script_4.clustersIndicesTree, Wrap=True)  # disabled
item_36 = ListItem(List=join_7, Index=c_script_4.clustersIndicesTree, Wrap=True)  # disabled

number_slider_6 = Slider(-1, range=-1..200)  # disabled
toggle_4 = BooleanToggle(True)  # disabled
c_script_5 = CSharpScript(enable=toggle_4, cList=join_10, branch=number_slider_6)  # -> out, DucatiumAmamusDumSpiramus, clustersIndicesTree, demoContentList; inputs enable: Boolean, cList: list of Curve, branch: Int32; disabled; same code as c_script
item_37 = ListItem(List=join_10, Index=c_script_5.clustersIndicesTree, Wrap=True)  # disabled
item_38 = ListItem(List=join_9, Index=c_script_5.clustersIndicesTree, Wrap=True)  # disabled

# ---- group: Calculate Distance
area_16 = Area(Geometry=item_30)  # -> Area, Centroid; disabled
area_17 = Area(Geometry=item_29)  # -> Area, Centroid; disabled
dist = Distance(PointA=area_16.Centroid, PointB=area_17.Centroid)  # disabled
multiplication = Multiplication(A=dist, B=number_slider_2)  # disabled

# ---- group: Offset and merge surfaces
crv = Curve(item_29)  # disabled
explode = Explode(Curve=crv, Recursive=True)  # -> Segments, Vertices; disabled
srf = Surface(crv)  # disabled
trim = TrimTree(Tree=explode.Segments, Depth=1)  # disabled
offset = OffsetCurve(Curve=trim, Distance=multiplication, Corners=0)  # disabled
trim_2 = TrimTree(Tree=offset, Depth=1)  # disabled
midpt = CurveMiddle(Curve=trim)  # disabled
midpt_2 = CurveMiddle(Curve=trim_2)  # disabled
vec2pt = Vector2Pt(PointA=midpt, PointB=midpt_2, Unitize=False)  # -> Vector, Length; disabled
extr = Extrude(Base=trim, Direction=vec2pt.Vector)  # disabled
vdisex = VectorDisplayEx(Point=midpt, Vector=vec2pt.Vector, Colour=RGB(0, 0, 0), Width=2)  # disabled
sunion_2 = SolidUnion(Breps=[extr, srf])  # disabled
fmerge = MergeFaces(Brep=sunion_2)  # -> Breps, Before, After; disabled
srf_2 = Surface(fmerge.Breps)  # disabled

# ---- group: Group touching buildings
number_slider_7 = Slider(-1, range=-1..200)  # disabled
toggle_5 = BooleanToggle(True)  # disabled
c_script_6 = CSharpScript(enable=toggle_5, cList=join_12, branch=number_slider_7)  # -> out, DucatiumAmamusDumSpiramus, clustersIndicesTree, demoContentList; inputs enable: Boolean, cList: list of Curve, branch: Int32; disabled; same code as c_script
item_39 = ListItem(List=join_12, Index=c_script_6.clustersIndicesTree, Wrap=True)  # disabled
item_40 = ListItem(List=join_11, Index=c_script_6.clustersIndicesTree, Wrap=True)  # disabled

# ---- group: Get bottom face
deconstruct_brep_3 = DeconstructBrep(Brep=side_faces)  # -> Faces, Edges, Vertices; disabled
curve_middle_2 = CurveMiddle(Curve=deconstruct_brep_3.Edges)  # disabled
deconstruct_3 = Deconstruct(Point=curve_middle_2)  # -> XComponent, YComponent, ZComponent; disabled
expression_3 = Expression(x=deconstruct_3.ZComponent, Expression="Format(\"{0:0}\",x)")  # disabled
panel_9 = Panel("0")  # disabled
equality_3 = Equality(FirstNumber=expression_3, SecondNumber=panel_9)  # -> Equality, Inequality; disabled
dispatch_3 = Dispatch(List=deconstruct_brep_3.Edges, DispatchPattern=equality_3.Equality)  # -> ListA, ListB; disabled
trim_tree_3 = TrimTree(Tree=dispatch_3.ListA, Depth=1)  # disabled

# ---- group: Group touching buildings
number_slider_8 = Slider(-1, range=-1..200)  # disabled
toggle_6 = BooleanToggle(True)  # disabled
c_script_7 = CSharpScript(enable=toggle_6, cList=join_14, branch=number_slider_8)  # -> out, DucatiumAmamusDumSpiramus, clustersIndicesTree, demoContentList; inputs enable: Boolean, cList: list of Curve, branch: Int32; disabled; same code as c_script
item_41 = ListItem(List=join_14, Index=c_script_7.clustersIndicesTree, Wrap=True)  # disabled
item_42 = ListItem(List=join_13, Index=c_script_7.clustersIndicesTree, Wrap=True)  # disabled

# ---- group: Calculate Distance
area_18 = Area(Geometry=item_32)  # -> Area, Centroid; disabled
area_19 = Area(Geometry=item_31)  # -> Area, Centroid; disabled
dist_2 = Distance(PointA=area_18.Centroid, PointB=area_19.Centroid)  # disabled
multiplication_2 = Multiplication(A=dist_2, B=number_slider)  # disabled

# ---- group: Offset and join surfaces
crv_2 = Curve(item_31)  # disabled
explode_2 = Explode(Curve=crv_2, Recursive=True)  # -> Segments, Vertices; disabled
srf_3 = Surface(crv_2)  # disabled
trim_3 = TrimTree(Tree=explode_2.Segments, Depth=1)  # disabled
offset_2 = OffsetCurve(Curve=trim_3, Distance=multiplication_2, Corners=0)  # disabled
trim_4 = TrimTree(Tree=offset_2, Depth=2)  # disabled
midpt_3 = CurveMiddle(Curve=trim_3)  # disabled
midpt_4 = CurveMiddle(Curve=trim_4)  # disabled
vec2pt_2 = Vector2Pt(PointA=midpt_3, PointB=midpt_4, Unitize=False)  # -> Vector, Length; disabled
vdisex_2 = VectorDisplayEx(Point=midpt_3, Vector=vec2pt_2.Vector, Colour=RGB(0, 0, 0), Width=2)  # disabled
extr_2 = Extrude(Base=trim_3, Direction=vec2pt_2.Vector)  # disabled
sunion_3 = SolidUnion(Breps=[extr_2, srf_3])  # disabled
fmerge_2 = MergeFaces(Brep=sunion_3)  # -> Breps, Before, After; disabled
pln = Plane(fmerge_2.Breps)  # disabled

# ---- group: Calculate Distance
area_20 = Area(Geometry=item_34)  # -> Area, Centroid
area_21 = Area(Geometry=item_33)  # -> Area, Centroid
dist_3 = Distance(PointA=area_20.Centroid, PointB=area_21.Centroid)
multiplication_3 = Multiplication(A=dist_3, B=abstandsflaechen_factor_2)
num = Number(minimum_value_2)
expression_4 = Expression(x=multiplication_3, y=num, Expression="if(x<y,y,x)")

area_22 = Area(Geometry=item_36)  # -> Area, Centroid; disabled
area_23 = Area(Geometry=item_35)  # -> Area, Centroid; disabled
dist_4 = Distance(PointA=area_22.Centroid, PointB=area_23.Centroid)  # disabled
num_2 = Number(minimum_value_3)  # disabled
multiplication_4 = Multiplication(A=dist_4, B=abstandsflaechen_factor_3)  # disabled
expression_5 = Expression(x=multiplication_4, y=num_2, Expression="if(x<y,y,x)")  # disabled

area_24 = Area(Geometry=item_38)  # -> Area, Centroid; disabled
area_25 = Area(Geometry=item_37)  # -> Area, Centroid; disabled
dist_5 = Distance(PointA=area_24.Centroid, PointB=area_25.Centroid)  # disabled
multiplication_5 = Multiplication(A=dist_5, B=abstandsflaechen_factor)  # disabled
num_3 = Number(minimum_value)  # disabled
expression_6 = Expression(x=multiplication_5, y=num_3, Expression="if(x<y,y,x)")  # disabled

area_26 = Area(Geometry=item_40)  # -> Area, Centroid; disabled
area_27 = Area(Geometry=item_39)  # -> Area, Centroid; disabled
dist_6 = Distance(PointA=area_26.Centroid, PointB=area_27.Centroid)  # disabled
num_4 = Number(minimum_value_5)  # disabled
multiplication_6 = Multiplication(A=dist_6, B=abstandsflaechen_factor_5)  # disabled
expression_7 = Expression(x=multiplication_6, y=num_4, Expression="if(x<y,y,x)")  # disabled

# ---- group: Offset and merge surfaces
crv_3 = Curve(item_39)  # disabled
explode_3 = Explode(Curve=crv_3, Recursive=True)  # -> Segments, Vertices; disabled
srf_4 = Surface(crv_3)  # disabled
trim_5 = TrimTree(Tree=explode_3.Segments, Depth=1)  # disabled
offset_3 = OffsetCurve(Curve=trim_5, Distance=expression_7, Corners=0)  # disabled
trim_6 = TrimTree(Tree=offset_3, Depth=1)  # disabled
midpt_5 = CurveMiddle(Curve=trim_5)  # disabled
midpt_6 = CurveMiddle(Curve=trim_6)  # disabled
vec2pt_3 = Vector2Pt(PointA=midpt_5, PointB=midpt_6, Unitize=False)  # -> Vector, Length; disabled
extr_3 = Extrude(Base=trim_5, Direction=vec2pt_3.Vector)  # disabled
vdisex_3 = VectorDisplayEx(Point=midpt_5, Vector=vec2pt_3.Vector, Colour=RGB(0, 0, 0), Width=2)  # disabled
sunion_4 = SolidUnion(Breps=[extr_3, srf_4])  # disabled
debrep_15 = DeconstructBrep(Brep=sunion_4)  # -> Faces, Edges, Vertices; disabled
join_15 = BrepJoin(Breps=debrep_15.Faces)  # -> Breps, Closed; disabled
fmerge_3 = MergeFaces(Brep=join_15.Breps)  # -> Breps, Before, After; disabled
srf_5 = Surface(fmerge_3.Breps)  # disabled

crv_4 = Curve(item_37)  # disabled
explode_4 = Explode(Curve=crv_4, Recursive=True)  # -> Segments, Vertices; disabled
srf_6 = Surface(crv_4)  # disabled
graft = GraftTree(Tree=expression_6, IncludeEmptyLists=True, IncludeNullItems=True)  # disabled
simplify = SimplifyTree(Tree=explode_4.Segments, Front=False)  # disabled
simplify_2 = SimplifyTree(Tree=graft, Front=False)  # disabled
offset_4 = OffsetCurve(Curve=simplify, Distance=simplify_2, Corners=0)  # disabled
trim_7 = TrimTree(Tree=offset_4, Depth=1)  # disabled
midpt_7 = CurveMiddle(Curve=simplify)  # disabled
midpt_8 = CurveMiddle(Curve=trim_7)  # disabled
vec2pt_4 = Vector2Pt(PointA=midpt_7, PointB=midpt_8, Unitize=False)  # -> Vector, Length; disabled
extr_4 = Extrude(Base=simplify, Direction=vec2pt_4.Vector)  # disabled
vdisex_4 = VectorDisplayEx(Point=midpt_7, Vector=vec2pt_4.Vector, Colour=RGB(0, 0, 0), Width=2)  # disabled
trim_8 = TrimTree(Tree=extr_4, Depth=1)  # disabled
sunion_5 = SolidUnion(Breps=[srf_6, trim_8])  # disabled
debrep_16 = DeconstructBrep(Brep=sunion_5)  # -> Faces, Edges, Vertices; disabled
join_16 = BrepJoin(Breps=debrep_16.Faces)  # -> Breps, Closed; disabled
fmerge_4 = MergeFaces(Brep=join_16.Breps)  # -> Breps, Before, After; disabled
srf_7 = Surface(fmerge_4.Breps)  # disabled

# ----
srf_8 = Surface(srf_2)  # disabled

panel_10 = Panel(explode_3.Segments)  # disabled
panel_11 = Panel(expression_7)  # disabled
stack = StackData(Data=["A", "B", "C", "D"], Stack=[1, 2, 3, 4])  # disabled

srf_9 = Surface(srf_5)  # disabled
brep_edges_2 = BrepEdges(Brep=srf_9)  # -> Naked, Interior, NonManifold; disabled
join_curves = JoinCurves(Curves=brep_edges_2.Naked, Preserve=False)  # disabled
curve = Curve(join_curves)  # disabled
surface_split = SurfaceSplit(Surface=flatten(srf_9), Curves=flatten(curve))  # -> flatten(Fragments); disabled
area_28 = Area(Geometry=surface_split)  # -> Area, Centroid; disabled
pt_8 = Point(area_28.Centroid)  # disabled
pdecon_29 = Deconstruct(Point=pt_8)  # -> XComponent, YComponent, ZComponent; disabled
number_slider_9 = Slider(2, range=0..10)  # disabled
number_slider_10 = Slider(2, range=0..10)  # disabled
number_slider_11 = Slider(2, range=0..10)  # disabled
eval = Evaluate(F="round(x,y)", x=pdecon_29.ZComponent, y=number_slider_9)  # disabled
eval_2 = Evaluate(F="round(x,y)", x=pdecon_29.YComponent, y=number_slider_10)  # disabled
eval_3 = Evaluate(F="round(x,y)", x=pdecon_29.XComponent, y=number_slider_11)  # disabled
pt_9 = ConstructPoint(XCoordinate=eval_3, YCoordinate=eval_2, ZCoordinate=eval)  # disabled
pt_10 = Point(pt_9)  # disabled
cset_8 = CreateSet(List=pt_10)  # -> Set, Map; disabled
index = ItemIndex(List=pt_10, Item=cset_8.Set)  # disabled
cull_i = CullIndex(List=surface_split, Indices=index, Wrap=True)  # disabled
overlapping_areas = Geometry(cull_i)  # disabled

srf_10 = Surface(srf_5)  # disabled
unflatten = UnflattenTree()  # disabled

srf_11 = Surface(srf_7)  # disabled
brep_edges_3 = BrepEdges(Brep=srf_11)  # -> Naked, Interior, NonManifold; disabled
join_curves_2 = JoinCurves(Curves=brep_edges_3.Naked, Preserve=False)  # disabled
curve_2 = Curve(join_curves_2)  # disabled
surface_split_2 = SurfaceSplit(Surface=flatten(srf_11), Curves=flatten(curve_2))  # -> flatten(Fragments); disabled
area_29 = Area(Geometry=surface_split_2)  # -> Area, Centroid; disabled
pt_11 = Point(area_29.Centroid)  # disabled
pdecon_30 = Deconstruct(Point=pt_11)  # -> XComponent, YComponent, ZComponent; disabled
number_slider_12 = Slider(2, range=0..10)  # disabled
number_slider_13 = Slider(2, range=0..10)  # disabled
number_slider_14 = Slider(2, range=0..10)  # disabled
eval_4 = Evaluate(F="round(x,y)", x=pdecon_30.ZComponent, y=number_slider_12)  # disabled
eval_5 = Evaluate(F="round(x,y)", x=pdecon_30.YComponent, y=number_slider_13)  # disabled
eval_6 = Evaluate(F="round(x,y)", x=pdecon_30.XComponent, y=number_slider_14)  # disabled
pt_12 = ConstructPoint(XCoordinate=eval_6, YCoordinate=eval_5, ZCoordinate=eval_4)  # disabled
pt_13 = Point(pt_12)  # disabled
cset_9 = CreateSet(List=pt_13)  # -> Set, Map; disabled
index_2 = ItemIndex(List=pt_13, Item=cset_9.Set)  # disabled
cull_i_2 = CullIndex(List=surface_split_2, Indices=index_2, Wrap=True)  # disabled
overlapping_areas_2 = Geometry(cull_i_2)  # disabled

geo_8 = Geometry(overlapping_areas_2)  # disabled
area_30 = Area(Geometry=geo_8)  # -> Area, Centroid; disabled
swatch = ColourSwatch(SwatchColor=RGB(255, 66, 66))  # disabled
swatch_2 = ColourSwatch(SwatchColor=RGB(204, 0, 0))  # disabled
preview = CustomPreview(Geometry=geo_8, Shader=swatch)  # disabled
tag = TextTag(Location=area_30.Centroid, Text="Conflict", Colour=swatch_2)  # disabled

srf_12 = Surface(srf_7)  # disabled
swatch_3 = ColourSwatch(SwatchColor=RGBA(148, 200, 255, 129))  # disabled
preview_2 = CustomPreview(Geometry=srf_12, Shader=swatch_3)  # disabled

number_slider_15 = Slider(0.4, range=0..1)  # disabled
brep_9 = Brep([<brep referenced from the Rhino model> x54])  # disabled

# ---- group: Group Vertically Aligned Volumes
geo_9 = Geometry(brep_9)  # disabled
volume_15 = Volume(Geometry=geo_9)  # -> Volume, Centroid; disabled
pdecon_31 = Deconstruct(Point=volume_15.Centroid)  # -> XComponent, YComponent, ZComponent; disabled
panel_12 = Panel("0")  # disabled
pt_14 = ConstructPoint(XCoordinate=pdecon_31.XComponent, YCoordinate=pdecon_31.YComponent, ZCoordinate=panel_12)  # disabled
cset_10 = CreateSet(List=pt_14)  # -> Set, Map; disabled
sort_29 = SortList(Keys=cset_10.Map, ValuesA=geo_9)  # -> Keys, ValuesA; disabled
mindex_8 = MemberIndex(Set=pt_14, Member=cset_10.Set)  # -> Index, Count; disabled
partition_8 = PartitionList(List=sort_29.ValuesA, Size=mindex_8.Count)  # disabled
volume_16 = Volume(Geometry=partition_8)  # -> Volume, Centroid; disabled
pdecon_32 = Deconstruct(Point=volume_16.Centroid)  # -> XComponent, YComponent, ZComponent; disabled
sort_30 = SortList(Keys=pdecon_32.ZComponent, ValuesA=partition_8)  # -> Keys, ValuesA; disabled
brep_10 = Brep(sort_30.ValuesA)  # disabled

# ---- group: Get top and bottom surface
lastdex_8 = LastIndex(List=brep_10)  # disabled
item_43 = ListItem(List=brep_10, Index=0, Wrap=True)  # disabled
item_44 = ListItem(List=brep_10, Index=lastdex_8, Wrap=True)  # disabled
debrep_17 = DeconstructBrep(Brep=item_43)  # -> Faces, Edges, Vertices; disabled
debrep_18 = DeconstructBrep(Brep=item_44)  # -> Faces, Edges, Vertices; disabled
area_31 = Area(Geometry=debrep_17.Faces)  # -> Area, Centroid; disabled
area_32 = Area(Geometry=debrep_18.Faces)  # -> Area, Centroid; disabled
pdecon_33 = Deconstruct(Point=area_31.Centroid)  # -> XComponent, YComponent, ZComponent; disabled
pdecon_34 = Deconstruct(Point=area_32.Centroid)  # -> XComponent, YComponent, ZComponent; disabled
sort_31 = SortList(Keys=pdecon_33.ZComponent, ValuesA=debrep_17.Faces)  # -> Keys, ValuesA; disabled
sort_32 = SortList(Keys=pdecon_34.ZComponent, ValuesA=debrep_18.Faces)  # -> Keys, ValuesA; disabled
item_45 = ListItem(List=reverse(sort_32.ValuesA), Index=0, Wrap=True)  # disabled
item_46 = ListItem(List=sort_31.ValuesA, Index=0, Wrap=True)  # disabled
flatten_15 = FlattenTree(Tree=item_45, Path="{0}")  # disabled
flatten_16 = FlattenTree(Tree=item_46, Path="{0}")  # disabled
area_33 = Area(Geometry=flatten_15)  # -> Area, Centroid; disabled
area_34 = Area(Geometry=flatten_16)  # -> Area, Centroid; disabled

# ---- group: Group touching buildings
number_slider_16 = Slider(-1, range=-1..200)  # disabled
toggle_7 = BooleanToggle(True)  # disabled
join_17 = JoinCurves(Curves=flatten_16, Preserve=False)  # disabled
c_script_8 = CSharpScript(enable=toggle_7, cList=join_17, branch=number_slider_16)  # -> out, DucatiumAmamusDumSpiramus, clustersIndicesTree, demoContentList; inputs enable: Boolean, cList: list of Curve, branch: Int32; disabled; same code as c_script
item_47 = ListItem(List=join_17, Index=c_script_8.clustersIndicesTree, Wrap=True)  # disabled
bottom_surfaces = Curve(item_47)  # disabled

# ---- group: sort lists to make consistent
area_35 = Area(Geometry=bottom_surfaces)  # -> Area, Centroid; disabled
pdecon_35 = Deconstruct(Point=area_35.Centroid)  # -> XComponent, YComponent, ZComponent; disabled
panel_13 = Panel("0")  # disabled
pt_15 = ConstructPoint(XCoordinate=pdecon_35.XComponent, YCoordinate=pdecon_35.YComponent, ZCoordinate=panel_13)  # disabled
sort_33 = SortList(Keys=pt_15, ValuesA=bottom_surfaces)  # -> Keys, ValuesA; disabled

# ----
panel_14 = Panel(sort_33.ValuesA)  # disabled

# ---- group: Offset base curves and merge
dist_7 = Distance(PointA=area_33.Centroid, PointB=area_34.Centroid)  # disabled
partition_9 = PartitionList(List=dist_7, Size=[3, 2])  # disabled
multiplication_7 = Multiplication(A=dist_7, B=number_slider_15)  # disabled
offset_5 = OffsetCurve(Curve=sort_33.ValuesA, Distance=multiplication_7, Corners=1)  # disabled
trim_9 = TrimTree(Tree=offset_5, Depth=1)  # disabled
runion = RegionUnion(Curves=trim_9)  # disabled

# ----
geo_10 = Geometry(dispatch_2.ListA)  # disabled
number_slider_17 = Slider(2, range=0..10)  # disabled
number_slider_18 = Slider(2, range=0..10)  # disabled
number_slider_19 = Slider(2, range=0..10)  # disabled

deconstruct_brep_4 = DeconstructBrep(Brep=side_faces)  # -> Faces, Edges, Vertices; disabled
brep_edges_4 = BrepEdges(Brep=deconstruct_brep_4.Faces)  # -> Naked, Interior, NonManifold; disabled
curve_middle_3 = CurveMiddle(Curve=brep_edges_4.Naked)  # disabled
deconstruct_4 = Deconstruct(Point=curve_middle_3)  # -> XComponent, YComponent, ZComponent; disabled
sort_list_2 = SortList(Keys=deconstruct_4.ZComponent, ValuesValuesA=curve_middle_3, ValuesA=brep_edges_4.Naked)  # -> Keys, ValuesValuesA, ValuesA; disabled
list_item_2 = ListItem(List=sort_list_2.ValuesValuesA, Index=0, Wrap=True)  # disabled
list_item_3 = ListItem(List=sort_list_2.ValuesA, Index=0, Wrap=True)  # disabled

# ---- group: offset and merge surfaces
crv_5 = Curve(item_33)
explode_5 = Explode(Curve=crv_5, Recursive=True)  # -> Segments, Vertices
srf_13 = Surface(crv_5)
lng = ListLength(List=explode_5.Segments)
simplify_3 = SimplifyTree(Tree=expression_4, Front=False)
trim_10 = TrimTree(Tree=lng, Depth=1)
trim_11 = TrimTree(Tree=explode_5.Segments, Depth=1)
stack_2 = StackData(Data=simplify_3, Stack=trim_10)
offset_6 = OffsetCurve(Curve=trim_11, Distance=stack_2, Corners=0)
trim_12 = TrimTree(Tree=offset_6, Depth=1)
midpt_9 = CurveMiddle(Curve=trim_11)
midpt_10 = CurveMiddle(Curve=trim_12)
vec2pt_5 = Vector2Pt(PointA=midpt_9, PointB=midpt_10, Unitize=False)  # -> Vector, Length
extr_5 = Extrude(Base=trim_11, Direction=vec2pt_5.Vector)
vdisex_5 = VectorDisplayEx(Point=midpt_9, Vector=vec2pt_5.Vector, Colour=RGB(0, 0, 0), Width=2)
runion_2 = RegionUnion(Curves=[extr_5, srf_13])

# ----
trim_13 = TrimTree(Tree=list_item_2, Depth=2)  # disabled

pt_16 = Point(trim_13)  # disabled

crv_6 = Curve(trim_tree_3)  # disabled
join_18 = JoinCurves(Curves=crv_6, Preserve=False)  # disabled
area_36 = Area(Geometry=join_18)  # -> Area, Centroid; disabled
sort_34 = SortList(Keys=area_36.Area, ValuesA=join_18)  # -> Keys, ValuesA; disabled
rev = ReverseList(List=sort_34.ValuesA)  # disabled
item_48 = ListItem(List=rev, Index=0, Wrap=True)  # disabled
panel_15 = Panel("1")  # disabled
incurve = PointInCurve(Point=pt_16, Curve=item_48)  # -> Relationship, Point; disabled
equals = Equality(FirstNumber=incurve.Relationship, SecondNumber=panel_15)  # -> Equality, Inequality; disabled
dispatch_4 = Dispatch(List=side_faces, DispatchPattern=equals.Equality)  # -> ListA, ListB; disabled
geo_11 = Geometry(dispatch_4.ListA)  # disabled

# ---- group: Get sides and their respective bottom edge
geo_12 = Geometry(geo_11)  # disabled
deconstruct_brep_5 = DeconstructBrep(Brep=geo_12)  # -> Faces, Edges, Vertices; disabled
brep_edges_5 = BrepEdges(Brep=deconstruct_brep_5.Faces)  # -> Naked, Interior, NonManifold; disabled
curve_middle_4 = CurveMiddle(Curve=brep_edges_5.Naked)  # disabled
deconstruct_5 = Deconstruct(Point=curve_middle_4)  # -> XComponent, YComponent, ZComponent; disabled
sort_list_3 = SortList(Keys=deconstruct_5.ZComponent, ValuesValuesA=brep_edges_5.Naked)  # -> Keys, ValuesValuesA; disabled
list_item_4 = ListItem(List=sort_list_3.ValuesValuesA, Index=0, Wrap=True)  # disabled
trim_14 = TrimTree(Tree=list_item_4, Depth=2)  # disabled
join_19 = JoinCurves(Curves=trim_14, Preserve=False)  # disabled
simplify_4 = SimplifyCurve(Curve=join_19)  # -> Curve, Simplified; disabled
explode_6 = Explode(Curve=simplify_4.Curve, Recursive=True)  # -> Segments, Vertices; disabled
crv_7 = Curve(explode_6.Segments)  # disabled
geo_13 = Geometry(geo_12)  # disabled

# ---- group: Fold Down Sides
trim_15 = TrimTree(Tree=crv_7, Depth=2)  # disabled
geo_14 = Geometry(geo_13)  # disabled
crv_8 = Curve(trim_15)  # disabled
midpt_11 = CurveMiddle(Curve=crv_8)  # disabled
surface_closest_point = SurfaceClosestPoint(Point=midpt_11, Surface=geo_14)  # -> Point, UVPoint, Distance; disabled
evaluate_surface = EvaluateSurface(Surface=geo_14, Point=surface_closest_point.UVPoint)  # -> Point, Normal, UDirection, VDirection, Frame; disabled
pln_2 = Plane(evaluate_surface.Frame)  # disabled
deplane = DeconstructPlane(Plane=pln_2)  # -> Origin, XAxis, YAxis, ZAxis; disabled
rot3d = Rotate3D(Geometry=pln_2, Angle=1.570796327, Center=deplane.Origin, Axis=deplane.YAxis)  # -> Geometry, Transform; disabled
rotate = Rotate(Geometry=geo_14, Angle=1.570796327, Plane=rot3d.Geometry)  # -> Geometry, Transform; disabled

# ---- group: Scale folded down sides
number = Number(factor)  # disabled
scale_nu = ScaleNU(Geometry=rotate.Geometry, Plane=pln_2, ScaleX=1, ScaleY=1, ScaleZ=number)  # -> Geometry, Transform; disabled

# ----
trim_16 = TrimTree(Tree=scale_nu.Geometry, Depth=1)  # disabled
geo_15 = Geometry(trim_16)  # disabled

# ---- group: Combined surfaces
geo_16 = Geometry([geo_10, geo_15])  # disabled
join_20 = BrepJoin(Breps=geo_16)  # -> Breps, Closed; disabled
geo_17 = Geometry(join_20.Breps)  # disabled
merge_faces_2 = MergeFaces(Brep=geo_17)  # -> Breps, Before, After; disabled
geo_18 = Geometry(merge_faces_2.Breps)  # disabled
edges = BrepEdges(Brep=geo_18)  # -> Naked, Interior, NonManifold; disabled
join_21 = JoinCurves(Curves=edges.Naked, Preserve=False)  # disabled
crv_9 = Curve(join_21)  # disabled

# ---- group: Finding intersecting and overlapping areas
brep_edges_6 = BrepEdges(Brep=geo_18)  # -> Naked, Interior, NonManifold; disabled
join_curves_3 = JoinCurves(Curves=brep_edges_6.Naked, Preserve=False)  # disabled
curve_3 = Curve(join_curves_3)  # disabled
surface_split_3 = SurfaceSplit(Surface=flatten(geo_18), Curves=flatten(curve_3))  # -> flatten(Fragments); disabled
area_37 = Area(Geometry=surface_split_3)  # -> Area, Centroid; disabled
pt_17 = Point(area_37.Centroid)  # disabled
pdecon_36 = Deconstruct(Point=pt_17)  # -> XComponent, YComponent, ZComponent; disabled
number_slider_20 = Slider(2, range=0..10)  # disabled
number_slider_21 = Slider(2, range=0..10)  # disabled
number_slider_22 = Slider(2, range=0..10)  # disabled
eval_7 = Evaluate(F="round(x,y)", x=pdecon_36.ZComponent, y=number_slider_20)  # disabled
eval_8 = Evaluate(F="round(x,y)", x=pdecon_36.YComponent, y=number_slider_21)  # disabled
eval_9 = Evaluate(F="round(x,y)", x=pdecon_36.XComponent, y=number_slider_22)  # disabled
pt_18 = ConstructPoint(XCoordinate=eval_9, YCoordinate=eval_8, ZCoordinate=eval_7)  # disabled
pt_19 = Point(pt_18)  # disabled
cset_11 = CreateSet(List=pt_19)  # -> Set, Map; disabled
index_3 = ItemIndex(List=pt_19, Item=cset_11.Set)  # disabled
cull_i_3 = CullIndex(List=surface_split_3, Indices=index_3, Wrap=True)  # disabled
overlapping_areas_3 = Geometry(cull_i_3)  # disabled

# ----
surface_areas = Geometry(geo_18)  # disabled
boundary_curves = Curve(crv_9)  # disabled
conflict_areas = Geometry(overlapping_areas_3)  # disabled

# ---- group: Display
swatch_4 = ColourSwatch(SwatchColor=RGB(255, 255, 255))  # disabled
swatch_5 = ColourSwatch(SwatchColor=RGB(255, 66, 66))  # disabled
swatch_6 = ColourSwatch(SwatchColor=RGB(204, 0, 0))  # disabled
area_38 = Area(Geometry=conflict_areas)  # -> Area, Centroid; disabled
preview_3 = CustomPreview(Geometry=[boundary_curves, surface_areas], Shader=swatch_4)  # disabled
preview_4 = CustomPreview(Geometry=conflict_areas, Shader=swatch_5)  # disabled
tag_2 = TextTag(Location=area_38.Centroid, Text="Conflict", Colour=swatch_6)  # disabled

# ----
area_39 = Area(Geometry=surface_split_3)  # -> Area, Centroid; disabled
pt_20 = Point(area_39.Centroid)  # disabled
pdecon_37 = Deconstruct(Point=pt_20)  # -> XComponent, YComponent, ZComponent; disabled
eval_10 = Evaluate(F="round(x,y)", x=pdecon_37.ZComponent, y=number_slider_17)  # disabled
eval_11 = Evaluate(F="round(x,y)", x=pdecon_37.YComponent, y=number_slider_18)  # disabled
eval_12 = Evaluate(F="round(x,y)", x=pdecon_37.XComponent, y=number_slider_19)  # disabled
pt_21 = ConstructPoint(XCoordinate=eval_12, YCoordinate=eval_11, ZCoordinate=eval_10)  # disabled
pt_22 = Point(pt_21)  # disabled
cset_12 = CreateSet(List=pt_22)  # -> Set, Map; disabled
index_4 = ItemIndex(List=pt_22, Item=cset_12.Set)  # disabled
cull_i_4 = CullIndex(List=surface_split_3, Indices=index_4, Wrap=True)  # disabled

# ---- group: Calculate Distance
area_40 = Area(Geometry=item_42)  # -> Area, Centroid; disabled
area_41 = Area(Geometry=item_41)  # -> Area, Centroid; disabled
dist_8 = Distance(PointA=area_40.Centroid, PointB=area_41.Centroid)  # disabled
multiplication_8 = Multiplication(A=dist_8, B=abstandsflaechen_factor_4)  # disabled
num_5 = Number(minimum_value_4)  # disabled
expression_8 = Expression(x=multiplication_8, y=num_5, Expression="if(x<y,y,x)")  # disabled
graft_2 = GraftTree(Tree=expression_8, IncludeEmptyLists=True, IncludeNullItems=True)  # disabled

# ---- group: Offset and merge surfaces
crv_10 = Curve(item_41)  # disabled
explode_7 = Explode(Curve=crv_10, Recursive=True)  # -> Segments, Vertices; disabled
srf_14 = Surface(crv_10)  # disabled

# ----
trim_17 = TrimTree(Tree=explode_7.Segments, Depth=1)  # disabled

# ---- group: Calculate Distance (continued)
lng_2 = ListLength(List=explode_7.Segments)  # disabled
dup = DuplicateData(Data=graft_2, Number=lng_2, Order=True)  # disabled

# ----
crv_11 = Curve(trim_17)  # disabled
trim_18 = TrimTree(Tree=dup, Depth=1)  # disabled

# ---- group: Offset and merge surfaces (continued)
offset_7 = OffsetCurve(Curve=explode_7.Segments, Distance=trim_18, Corners=0)  # disabled
trim_19 = TrimTree(Tree=offset_7, Depth=2)  # disabled
midpt_12 = CurveMiddle(Curve=crv_11)  # disabled
midpt_13 = CurveMiddle(Curve=trim_19)  # disabled
vec2pt_6 = Vector2Pt(PointA=midpt_12, PointB=midpt_13, Unitize=False)  # -> Vector, Length; disabled
extr_6 = Extrude(Base=crv_11, Direction=vec2pt_6.Vector)  # disabled
vdisex_6 = VectorDisplayEx(Point=midpt_12, Vector=vec2pt_6.Vector, Colour=RGB(0, 0, 0), Width=2)  # disabled
sunion_6 = SolidUnion(Breps=[extr_6, srf_14])  # disabled
debrep_19 = DeconstructBrep(Brep=sunion_6)  # -> Faces, Edges, Vertices; disabled
join_22 = BrepJoin(Breps=debrep_19.Faces)  # -> Breps, Closed; disabled
fmerge_5 = MergeFaces(Brep=join_22.Breps)  # -> Breps, Before, After; disabled
srf_15 = Surface(fmerge_5.Breps)  # disabled

# ----
srf_16 = Surface(srf_15)  # disabled
brep_edges_7 = BrepEdges(Brep=srf_16)  # -> Naked, Interior, NonManifold; disabled
join_curves_4 = JoinCurves(Curves=brep_edges_7.Naked, Preserve=False)  # disabled
curve_4 = Curve(join_curves_4)  # disabled
surface_split_4 = SurfaceSplit(Surface=flatten(srf_16), Curves=flatten(curve_4))  # -> flatten(Fragments); disabled
area_42 = Area(Geometry=surface_split_4)  # -> Area, Centroid; disabled
pt_23 = Point(area_42.Centroid)  # disabled
pdecon_38 = Deconstruct(Point=pt_23)  # -> XComponent, YComponent, ZComponent; disabled
number_slider_23 = Slider(2, range=0..10)  # disabled
number_slider_24 = Slider(2, range=0..10)  # disabled
number_slider_25 = Slider(2, range=0..10)  # disabled
eval_13 = Evaluate(F="round(x,y)", x=pdecon_38.ZComponent, y=number_slider_23)  # disabled
eval_14 = Evaluate(F="round(x,y)", x=pdecon_38.YComponent, y=number_slider_24)  # disabled
eval_15 = Evaluate(F="round(x,y)", x=pdecon_38.XComponent, y=number_slider_25)  # disabled
pt_24 = ConstructPoint(XCoordinate=eval_15, YCoordinate=eval_14, ZCoordinate=eval_13)  # disabled
pt_25 = Point(pt_24)  # disabled
cset_13 = CreateSet(List=pt_25)  # -> Set, Map; disabled
index_5 = ItemIndex(List=pt_25, Item=cset_13.Set)  # disabled
cull_i_5 = CullIndex(List=surface_split_4, Indices=index_5, Wrap=True)  # disabled
overlapping_areas_4 = Geometry(cull_i_5)  # disabled

geo_19 = Geometry(overlapping_areas_4)  # disabled
area_43 = Area(Geometry=geo_19)  # -> Area, Centroid; disabled
swatch_7 = ColourSwatch(SwatchColor=RGB(255, 66, 66))  # disabled
swatch_8 = ColourSwatch(SwatchColor=RGB(204, 0, 0))  # disabled
preview_5 = CustomPreview(Geometry=geo_19, Shader=swatch_7)  # disabled
tag_3 = TextTag(Location=area_43.Centroid, Text="Conflict", Colour=swatch_8)  # disabled

srf_17 = Surface(srf_15)  # disabled
swatch_9 = ColourSwatch(SwatchColor=RGBA(148, 200, 255, 129))  # disabled
preview_6 = CustomPreview(Geometry=srf_17, Shader=swatch_9)  # disabled

# ---- group: Offset and merge surfaces
crv_12 = Curve(item_35)  # disabled
explode_8 = Explode(Curve=crv_12, Recursive=True)  # -> Segments, Vertices; disabled
srf_18 = Surface(crv_12)  # disabled
simplify_5 = SimplifyTree(Tree=explode_8.Segments, Front=False)  # disabled
graft_3 = GraftTree(Tree=expression_5, IncludeEmptyLists=True, IncludeNullItems=True)  # disabled
lng_3 = ListLength(List=simplify_5)  # disabled
simplify_6 = SimplifyTree(Tree=graft_3, Front=False)  # disabled
dup_2 = DuplicateData(Data=simplify_6, Number=lng_3, Order=True)  # disabled
trim_20 = TrimTree(Tree=dup_2, Depth=1)  # disabled
offset_8 = OffsetCurve(Curve=simplify_5, Distance=trim_20, Corners=0)  # disabled
trim_21 = TrimTree(Tree=offset_8, Depth=1)  # disabled
midpt_14 = CurveMiddle(Curve=trim_21)  # disabled
midpt_15 = CurveMiddle(Curve=simplify_5)  # disabled
vec2pt_7 = Vector2Pt(PointA=midpt_15, PointB=midpt_14, Unitize=False)  # -> Vector, Length; disabled
extr_7 = Extrude(Base=simplify_5, Direction=vec2pt_7.Vector)  # disabled
vdisex_7 = VectorDisplayEx(Point=midpt_15, Vector=vec2pt_7.Vector, Colour=RGB(0, 0, 0), Width=2)  # disabled

# ----
simplify_7 = SimplifyTree(Tree=srf_18, Front=False)  # disabled
tstat = TreeStatistics(Tree=simplify_7)  # -> Paths, Length, Count; disabled
x_minus_one = XMinusOne(NumberX=tstat.Count)  # disabled
trim_22 = TrimTree(Tree=extr_7, Depth=x_minus_one)  # disabled

# ---- group: Offset and merge surfaces (continued)
sunion_7 = SolidUnion(Breps=[trim_22, simplify_7])  # disabled
debrep_20 = DeconstructBrep(Brep=sunion_7)  # -> Faces, Edges, Vertices; disabled
join_23 = BrepJoin(Breps=debrep_20.Faces)  # -> Breps, Closed; disabled
fmerge_6 = MergeFaces(Brep=join_23.Breps)  # -> Breps, Before, After; disabled
srf_19 = Surface(fmerge_6.Breps)  # disabled

# ----
panel_16 = Panel(trim_22)  # disabled
srf_20 = Surface(srf_19)  # disabled

srf_21 = Surface(srf_19)  # disabled
brep_edges_8 = BrepEdges(Brep=srf_21)  # -> Naked, Interior, NonManifold; disabled
join_curves_5 = JoinCurves(Curves=brep_edges_8.Naked, Preserve=False)  # disabled
curve_5 = Curve(join_curves_5)  # disabled
surface_split_5 = SurfaceSplit(Surface=flatten(srf_21), Curves=flatten(curve_5))  # -> flatten(Fragments); disabled
area_44 = Area(Geometry=surface_split_5)  # -> Area, Centroid; disabled
pt_26 = Point(area_44.Centroid)  # disabled
pdecon_39 = Deconstruct(Point=pt_26)  # -> XComponent, YComponent, ZComponent; disabled
number_slider_26 = Slider(2, range=0..10)  # disabled
number_slider_27 = Slider(2, range=0..10)  # disabled
number_slider_28 = Slider(2, range=0..10)  # disabled
eval_16 = Evaluate(F="round(x,y)", x=pdecon_39.ZComponent, y=number_slider_26)  # disabled
eval_17 = Evaluate(F="round(x,y)", x=pdecon_39.YComponent, y=number_slider_27)  # disabled
eval_18 = Evaluate(F="round(x,y)", x=pdecon_39.XComponent, y=number_slider_28)  # disabled
pt_27 = ConstructPoint(XCoordinate=eval_18, YCoordinate=eval_17, ZCoordinate=eval_16)  # disabled
pt_28 = Point(pt_27)  # disabled
cset_14 = CreateSet(List=pt_28)  # -> Set, Map; disabled
index_6 = ItemIndex(List=pt_28, Item=cset_14.Set)  # disabled
cull_i_6 = CullIndex(List=surface_split_5, Indices=index_6, Wrap=True)  # disabled
overlapping_areas_5 = Geometry(cull_i_6)  # disabled

geo_20 = Geometry(overlapping_areas_5)  # disabled
area_45 = Area(Geometry=geo_20)  # -> Area, Centroid; disabled
swatch_10 = ColourSwatch(SwatchColor=RGB(255, 66, 66))  # disabled
swatch_11 = ColourSwatch(SwatchColor=RGB(204, 0, 0))  # disabled
preview_7 = CustomPreview(Geometry=geo_20, Shader=swatch_10)  # disabled
tag_4 = TextTag(Location=area_45.Centroid, Text="Conflict", Colour=swatch_11)  # disabled

boundary = BoundarySurfaces(Edges=runion_2)

# ---- group: offset and merge surfaces (continued)
srf_22 = Surface(boundary)

# ----
srf_23 = Surface(srf_22)
brep_edges_9 = BrepEdges(Brep=srf_23)  # -> Naked, Interior, NonManifold
join_curves_6 = JoinCurves(Curves=brep_edges_9.Naked, Preserve=False)
curve_6 = Curve(join_curves_6)
surface_split_6 = SurfaceSplit(Surface=flatten(srf_23), Curves=flatten(curve_6))  # -> flatten(Fragments)
area_46 = Area(Geometry=surface_split_6)  # -> Area, Centroid
pt_29 = Point(area_46.Centroid)
pdecon_40 = Deconstruct(Point=pt_29)  # -> XComponent, YComponent, ZComponent
eval_19 = Evaluate(F="round(x,y)", x=pdecon_40.ZComponent, y=Slider(2, range=0..10))
eval_20 = Evaluate(F="round(x,y)", x=pdecon_40.YComponent, y=Slider(2, range=0..10))
eval_21 = Evaluate(F="round(x,y)", x=pdecon_40.XComponent, y=Slider(2, range=0..10))
pt_30 = ConstructPoint(XCoordinate=eval_21, YCoordinate=eval_20, ZCoordinate=eval_19)
pt_31 = Point(pt_30)
cset_15 = CreateSet(List=pt_31)  # -> Set, Map
index_7 = ItemIndex(List=pt_31, Item=cset_15.Set)
cull_i_7 = CullIndex(List=surface_split_6, Indices=index_7, Wrap=True)
overlapping_areas_6 = Geometry(cull_i_7)

srf_24 = Surface(srf_22)

flatten_17 = FlattenTree(Tree=srf_24, Path="{0}")
lng_4 = ListLength(List=flatten_17)
wheel = ColourWheel(
    lng_4,
    ColourGrips_Style=10,
    ColourGrips_Grip=[3.639586234, 2.094395102, 4.188790205, 3.141592654],
    ColourGrips_Lum=[0.1, 0.5],
    ColourGrips_Range=[0.2617993878, 0.2617993878, 0.2617993878, 0.2617993878],
    ColourGrips_Sat=[0.2, 0.6])
preview_8 = CustomPreview(Geometry=flatten_17, Material=wheel)

geo_21 = Geometry(overlapping_areas_6)
area_47 = Area(Geometry=geo_21)  # -> Area, Centroid
preview_9 = CustomPreview(Geometry=geo_21, Shader=ColourSwatch(SwatchColor=RGB(255, 66, 66)))
tag_5 = TextTag(Location=area_47.Centroid, Text="Conflict", Colour=ColourSwatch(SwatchColor=RGB(204, 0, 0)))
