# Grasshopper definition AutoGenerateLayers_v1.0_tjd.gh (Grasshopper 1.0.7)
# plug-ins: Human

auto_generate_layers_v1_0 = Panel("Tom Dufficy 2023")

# ---- group: Separate out #
# READ ME: autogeneratelayers
# v1.0 20220829
# tjd
# 
# required plugin(s):
# - Human for Rhino 6(https://www.food4rhino.com/en/system/files/users-files/andheum/app/human.gha)
# 
# usage:
# Configure size with sliders in red group
# Press BAKE button in red group
# May freeze momentarily
# 
# notes:
# text size when baking doesn't function correctly. After baking, select all text and specify height in attributes
# 
# currently only works with 4 headings, no limit on subheadings
# 
# layer structure should be
# HEADING1
# 	HEADING1_SUBHEADING1
# 		HEADING1_SUBHEADING1_SUBSUBHEADING1
# 		HEADING1_SUBHEADING1_SUBSUBHEADING2
# 	HEADING1_SUBHEADING2
# 		HEADING1_SUBHEADING2_SUBSUBHEADING1
# 		HEADING1_SUBHEADING2_SUBSUBHEADING2
# TO DO: - fix text height issue
# - automate so any number of headings can be accommodated
layertable = LayerTable(Update=True, AutoUpdate=Toggle(True))  # -> Layers, FullLayerPaths, LayerColors, Linetypes, MaterialNames, Visible, PrintWidth, PrintColor
tmatch = MatchText(Text=layertable.FullLayerPaths, RegEx="#", Case=True)
dispatch = Dispatch(List=layertable.FullLayerPaths, DispatchPattern=tmatch)  # -> ListA, ListB
panel = Panel(dispatch.ListA)
txt = Text(dispatch.ListB)

# ---- group: Separate out headings
tmatch_2 = MatchText(Text=txt, RegEx="::", Case=True)
dispatch_2 = Dispatch(List=txt, DispatchPattern=tmatch_2)  # -> ListA, ListB
panel_2 = Panel(dispatch_2.ListB)

# ---- group: Reformat :: to : for GH
txt_2 = Text(dispatch_2.ListA)
rep = ReplaceText(Text=txt_2, Find="::", Replace=":", RecursiveReplace=False)
txt_3 = Text(rep)

# ----
column_spacing = Slider(32712, range=0..100000)
inset_horizontal_spacing = Slider(2000, range=0..10000)
size_of_cubes = Slider(500, range=0..1000)
size_of_title_text = Slider(750, range=0..1000)
size_of_body_text = Slider(500, range=0..1000)
space_between_lines_of_text = Slider(2500, range=0..10000)

# ---- group: BAKE ALL LAYERS
bake = Button()

# ----
pt = Point(Point(0, 0, 0))
lng = ListLength(List=dispatch_2.ListB)
series = Series(Start=0, Step=column_spacing, Count=lng)
X = UnitX(Factor=series)
move = Move(Geometry=pt, Motion=X)  # -> Geometry, Transform
createatts = CreateAttributes(LayerName=dispatch_2.ListB, enableFullPath=False)
pt_2 = Point(move.Geometry)
justified_text = JustifiedText3d(
    Location=pt_2,
    Text=dispatch_2.ListB,
    Size=size_of_title_text,
    HorizontalAlignment=0,
    VerticalAlginment=1,
    UseMeshes=False,
    Attributes=createatts,
    Bake=bake)

txt_4 = Text(dispatch_2.ListB)

item = ListItem(List=txt_4, Index="0", Wrap=True)
tmatch_3 = MatchText(Text=txt_3, RegEx=item, Case=True)
item_2 = ListItem(List=pt_2, Index="0", Wrap=True)
dispatch_3 = Dispatch(List=txt_3, DispatchPattern=tmatch_3)  # -> ListA, ListB
lng_2 = ListLength(List=dispatch_3.ListA)
series_2 = Series(Start=space_between_lines_of_text, Step=space_between_lines_of_text, Count=lng_2)
Y = UnitY(Factor=series_2)
neg = Negative(Value=Y)
move_2 = Move(Geometry=item_2, Motion=neg)  # -> Geometry, Transform
split = TextSplit(Text=dispatch_3.ListA, Separators=":")
lng_3 = ListLength(List=split)  # -> expr("x-1", flatten(Length))
multiplication = Multiplication(A=lng_3, B=inset_horizontal_spacing)
X_2 = UnitX(Factor=multiplication)
move_3 = Move(Geometry=move_2.Geometry, Motion=X_2)  # -> Geometry, Transform
X_3 = UnitX(Factor=expr("x*2", size_of_cubes))
neg_2 = Negative(Value=X_3)
move_4 = Move(Geometry=move_3.Geometry, Motion=neg_2)  # -> Geometry, Transform
box = CenterBox(Base=move_4.Geometry, X=size_of_cubes, Y=size_of_cubes, Z=size_of_cubes)

item_3 = ListItem(List=txt_4, Index="1", Wrap=True)
tmatch_4 = MatchText(Text=dispatch_3.ListB, RegEx=item_3, Case=True)
item_4 = ListItem(List=pt_2, Index="1", Wrap=True)
dispatch_4 = Dispatch(List=dispatch_3.ListB, DispatchPattern=tmatch_4)  # -> ListA, ListB
lng_4 = ListLength(List=dispatch_4.ListA)
series_3 = Series(Start=space_between_lines_of_text, Step=space_between_lines_of_text, Count=lng_4)
Y_2 = UnitY(Factor=series_3)
neg_3 = Negative(Value=Y_2)
move_5 = Move(Geometry=item_4, Motion=neg_3)  # -> Geometry, Transform
split_2 = TextSplit(Text=dispatch_4.ListA, Separators=":")
lng_5 = ListLength(List=split_2)  # -> expr("x-1", flatten(Length))
multiplication_2 = Multiplication(A=lng_5, B=inset_horizontal_spacing)
X_4 = UnitX(Factor=multiplication_2)
move_6 = Move(Geometry=move_5.Geometry, Motion=X_4)  # -> Geometry, Transform
X_5 = UnitX(Factor=expr("x*2", size_of_cubes))
neg_4 = Negative(Value=X_5)
move_7 = Move(Geometry=move_6.Geometry, Motion=neg_4)  # -> Geometry, Transform
box_2 = CenterBox(Base=move_7.Geometry, X=size_of_cubes, Y=size_of_cubes, Z=size_of_cubes)

item_5 = ListItem(List=txt_4, Index="2", Wrap=True)
tmatch_5 = MatchText(Text=dispatch_4.ListB, RegEx=item_5, Case=True)
item_6 = ListItem(List=pt_2, Index="2", Wrap=True)
dispatch_5 = Dispatch(List=dispatch_4.ListB, DispatchPattern=tmatch_5)  # -> ListA, ListB
lng_6 = ListLength(List=dispatch_5.ListA)
series_4 = Series(Start=space_between_lines_of_text, Step=space_between_lines_of_text, Count=lng_6)
Y_3 = UnitY(Factor=series_4)
neg_5 = Negative(Value=Y_3)
move_8 = Move(Geometry=item_6, Motion=neg_5)  # -> Geometry, Transform
split_3 = TextSplit(Text=dispatch_5.ListA, Separators=":")
lng_7 = ListLength(List=split_3)  # -> expr("x-1", flatten(Length))
multiplication_3 = Multiplication(A=lng_7, B=inset_horizontal_spacing)
X_6 = UnitX(Factor=multiplication_3)
move_9 = Move(Geometry=move_8.Geometry, Motion=X_6)  # -> Geometry, Transform
X_7 = UnitX(Factor=expr("x*2", size_of_cubes))
neg_6 = Negative(Value=X_7)
move_10 = Move(Geometry=move_9.Geometry, Motion=neg_6)  # -> Geometry, Transform
box_3 = CenterBox(Base=move_10.Geometry, X=size_of_cubes, Y=size_of_cubes, Z=size_of_cubes)

item_7 = ListItem(List=txt_4, Index="3", Wrap=True)
tmatch_6 = MatchText(Text=dispatch_5.ListB, RegEx=item_7, Case=True)
item_8 = ListItem(List=pt_2, Index="3", Wrap=True)
dispatch_6 = Dispatch(List=dispatch_5.ListB, DispatchPattern=tmatch_6)  # -> ListA, ListB
lng_8 = ListLength(List=dispatch_6.ListA)
series_5 = Series(Start=space_between_lines_of_text, Step=space_between_lines_of_text, Count=lng_8)
Y_4 = UnitY(Factor=series_5)
neg_7 = Negative(Value=Y_4)
move_11 = Move(Geometry=item_8, Motion=neg_7)  # -> Geometry, Transform
split_4 = TextSplit(Text=dispatch_6.ListA, Separators=":")
lng_9 = ListLength(List=split_4)  # -> expr("x-1", flatten(Length))
multiplication_4 = Multiplication(A=lng_9, B=inset_horizontal_spacing)
X_8 = UnitX(Factor=multiplication_4)
move_12 = Move(Geometry=move_11.Geometry, Motion=X_8)  # -> Geometry, Transform
X_9 = UnitX(Factor=expr("x*2", size_of_cubes))
neg_8 = Negative(Value=X_9)
move_13 = Move(Geometry=move_12.Geometry, Motion=neg_8)  # -> Geometry, Transform
box_4 = CenterBox(Base=move_13.Geometry, X=size_of_cubes, Y=size_of_cubes, Z=size_of_cubes)

split_5 = TextSplit(Text=dispatch_5.ListA, Separators=":")
rev = ReverseList(List=split_5)
item_9 = ListItem(List=rev, Index=0, Wrap=True)  # -> flatten(Item)
createatts_2 = CreateAttributes(LayerName=item_9, enableFullPath=False)
justified_text_2 = JustifiedText3d(
    Location=move_9.Geometry,
    Text=dispatch_5.ListA,
    Size=size_of_body_text,
    HorizontalAlignment=0,
    VerticalAlginment=1,
    UseMeshes=False,
    Attributes=createatts_2,
    Bake=bake)
bake_2 = BakeGeometry(Bake=bake, Geometry=box_3, Attributes=createatts_2, DeleteOldBakes=False, PreserveTrees=False)

split_6 = TextSplit(Text=dispatch_4.ListA, Separators=":")
rev_2 = ReverseList(List=split_6)
item_10 = ListItem(List=rev_2, Index=0, Wrap=True)  # -> flatten(Item)
createatts_3 = CreateAttributes(LayerName=item_10, enableFullPath=False)
justified_text_3 = JustifiedText3d(
    Location=move_6.Geometry,
    Text=dispatch_4.ListA,
    Size=size_of_body_text,
    HorizontalAlignment=0,
    VerticalAlginment=1,
    UseMeshes=False,
    Attributes=createatts_3,
    Bake=bake)
bake_3 = BakeGeometry(Bake=bake, Geometry=box_2, Attributes=createatts_3, DeleteOldBakes=False, PreserveTrees=False)

split_7 = TextSplit(Text=dispatch_6.ListA, Separators=":")
rev_3 = ReverseList(List=split_7)
item_11 = ListItem(List=rev_3, Index=0, Wrap=True)  # -> flatten(Item)
createatts_4 = CreateAttributes(LayerName=item_11, enableFullPath=False)
justified_text_4 = JustifiedText3d(
    Location=move_12.Geometry,
    Text=dispatch_6.ListA,
    Size=size_of_body_text,
    HorizontalAlignment=0,
    VerticalAlginment=1,
    UseMeshes=False,
    Attributes=createatts_4,
    Bake=bake)
bake_4 = BakeGeometry(Bake=bake, Geometry=box_4, Attributes=createatts_4, DeleteOldBakes=False, PreserveTrees=False)

split_8 = TextSplit(Text=dispatch_3.ListA, Separators=":")
rev_4 = ReverseList(List=split_8)
item_12 = ListItem(List=rev_4, Index=0, Wrap=True)  # -> flatten(Item)
createatts_5 = CreateAttributes(LayerName=item_12, enableFullPath=False)
justified_text_5 = JustifiedText3d(
    Location=move_3.Geometry,
    Text=dispatch_3.ListA,
    Size=size_of_body_text,
    HorizontalAlignment=0,
    VerticalAlginment=1,
    UseMeshes=False,
    Attributes=createatts_5,
    Bake=bake)
bake_5 = BakeGeometry(Bake=bake, Geometry=box, Attributes=createatts_5, DeleteOldBakes=False, PreserveTrees=False)
