# Grasshopper definition AutomaticVenetianBlinds_v1.0.gh (Grasshopper 1.0.7)

automaticvenetianblinds_v1_0 = Panel("Tom Dufficy 2023")

# ---- group: Blind Settings
shorten_or_length_of_top_box = Slider(20, range=-100..100)
shorten_or_length_of_blinds = Slider(-10, range=-100..100)
height_of_box_at_top = Slider(50, range=0..100)
thickness = Slider(5, range=0..10)
rotation = Slider(34, range=-90..90)
width = Slider(35, range=0..100)

# ---- group: Glass Pane
srf = Surface(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)

# ---- group: Window Frame
geo = Geometry(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)

# ---- group: Custom Display - Window
material = CreateMaterial(
    Diffuse=ColourSwatch(SwatchColor=RGB(186, 153, 117)),
    Specular=RGB(255, 255, 255),
    Emission=RGB(0, 0, 0),
    Transparency=0,
    Shine=0)
material_2 = CreateMaterial(
    Diffuse=ColourSwatch(SwatchColor=RGB(199, 223, 255)),
    Specular=RGB(255, 255, 255),
    Emission=RGB(0, 0, 0),
    Transparency=0.7,
    Shine=0)
preview = CustomPreview(Geometry=geo, Material=material)
preview_2 = CustomPreview(Geometry=srf, Material=material_2)

# ---- group: Blind/window Settings
distance_from_window_pane = Slider(50, range=0..100)
vertical_shift = Slider(15, range=0..50)
number_of_blinds = Slider(30, range=0..100)

# ---- group: Finding Top Curve
area = Area(Geometry=srf)  # -> Area, Centroid
evalsrf = EvaluateSurface(Surface=srf, Point=area.Centroid)  # -> Point, Normal, UDirection, VDirection, Frame
amp = Amplitude(Vector=evalsrf.Normal, Amplitude=distance_from_window_pane)
move = Move(Geometry=srf, Motion=amp)  # -> Geometry, Transform
debrep = DeconstructBrep(Brep=move.Geometry)  # -> Faces, Edges, Vertices
midpt = CurveMiddle(Curve=debrep.Edges)
pdecon = Deconstruct(Point=midpt)  # -> XComponent, YComponent, ZComponent
sort = SortList(Keys=pdecon.ZComponent, ValuesA=debrep.Edges)  # -> Keys, ValuesA
division = Division(A=width, B=2)
item = ListItem(List=sort.ValuesA, Index=0, Wrap=True)
item_2 = ListItem(List=reverse(sort.ValuesA), Index=0, Wrap=True)
neg = Negative(Value=division)
midpt_2 = CurveMiddle(Curve=item)
midpt_3 = CurveMiddle(Curve=item_2)
ln = Line(StartPoint=midpt_3, EndPoint=midpt_2)

# ---- group: Blind/window Settings (continued)
distance_of_wires = PointOnCurve(item_2, parameter=0.147)
blinds_open_closed = PointOnCurve(ln, parameter=0.714)

# ---- group: Construting First Blind
geo_2 = Geometry(item_2)
ext = ExtendCurve(Curve=geo_2, Type=0, Start=shorten_or_length_of_blinds, End=shorten_or_length_of_blinds)
offset = OffsetCurve(Curve=ext, Distance=[neg, division], Corners=1)  # -> flatten(Curve)
loft = Loft(Curves=offset, Options={Adjust=False, Closed=False, LoftEnds=0, LoftSimp=0, LoftType=0, Rebuild=10, Refit=0.01})
midpt_4 = CurveMiddle(Curve=geo_2)
Z = UnitZ(Factor=thickness)
rad = Radians(Degrees=rotation)
extr = Extrude(Base=loft, Direction=Z)
cap = CapHoles(Brep=extr)
rot3d = Rotate3D(Geometry=cap, Angle=rad, Center=midpt_4, Axis=geo_2)  # -> Geometry, Transform

# ----
ext_2 = ExtendCurve(Curve=geo_2, Type=0, Start=shorten_or_length_of_top_box, End=shorten_or_length_of_top_box)
offset_2 = OffsetCurve(Curve=ext_2, Distance=[neg, division], Corners=1)  # -> flatten(Curve)
loft_2 = Loft(Curves=offset_2, Options={Adjust=False, Closed=False, LoftEnds=0, LoftSimp=0, LoftType=0, Rebuild=10, Refit=0.01})
Z_2 = UnitZ(Factor=height_of_box_at_top)
extr_2 = Extrude(Base=loft_2, Direction=Z_2)

# ---- group: Distributing Blinds
ln_2 = Line(StartPoint=midpt_3, EndPoint=blinds_open_closed)
divide = DivideCurve(Curve=ln_2, Count=number_of_blinds, Kinks=False)  # -> Points, Tangents, Parameters
vec2pt = Vector2Pt(PointA=midpt_3, PointB=divide.Points, Unitize=False)  # -> Vector, Length
move_2 = Move(Geometry=rot3d.Geometry, Motion=vec2pt.Vector)  # -> Geometry, Transform
cull_i = CullIndex(List=move_2.Geometry, Indices=0, Wrap=True)
Z_3 = UnitZ(Factor=vertical_shift)

# ---- group: Generating Wires
vec2pt_2 = Vector2Pt(PointA=midpt_3, PointB=distance_of_wires, Unitize=False)  # -> Vector, Length
neg_2 = Negative(Value=vec2pt_2.Vector)
move_3 = Move(Geometry=ln_2, Motion=[vec2pt_2.Vector, neg_2])  # -> Geometry, Transform
pipe = Pipe(Curve=move_3.Geometry, Radius=Slider(2, range=0..10), Caps=0)  # -> flatten(Pipe)

# ---- group: Distributing Blinds (continued)
move_4 = Move(Geometry=[cull_i, pipe], Motion=Z_3)  # -> Geometry, Transform
bang = ExplodeTree(Data=move_4.Geometry)  # -> Branch0, _0000

# ---- group: Output Geometry
blinds = Geometry(bang._0000)
top_box = Geometry(extr_2)
wires = Geometry(bang.Branch0)

# ---- group: Custom Display - Blinds
material_3 = CreateMaterial(
    Diffuse=ColourSwatch(SwatchColor=RGB(186, 153, 117)),
    Specular=RGB(255, 255, 255),
    Emission=RGB(0, 0, 0),
    Transparency=0,
    Shine=0)
material_4 = CreateMaterial(
    Diffuse=ColourSwatch(SwatchColor=RGB(82, 82, 82)),
    Specular=RGB(255, 255, 255),
    Emission=RGB(0, 0, 0),
    Transparency=0,
    Shine=0)
preview_3 = CustomPreview(Geometry=[blinds, top_box], Material=material_3)
preview_4 = CustomPreview(Geometry=wires, Material=material_4)
