# Grasshopper definition CalculateGFA_v2.0.gh (Grasshopper 1.0.7)

calculategfa_v2_0 = Panel("Tom Dufficy 2023")
brep = Brep([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])
gfa = GFA(geometry=brep)  # -> gfa, measured_geometry, error_check
gfa_in_m2 = Panel(gfa.gfa)
error_check = Panel(gfa.error_check)
measured_surfaces = Geometry(gfa.measured_geometry)

# ==== cluster GFA
geometry = ClusterInput()

# ---- group: Deconstruct and find bottom-facing surface for each volume
debrep = DeconstructBrep(Brep=geometry)  # -> Faces, Edges, Vertices
area = Area(Geometry=debrep.Faces)  # -> Area, Centroid
Z = UnitZ(Factor=1)
evalsrf = EvaluateSurface(Surface=debrep.Faces, Point=area.Centroid)  # -> Point, Normal, UDirection, VDirection, Frame
neg = Negative(Value=Z)
mindex = MemberIndex(Set=evalsrf.Normal, Member=neg)  # -> Index, Count
item = ListItem(List=debrep.Faces, Index=mindex.Index, Wrap=True)  # -> flatten(Item)
area_2 = Area(Geometry=item)  # -> Area, Centroid
measured_geometry = ClusterOutput(item)
ma = MassAddition(Input=area_2.Area)  # -> flatten(Result), PartialResults
gfa = ClusterOutput(ma.Result)

# ---- group: Compares number of volumes selected to number of areas to combine - should match
lng = ListLength(List=area_2.Area)
lng_2 = ListLength(List=geometry)
equals = Equality(FirstNumber=lng, SecondNumber=lng_2)  # -> Equality, Inequality
panel = Panel("Possible Error - check that all volumes are flat on c-plane")
filter = StreamFilter(Gate=equals.Equality, Stream0=panel, Stream1="No error detected")
panel_2 = Panel(filter)
error_check = ClusterOutput(filter)

# ---- group: Colour if unmeasured (likely due to error)
# if a flat base surface is not found, the related volume will be coloured red
combine = CombineData(Input0=mindex.Index)  # -> flatten(Result), Index
null = NullItem(Item=combine.Result)  # -> NullFlags, InvalidFlags, Description
dispatch = Dispatch(List=geometry, DispatchPattern=null.NullFlags)  # -> ListA, ListB
entwine = Entwine(Branch00=ColourSwatch(SwatchColor=RGB(255, 0, 0)), Branch01=ColourSwatch(SwatchColor=RGB(0, 147, 0)), FlattenInputs=True)
entwine_2 = Entwine(Branch00=dispatch.ListA, Branch01=dispatch.ListB, FlattenInputs=True)
preview = CustomPreview(Geometry=entwine_2, Material=entwine)

# ----
panel_3 = Panel(evalsrf.Normal)
