# Grasshopper definition calculatetotalareaofvolumes_tjd.gh (Grasshopper 1.0.7)

geo = Geometry()

# ----
# deconstruct volumes
# find face normals
# fetch indexes of down-facing surfaces
debrep = DeconstructBrep(Brep=geo)  # -> Faces, Edges, Vertices
Z = UnitZ(Factor=1)
area = Area(Geometry=debrep.Faces)  # -> Area, Centroid
neg = Negative(Value=Z)
evalsrf = EvaluateSurface(Surface=debrep.Faces, Point=area.Centroid)  # -> Point, Normal, UDirection, VDirection, Frame
panel = Panel(neg)
panel_2 = Panel(evalsrf.Normal)
mindex = MemberIndex(Set=panel_2, Member=panel)  # -> Index, Count
panel_3 = Panel(mindex.Index)

# ----
# calculate total floor area
item = ListItem(List=debrep.Faces, Index=panel_3, Wrap=True)
area_2 = Area(Geometry=item)  # -> Area, Centroid
ma = MassAddition(Input=flatten(area_2.Area))  # -> Result, PartialResults

total_area = Panel(ma.Result)
