# Grasshopper definition contourgeneration.gh (Grasshopper 1.0.7)
# plug-ins: OpenNest

size_of_text = Slider(9, range=0..100)
how_far_to_separate_contour_groups = Slider(100, range=0..100)
contour_distance = Slider(1.5, range=0..10)
mesh = Mesh(<mesh referenced from the Rhino model>)

Z = UnitZ(Factor=1)
contour = Contour(Shape=mesh, Point=Point(0, 0, 0), Direction=Z, Distance=contour_distance)
group = Group(Objects=contour)  # -> flatten(Group)
lng = ListLength(List=group)
series = Series(Start=how_far_to_separate_contour_groups, Step=how_far_to_separate_contour_groups, Count=lng)
X = UnitX(Factor=series)
pt = Point(Point(0, 0, 0))
move = Move(Geometry=group, Motion=X)  # -> Geometry, Transform
move_2 = Move(Geometry=pt, Motion=X)  # -> Geometry, Transform
lng_2 = ListLength(List=move.Geometry)
neg = Negative(Value=contour_distance)
series_2 = Series(Start=0, Step=neg, Count=lng_2)
Z_2 = UnitZ(Factor=series_2)
series_3 = Series(Start=0, Step=1, Count=lng)
move_3 = Move(Geometry=move_2.Geometry, Motion=Z_2)  # -> Geometry, Transform
move_4 = Move(Geometry=move.Geometry, Motion=Z_2)  # -> Geometry, Transform
text = Text(Location=move_3.Geometry, Text=series_3, Size=size_of_text)
ungroup = Ungroup(Group=move_4.Geometry)

ref_numbers = Curve(text)
flat_contours = Curve(ungroup)
contours_on_mesh = Curve(contour)
