# Grasshopper definition gradient_mapper_advanced.gh (Grasshopper 1.0.4)

number_slider = Slider(12, range=0..100)
geo = Geometry(<brep referenced from the Rhino model>)

divide = DivideDomain²(Domain=geo, UCount=number_slider, VCount=number_slider)
subsrf = Isotrim(Surface=geo, Domain=divide)
area = Area(Geometry=subsrf)  # -> Area, Centroid
srf_cp = SurfaceClosestPoint(Point=area.Centroid, Surface=subsrf)  # -> Point, UVPoint, Distance
evalsrf = EvaluateSurface(Surface=subsrf, Point=srf_cp.UVPoint)  # -> Point, Normal, Frame
devec = DeconstructVector(Vector=evalsrf.Normal)  # -> XComponent, YComponent, ZComponent

gradient = Gradient(
    LowerLimit=expr("-x", "1"),
    UpperLimit="1",
    Parameter=devec.ZComponent,
    stops=[0: RGB(130, 249, 255), 1: RGB(197, 0, 219)])
preview = CustomPreview(Geometry=subsrf, Shader=gradient)
