# Grasshopper definition AutomaticFacadeBlocks.ghx (Grasshopper 1.0.8)
# plug-ins: Pufferfish

# ---- group: Input massing volumes
# Title: Automatic Facade Blocks  v1.1.0
# Meta: Author: Tom Dufficy
# Date: 2025-09-12
# Units: m
# License: MIT (see repo)
# 1. Input base geometry
# IO: Inputs
#   1. Base building masses
#   2. Choice of facade block
# 
# Outputs
# 3. Translated facade block onto massing
# 4. Previews of available blocks
# Notes: Description
# Applies chosen facade block to simple building massings. Intended to add facade options over time across definition versions
# 
# Notes
#   Intended for masterplans & context modelling for visualisations
# Works with flat volumes
# Currently assumes 3m floor-to-floor height, and will try to scale block modules to fill gaps
# 
# Dependencies
# Rhino 8
# Changelog: v1.0
# Initial release
# 
# v1.1
# Added automatic scaling of modules to fill gaps
geo = Geometry([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])

# ---- group: Facade options / Facade 02
facade_block_02 = BlockInstance(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)

# ---- group: Facade options / Facade 05
facade_block_05 = BlockInstance(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)

# ---- group: Facade options / Facade 03
facade_block_03 = BlockInstance(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)

# ---- group: Facade options / Facade 04
facade_block_04 = BlockInstance(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)

# ---- group: Facade options / Facade 01
# 2. Choose a facade and connect width
facade_block_01 = BlockInstance(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)

# ---- group: Automatically adjust width
bbox = BoundingBox(Content=facade_block_01, Plane=PlaneXY(0, 0, 0))  # -> Box, Box_2
debox = DeconstructBox(Box=bbox.Box)  # -> Plane, X, Y, Z
roundd = RoundToDecimalPlace(NumberX=debox.X, DecimalPlace=2, RoundType=0)  # -> Rounded, Difference

# ---- group: Find top & bottom surfaces of volumes, split curves into sides
debrep = DeconstructBrep(Brep=geo)  # -> Faces, Edges, Vertices
area = Area(Geometry=debrep.Faces)  # -> Area, Centroid
pdecon = Deconstruct(Point=area.Centroid)  # -> XComponent, YComponent, ZComponent
sort = SortList(Keys=pdecon.ZComponent, ValuesA=debrep.Faces)  # -> Keys, ValuesA
rev = ReverseList(List=sort.ValuesA)
item = ListItem(List=sort.ValuesA, Index=0, Wrap=True)
item_2 = ListItem(List=rev, Index=0, Wrap=True)
crv = Curve(item)
explode = Explode(Curve=crv, Recursive=True)  # -> Segments, Vertices

# ---- group: Input massing volumes
# 1. Input base geometry
geo_2 = Geometry([<extrusion referenced from the Rhino model> x7])  # disabled

# ---- group: Facade options / Facade 02
facade_block_02_2 = BlockInstance(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)  # disabled

# ---- group: Facade options / Facade 03
facade_block_03_2 = BlockInstance(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)  # disabled

# ---- group: Facade options / Facade 04
facade_block_04_2 = BlockInstance(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)  # disabled

# ---- group: Facade options / Facade 05
facade_block_05_2 = BlockInstance(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)  # disabled

# ---- group: Facade options / Facade 01
# 2. Choose a facade and connect width
facade_block_01_2 = BlockInstance(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)  # disabled

# ---- group: Find top & bottom surfaces of volumes
debrep_2 = DeconstructBrep(Brep=geo_2)  # -> Faces, Edges, Vertices; disabled
area_2 = Area(Geometry=debrep_2.Faces)  # -> Area, Centroid; disabled
pdecon_2 = Deconstruct(Point=area_2.Centroid)  # -> XComponent, YComponent, ZComponent; disabled
sort_2 = SortList(Keys=pdecon_2.ZComponent, ValuesA=debrep_2.Faces)  # -> Keys, ValuesA; disabled
rev_2 = ReverseList(List=sort_2.ValuesA)  # disabled
item_3 = ListItem(List=sort_2.ValuesA, Index=0, Wrap=True)  # disabled
item_4 = ListItem(List=rev_2, Index=0, Wrap=True)  # disabled
crv_2 = Curve(item_3)  # disabled

# ---- group: Automatically adjust width
bbox_2 = BoundingBox(Content=facade_block_05_2, Plane=PlaneXY(0, 0, 0))  # -> Box, Box_2; disabled
debox_2 = DeconstructBox(Box=bbox_2.Box)  # -> Plane, X, Y, Z; disabled
roundd_2 = RoundToDecimalPlace(NumberX=debox_2.X, DecimalPlace=2, RoundType=0)  # -> Rounded, Difference; disabled

# ---- group: Finding remainder after dividing by distance, distributing across modules, calculating scale factor for facades
num = Number(roundd.Rounded)
crv_3 = Curve(explode.Segments)
panel = Panel(num)
divlength = DivideLength(Curve=crv_3, Length=num)  # -> Points, Tangents, Parameters
len = Length(Curve=crv_3)
division = Division(A=len, B=num)
expression = Expression(x=division, Expression="floor(x)")
lng = ListLength(List=divlength.Points)  # -> expr("x-1", Length)
multiplication = Multiplication(A=expression, B=num)
trim = TrimTree(Tree=lng, Depth=1)
subtraction = Subtraction(A=len, B=multiplication)
division_2 = Division(A=subtraction, B=trim)
addition = Addition(A=division_2, B=num)
divlength_2 = DivideLength(Curve=crv_3, Length=addition)  # -> Points, Tangents, Parameters
division_3 = Division(A=addition, B=num)

# ---- group: Separate edges, apply frames, translate facade block to frames
explode_2 = Explode(Curve=crv_2, Recursive=True)  # -> Segments, Vertices; disabled
end = EndPoints(Curve=explode_2.Segments)  # -> Start, End; disabled
divdist = DivideDistance(Curve=explode_2.Segments, Distance=roundd_2.Rounded)  # -> Points, Tangents, Parameters; disabled
pframe = PerpFrame(Curve=graft(explode_2.Segments), Parameter=divdist.Parameters)  # disabled
lastdex = LastIndex(List=pframe)  # disabled
cull_i = CullIndex(List=pframe, Indices=lastdex, Wrap=True)  # disabled
yz = YZPlane(Origin=Point(0, 0, 0))  # disabled
orient = Orient(Geometry=facade_block_05_2, Source=yz, Target=cull_i)  # -> Geometry, Transform; disabled

# ---- group: Distribute frames and modules along curves and resize
pframe_2 = PerpFrame(Curve=graft(explode.Segments), Parameter=divlength_2.Parameters)
lastdex_2 = LastIndex(List=pframe_2)
yz_2 = YZPlane(Origin=Point(0, 0, 0))
cull_i_2 = CullIndex(List=pframe_2, Indices=lastdex_2, Wrap=True)
orient_2 = Orient(Geometry=facade_block_01, Source=yz_2, Target=cull_i_2)  # -> Geometry, Transform
graft = GraftTree(Tree=division_3, IncludeEmptyLists=True, IncludeNullItems=True)
scale_nu = ScaleNU(Geometry=orient_2.Geometry, Plane=cull_i_2, ScaleX=1, ScaleY=1, ScaleZ=graft)  # -> Geometry, Transform

# ----
# 3. Bake blocks, bake top surfaces (optional)
block_instances = BlockInstance(scale_nu.Geometry)
top_surfaces = Geometry(item_2)

# ---- group: Block examples
block_instance = BlockInstance([facade_block_01, facade_block_02, facade_block_03, facade_block_04, facade_block_05])
lng_2 = ListLength(List=block_instance)
# 4. Block previews
series = Series(Start=0, Step="5", Count=lng_2)
Y = UnitY(Factor=series)
move = Move(Geometry=block_instance, Motion=Y)  # -> Geometry, Transform
block_instance_2 = BlockInstance(move.Geometry)
preview = CustomPreview(Geometry=block_instance_2, Material=ColourSwatch(SwatchColor=RGB(220, 118, 139)))

# ----
# 3. Bake blocks, bake top surfaces (optional)
block_instances_2 = BlockInstance(orient.Geometry)  # disabled
top_surfaces_2 = Geometry(item_4)  # disabled

# ---- group: Block examples
block_instance_3 = BlockInstance([facade_block_01_2, facade_block_02_2, facade_block_03_2, facade_block_04_2, facade_block_05_2])  # disabled
lng_3 = ListLength(List=block_instance_3)  # disabled
panel_2 = Panel("5")  # disabled
# 4. Block previews
series_2 = Series(Start=0, Step=panel_2, Count=lng_3)  # disabled
Y_2 = UnitY(Factor=series_2)  # disabled
move_2 = Move(Geometry=block_instance_3, Motion=Y_2)  # -> Geometry, Transform; disabled
swatch = ColourSwatch(SwatchColor=RGB(220, 118, 139))  # disabled
block_instance_4 = BlockInstance(move_2.Geometry)  # disabled
preview_2 = CustomPreview(Geometry=block_instance_4, Material=swatch)  # disabled

# ---- group: Custom visual display
swatch_2 = ColourSwatch(SwatchColor=RGBA(255, 215, 139, 167))
preview_3 = CustomPreview(Geometry=top_surfaces, Material=swatch_2)
preview_4 = CustomPreview(Geometry=block_instances, Material=swatch_2)

swatch_3 = ColourSwatch(SwatchColor=RGBA(255, 215, 139, 167))  # disabled
preview_5 = CustomPreview(Geometry=top_surfaces_2, Material=swatch_3)  # disabled
preview_6 = CustomPreview(Geometry=block_instances_2, Material=swatch_3)  # disabled
