# Grasshopper definition greenroofs_tjd.gh (Grasshopper 1.0.7)

# ---- group: Start Here
# Select the top level BREPs, and configure offset distance + height
# 
# Bake whatever output you need (offset curve, extruded solid etc.)
# 
# If you have any questions, email tjd@adept.dk
extrusion_height = Slider(0.05, range=0..0.1)
offset_distance = Slider(1, range=0.1..10)
top_storey_brep_volumes = Brep([<brep referenced from the Rhino model> x3])

# ----
debrep = DeconstructBrep(Brep=top_storey_brep_volumes)  # -> Faces, Edges, Vertices
area = Area(Geometry=debrep.Faces)  # -> Area, Centroid
pdecon = Deconstruct(Point=area.Centroid)  # -> XComponent, YComponent, ZComponent
sort = SortList(Keys=pdecon.ZComponent, ValuesA=debrep.Faces)  # -> Keys, ValuesA
rev = ReverseList(List=sort.ValuesA)
item = ListItem(List=rev, Index=0, Wrap=True)
top_surfaces_roof_surfaces = Surface(item)
debrep_2 = DeconstructBrep(Brep=top_surfaces_roof_surfaces)  # -> Faces, Edges, Vertices
crv = Curve(debrep_2.Edges)
join = JoinCurves(Curves=crv, Preserve=False)
offsets = OffsetOnSrf(Curve=join, Distance=offset_distance, Surface=top_surfaces_roof_surfaces)

# ---- group: Offset Curves
crv_2 = Curve(offsets)

# ----
code_checker = CodeChecker(G=crv_2, G_2=join)

Z = UnitZ(Factor=extrusion_height)
extr = Extrude(Base=crv_2, Direction=Z)
cap = CapHoles(Brep=extr)

panel = Panel(code_checker)

# ---- group: Offset Volumes
brep = Brep(cap)

# ==== cluster CodeChecker
G = ClusterInput()
G_2 = ClusterInput()
area = Area(Geometry=G)  # -> Area, Centroid
area_2 = Area(Geometry=G_2)  # -> Area, Centroid
larger = LargerThan(FirstNumber=area.Area, SecondNumber=area_2.Area)  # -> flatten(LargerThan), OrEqualTo
ma = MassAddition(Input=larger.LargerThan)  # -> Result, PartialResults
expression = Expression(x=ma.Result, Expression="If(x=0, \"code executed correctly\", \"CHECK RESULTS, one or more roofs are wrong\")")
R = ClusterOutput(expression)
