# Grasshopper definition OutdoorComfort_v1.0.gh (Grasshopper 1.0.7)

# Outdoor Comfort v1.0: Tom Dufficy 2023
# 
# Dependencies:
# Ladybug
# Butterfly
panel = Panel("https://energyplus-weather.s3.amazonaws.com/europe_wmo_region_6/DNK/DNK_Copenhagen.061800_IWEC/DNK_Copenhagen.061800_IWEC.zip")
downloadepw = LBDownloadWeather(weather_URL=panel)  # -> epw_file, stat_file, ddy_file; plug-in component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
epwmap = LBEPWmap(epw_map=Toggle(False))  # -> report; plug-in component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
srf = Surface(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)
genpts = LBGeneratePointGrid(geometry=srf, grid_size=Slider(5, range=0..10))  # -> points, vectors, face_areas, mesh; plug-in component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
geo = Geometry([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])
importepw = LBImportEPW(epw_file=downloadepw.epw_file)  # -> location, dry_bulb_temperature, dew_point_temperature, relative_humidity, wind_speed, wind_direction, direct_normal_rad, diffuse_horizontal_rad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; plug-in component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
brepsinc = PointInBreps(Brep=geo, Point=genpts.points, Strict=False)  # -> Inside, Index
cull = CullPattern(List=genpts.points, CullPattern=invert(brepsinc.Inside))
cullf = CullFaces(Mesh=genpts.mesh, Pattern=brepsinc.Inside)
humantosky = LBHumanToSkyRelation(location=importepw.location, position=flatten(cull), context=flatten(geo), run=Toggle(False))  # -> report, human_points, human_line, fract_body_exp, sky_exposure; plug-in component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
xdata = LBDeconstructData(data=humantosky.fract_body_exp)  # -> header, values; plug-in component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
windrose = LBWindRose(data=importepw.wind_speed, wind_direction=importepw.wind_direction)  # -> report, mesh, compass, orient_line, freq_line, windrose_line, legend, title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; plug-in component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
sunpath = LBSunPath(location=importepw.location, scale=2)  # -> report, vectors, altitudes, azimuths, hoys, sun_pts, analemma, daily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; plug-in component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
avr = Average(Input=xdata.values)  # -> flatten(ArithmeticMean)
outdoorsolarmrt = LBOutdoorSolarMRT(
    location=importepw.location,
    surface_temp=importepw.dry_bulb_temperature,
    dir_norm_rad=importepw.direct_normal_rad,
    diff_horiz_rad=importepw.diffuse_horizontal_rad,
    horiz_infrared=importepw.horizontal_infrared_rad,
    fract_body_exp=avr,
    sky_exposure=humantosky.sky_exposure,
    run=Toggle(False))  # -> report, short_erf, long_erf, short_dmrt, long_dmrt, mrt; plug-in component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
pt = ConstructPoint(XCoordinate=0, YCoordinate=0, ZCoordinate=0)
Y = UnitY(Factor=1)
neg = Negative(Value=windrose.prevailing)
line = LineSDL(Start=pt, Direction=Y, Length="20")
rotate = Rotate(Geometry=line, Angle=neg, Plane=PlaneXY(0, 0, 0))  # -> Geometry, Transform
end = EndPoints(Curve=rotate.Geometry)  # -> Start, End
vec2pt = Vector2Pt(PointA=end.Start, PointB=end.End, Unitize=False)  # -> Vector, Length
rev = Reverse(Vector=vec2pt.Vector)
vdis = VectorDisplay(Anchor=end.Start, Vector=vec2pt.Vector)
windvector = Butterfly_WindVector(wind_speed="17", wind_direction=vec2pt.Vector)  # -> wind_vector; plug-in component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
createbfgeometry = Butterfly_CreateButterflyGeometry(name="bldg", geo=flatten(geo))  # -> report, BF_geo; plug-in component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
tunnelparams = Butterfly_WindTunnelParameters(windward_x=2, top_x=2, sides_x=2, leeward_x=6)  # -> report, tunnel_params; plug-in component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
createcasefromtunnel = Butterfly_CreateCaseFromTunnel(
    name="utci_to_wind",
    BF_geo=flatten(createbfgeometry.BF_geo),
    wind_vector=windvector,
    ref_wind_height=10,
    landscape=6,
    tunnel_params=tunnelparams.tunnel_params,
    run=Toggle(False))  # -> report, block_pts, wind_tunnel, case; plug-in component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
wtgrading = Butterfly_windTunnelGrading(wind_tunnel=createcasefromtunnel.wind_tunnel, cell_size="5", cell_to_cell_ratio=1.2, wake_offset=2, height_offset=5)  # -> report, grad_xyz, cell_count_xyz, cell_count_tot, preview; plug-in component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
blockmesh = Butterfly_blockMesh(
    case=createcasefromtunnel.case,
    grad_xyz=wtgrading.grad_xyz,
    cell_count=wtgrading.cell_count_xyz,
    overwrite=True,
    write=Toggle(False),
    run=Toggle(False))  # -> report, case; plug-in component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
loadmesh = Butterfly_LoadMesh(case=blockmesh.case, inner_mesh=False, load=Toggle(False))  # -> mesh; plug-in component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
snappyhexmesh = Butterfly_snappyHexMesh(case=blockmesh.case, glob_refine_level="2, 2", write=Toggle(False), run=Toggle(False))  # -> report, case; plug-in component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
controldict = Butterfly_controlDict(start_time=0, end_time=300, write_interval=100, write_compression=False, purge_write=0)  # -> control_dict; plug-in component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
probes = Butterfly_probes(points=cull, fields="U")  # -> probes; plug-in component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
ras = Butterfly_RASTurbulenceModel(RAS_model="RNGkEpsilon", turbulence=True, print_coeffs=True)  # -> RAS; plug-in component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
loadmesh_2 = Butterfly_LoadMesh(case=snappyhexmesh.case, inner_mesh=False, load=Toggle(False))  # -> mesh; plug-in component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
steadyincomp = Butterfly_SteadyIncompressibleRecipe(turbulence_prop=ras)  # -> report, recipe; plug-in component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
solutionparams = Butterfly_SolutionParameters(control_dict=controldict, probes=probes)  # -> solution_par; plug-in component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
solution = Butterfly_Solution(
    case=snappyhexmesh.case,
    recipe=steadyincomp.recipe,
    solution_par=solutionparams,
    interval=2,
    write=Toggle(False),
    run=Toggle(False))  # -> report, solution, is_running, timestep, residual_fields, residual_values, log_files; plug-in component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
loadprobesvalue = Butterfly_LoadProbesValue(solution=solution.solution, field="U")  # -> values; plug-in component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
multiplication = Multiplication(A=loadprobesvalue, B=Slider(1, range=0..10))
vlen = VectorLength(Vector=loadprobesvalue)
utci = LBUTCIComfort(
    air_temp=importepw.dry_bulb_temperature,
    mrt=outdoorsolarmrt.mrt,
    rel_humid=importepw.relative_humidity,
    wind_vel=vlen,
    run=Toggle(False))  # -> report, utci, comfort, condition, category, comf_obj; plug-in component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
xdata_2 = LBDeconstructData(data=utci.utci)  # -> header, values; plug-in component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
avr_2 = Average(Input=xdata_2.values)  # -> flatten(ArithmeticMean)
vdisex = VectorDisplayEx(Point=cull, Vector=multiplication, Colour=RGB(0, 0, 0), Width=1)
heatmap = LBSpatialHeatmap(values=avr_2, mesh=cullf)  # -> mesh, legend, title, colors, legend_par; plug-in component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
panel_2 = Panel(utci.category)
