# Grasshopper definition QueleaTest_v1.0.gh (Grasshopper 1.0.7)
# plug-ins: Agent

# Quelea Test v1.0: Tom Dufficy 2023
# 
# Dependencies:
# Quelea
number_slider = Slider(1000, range=0..1000)
pt = Point([Point(18, 19, 0), Point(44, 13, 0), Point(48, 39, 0)])
particle = ConstructParticle(
    UpDirection=Vector(0, 0, 1),
    Acceleration=Vector(0, 0, 0),
    Lifespan=-1,
    Mass=Slider(10, range=0..10),
    BodySize=Slider(2, range=0..10),
    HistoryLength=number_slider)
ptemit = PointEmitter(
    ContinuousFlow=True,
    CreationRate=Slider(1, range=1..1000),
    NumberOfQuelea=Slider(1000, range=0..1000),
    MinimumInitialVelocity=Vector(-0.1, -0.1, -0.1),
    MaximumInitialVelocity=Vector(0.1, 0.1, 0.1),
    Point=pt)
srf = Surface(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)
agent = ConstructAgent(
    ParticleQueleaSettings=particle,
    MaxSpeed=Slider(1, range=0..1),
    MaxForce=Slider(3, range=0..5),
    VisionRadius=Slider(15, range=0..100),
    VisionAngle=Slider(360, range=1..360))
trigger = Trigger(Interval=10, TimerInterval=10, Target=[system, engine])  # disabled
system = System(QueleaSettings=agent, Emitters=ptemit, Environment=srf)  # -> System, Quelea, QueleaNetwork
engine = Engine(Reset=Button(), System=system.System)
brep = Brep(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)
brep_2 = Brep(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)
brep_3 = Brep(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)
brep_4 = Brep(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)
toggle = BooleanToggle(True)
pt_2 = Point(Point(23, 42, 0))
crv = Curve(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)
departicle = DeconstructParticle(ParticleQuelea=system.Quelea)  # -> Position, Velocity, Acceleration, Lifespan, SurfacePosition, SurfaceVelocity, SurfaceAcceleration
avoidcollision = AvoidUnalignedCollisionForce(
    Apply=Toggle(False),
    WeightMultiplier=Slider(0.2, range=0..1),
    AgentQuelea=system.Quelea,
    QueleaNetwork=system.QueleaNetwork,
    MinumumTimeToCollision=5,
    PotentialCollisionDistance=0)  # -> Force, DesiredVelocity
align = AlignForce(
    Apply=Toggle(False),
    WeightMultiplier=Slider(0.2, range=0..1),
    AgentQuelea=system.Quelea,
    QueleaNetwork=system.QueleaNetwork)  # -> Force, DesiredVelocity
wander = WanderForce(
    Apply=Toggle(True),
    WeightMultiplier=Slider(0.1, range=0..1),
    AgentQuelea=system.Quelea,
    Strength=Slider(0.5, range=0..1),
    Rate=Slider(0.5, range=0..1))  # -> Force, DesiredVelocity, Sphere, TargetPoint
arrive = ArriveForce(
    Apply=Toggle(True),
    WeightMultiplier=Slider(0.5, range=0..1),
    AgentQuelea=system.Quelea,
    TargetPoint=pt_2,
    ArrivalRadius=Slider(1, range=0..10))  # -> Force, DesiredVelocity
seek = SeekForce(Apply=Toggle(True), WeightMultiplier=Slider(0.2, range=0..1), AgentQuelea=system.Quelea, TargetPoint=pt_2)  # -> Force, DesiredVelocity
followpath = FollowPathForce(Apply=True, WeightMultiplier=1, AgentQuelea=system.Quelea, Curve=crv, PathRadius=Slider(2, range=0..10))  # -> Force, DesiredVelocity, PredictionLocation, PathPoint
avoidobstacle = AvoidObstacleForce(
    Apply=toggle,
    WeightMultiplier=Slider(1, range=0..1),
    AgentQuelea=system.Quelea,
    Obstacle=brep,
    VisionRadiusMutliplier=Slider(0.4, range=0..1))  # -> Force, DesiredVelocity
cohese = CoheseForce(
    Apply=Toggle(True),
    WeightMultiplier=Slider(0.1, range=0..1),
    AgentQuelea=system.Quelea,
    QueleaNetwork=system.QueleaNetwork)  # -> Force, DesiredVelocity
avoidobstacle_2 = AvoidObstacleForce(
    Apply=toggle,
    WeightMultiplier=Slider(1, range=0..1),
    AgentQuelea=system.Quelea,
    Obstacle=brep_2,
    VisionRadiusMutliplier=Slider(0.4, range=0..1))  # -> Force, DesiredVelocity
avoidobstacle_3 = AvoidObstacleForce(
    Apply=toggle,
    WeightMultiplier=Slider(1, range=0..1),
    AgentQuelea=system.Quelea,
    Obstacle=brep_3,
    VisionRadiusMutliplier=Slider(0.4, range=0..1))  # -> Force, DesiredVelocity
avoidobstacle_4 = AvoidObstacleForce(
    Apply=toggle,
    WeightMultiplier=Slider(1, range=0..1),
    AgentQuelea=system.Quelea,
    Obstacle=brep_4,
    VisionRadiusMutliplier=Slider(0.4, range=0..1))  # -> Force, DesiredVelocity
intcrv = Interpolate(Vertices=departicle.Position, Degree=3, Periodic=False, KnotStyle=1)  # -> Curve, Length, Domain; disabled
