# Grasshopper definition RailingGenerator_v1.0.gh (Grasshopper 1.0.7)

height_of_posts = Slider(767, range=0..10000)
distance_between_posts = Slider(186, range=0..1000)
railinggenerator_v1_0 = Panel("Tom Dufficy 2024")
rail_width = Slider(46, range=0..100)
rail_thickness = Slider(8, range=0..100)
rectangle_side_1 = Slider(10, range=0..10)
crv = Curve(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)
rectangle_side_2 = Slider(29, range=0..100)
divdist = DivideDistance(Curve=crv, Distance=distance_between_posts)  # -> Points, Tangents, Parameters
division = Division(A=rail_width, B=2)
Z = UnitZ(Factor=height_of_posts)
hframe = HorizontalFrame(Curve=crv, Parameter=divdist.Parameters)
neg = Negative(Value=division)
xy = XYPlane(Origin=Point(0, 0, 0))
move = Move(Geometry=crv, Motion=Z)  # -> Geometry, Transform
division_2 = Division(A=rectangle_side_2, B=2)
division_3 = Division(A=rectangle_side_1, B=2)
offset = OffsetCurve(Curve=move.Geometry, Distance=[division, neg], Plane=xy, Corners=1)
dom = ConstructDomain(DomainStart=division_3, DomainEnd=expr("-x", division_3))
dom_2 = ConstructDomain(DomainStart=division_2, DomainEnd=expr("-x", division_2))
Z_2 = UnitZ(Factor=expr("-x", rail_thickness))
loft = Loft(Curves=flatten(offset), Options={Adjust=False, Closed=False, LoftEnds=0, LoftSimp=0, LoftType=0, Rebuild=10, Refit=0.01})
extr = Extrude(Base=loft, Direction=Z_2)
rectangle = Rectangle(Plane=hframe, XSize=dom, YSize=dom_2, Radius=0)  # -> Rectangle, Length
boxrec = BoxRectangle(Rectangle=rectangle.Rectangle, Height=height_of_posts)
geo = Geometry(boxrec)
geo_2 = Geometry(extr)
