# Grasshopper definition RainFlowAnalysis_v2.0.gh (Grasshopper 1.0.7)
# plug-ins: Kangaroo2 Components

rain_flow_analysis_v2_0 = Panel("Tom Dufficy 2023")
geo = Geometry(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)

# ---- group: Number of Points
number_slider = Slider(27, range=0..100)
number_slider_2 = Slider(33, range=0..100)

# ---- group: Scale of Bounding Box
number_slider_3 = Slider(1.2, range=1..2.5)

# ---- group: Generating Points
bbox = BoundingBox(Content=geo, Plane=PlaneXY(0, 0, 0))  # -> Box, Box_2
debrep = DeconstructBrep(Brep=bbox.Box)  # -> Faces, Edges, Vertices
item = ListItem(List=debrep.Faces, Index=[5, 4], Wrap=True)
area = Area(Geometry=item)  # -> Area, Centroid
scale = Scale(Geometry=item, Center=area.Centroid, Factor=[number_slider_3, "5"])  # -> Geometry, Transform
item_2 = ListItem(List=scale.Geometry, Index=1, Wrap=True)
Z = UnitZ(Factor="-10")
extr = Extrude(Base=item_2, Direction=Z)

# ----
item_3 = ListItem(List=scale.Geometry, Index=0, Wrap=True)

# ---- group: Generating Points (continued)
sdivide = DivideSurface(Surface=item_3, UCount=number_slider_2, VCount=number_slider)  # -> Points, Normals, Parameters

# ---- group: Physics
Z_2 = UnitZ(Factor="-0.0001")
spc = SolidPointCollide(Points=sdivide.Points, Solid=geo, Interior=False, Unidirectional=True, Strength=1)
spc_2 = SolidPointCollide(Points=sdivide.Points, Solid=extr, Interior=False, Unidirectional=True, Strength=1)
show = Show(G=sdivide.Points)
load = Load(Point=sdivide.Points, ForceVector=Z_2, Weighting=1)

# ---- group: Solver
solver = Solver(GoalObjects=[spc, load, show, spc_2], Reset=Button(), Threshold=1e-15, Tolerance=0.01, On=Toggle(False))  # -> I, graft(V), O
rec = DataRecorder(solver.V, DataLimit=-10, RecordData=True)
pline = PolyLine(Vertices=rec, Closed=False)
dot = DotDisplay(Point=solver.O)
