# Grasshopper definition randomlyplacepeople_tjd.gh (Grasshopper 1.0.7)
# plug-ins: EleFront

# ---- group: Set-up
# select points for people to be placed onto
seed_for_block_randomisation = Slider(0, range=0..10)  # disabled
name_of_blocks = Panel("""human_1
human_2
human_3
human_4
human_5
human_6
human_7
human_8
human_9
human_10""")  # disabled
seed_for_rotation_angles = Slider(0, range=0..10)  # disabled
points_to_place_people = Geometry([<point referenced from the Rhino model> x24])  # disabled

# ----
# select points for people to be placed onto
# list all possible blocks for the definition to choose from
seed_for_block_randomisation_2 = Slider(0, range=0..10)
name_of_blocks_2 = Panel("""human_1
human_2
human_3
human_4
human_5
human_6
human_7
human_8
human_9
human_10""")
points_to_place_blocks = Geometry([<point referenced from the Rhino model> x24])
seed_for_rotation_angles_2 = Slider(0, range=0..10)

# ---- group: Placement of blocks
lng = ListLength(List=points_to_place_people)  # disabled
random = Random(Range=Domain(0, 9), Number=lng, Seed=seed_for_block_randomisation)  # disabled
item = ListItem(List=name_of_blocks, Index=random, Wrap=True)  # disabled
inblock = InsertBlock(BlockName=item, SourcePlane=points_to_place_people)  # disabled

# ---- group: Selection, placement, and rotation of blocks
cluster = Cluster(
    L=points_to_place_blocks,
    P=points_to_place_blocks,
    S=seed_for_block_randomisation_2,
    L_2=name_of_blocks_2,
    S_2=seed_for_rotation_angles_2,
    P_2=points_to_place_blocks)

# ----
output = Geometry(cluster)

# ---- group: Rotation of blocks
random_2 = Random(Range=Domain(0, 360), Number=lng, Seed=seed_for_rotation_angles)  # disabled
rad = Radians(Degrees=random_2)  # disabled
rotate = Rotate(Geometry=inblock, Angle=rad, Plane=points_to_place_people)  # -> Geometry, Transform; disabled

# ----
output_2 = Geometry(rotate.Geometry)  # disabled

# ==== cluster Cluster
S = ClusterInput()
L = ClusterInput()
P = ClusterInput()
L_2 = ClusterInput()
P_2 = ClusterInput()
S_2 = ClusterInput()
lng = ListLength(List=L)
random = Random(Range=Domain(0, 9), Number=lng, Seed=S)
item = ListItem(List=L_2, Index=random, Wrap=True)
inblock = InsertBlock(BlockName=item, SourcePlane=P)
random_2 = Random(Range=Domain(0, 360), Number=lng, Seed=S_2)
rad = Radians(Degrees=random_2)
rotate = Rotate(Geometry=inblock, Angle=rad, Plane=P_2)  # -> Geometry, Transform
G = ClusterOutput(rotate.Geometry)
