# Grasshopper definition SortByArea_v1.2.gh (Grasshopper 1.0.7)
# plug-ins: Pufferfish

x_adjustment = Slider(0, range=-40..40)  # disabled
y_adjustment = Slider(0, range=-40..40)  # disabled
# v1,1
geo = Geometry([<curve referenced from the Rhino model> x19])  # disabled

size_of_list_partitions = Slider(4, range=0..10)
x_adjustment_2 = Slider(0, range=-40..40)
y_adjustment_2 = Slider(0, range=-40..40)
# v1,2
geo_2 = Geometry([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])

# ---- group: Finding Minimum X Y Values
brec = BoundingRectangle(Geometry=graft(geo), Plane=PlaneXY(0, 0, 0), Axis=0, Slide=0, Union=True)  # -> Bounding, DimensionX, DimensionY; disabled
flatten = FlattenTree(Tree=brec.DimensionY, Path="{0}")  # disabled
flatten_2 = FlattenTree(Tree=brec.DimensionX, Path="{0}")  # disabled
sort = SortList(Keys=flatten)  # -> Keys, ValuesA; disabled
lastdex = LastIndex(List=sort.Keys)  # disabled
sort_2 = SortList(Keys=flatten_2)  # -> Keys, ValuesA; disabled
item = ListItem(List=sort.Keys, Index=lastdex, Wrap=True)  # disabled
lastdex_2 = LastIndex(List=sort_2.Keys)  # disabled
item_2 = ListItem(List=sort_2.Keys, Index=lastdex_2, Wrap=True)  # disabled
addition = Addition(A=item, B=y_adjustment)  # disabled
addition_2 = Addition(A=item_2, B=x_adjustment)  # disabled

brec_2 = BoundingRectangle(Geometry=graft(geo_2), Plane=PlaneXY(0, 0, 0), Axis=0, Slide=0, Union=True)  # -> flatten(Bounding), DimensionX, DimensionY
flatten_3 = FlattenTree(Tree=brec_2.DimensionY, Path="{0}")
flatten_4 = FlattenTree(Tree=brec_2.DimensionX, Path="{0}")
sort_3 = SortList(Keys=flatten_3)  # -> Keys, ValuesA
lastdex_3 = LastIndex(List=sort_3.Keys)
sort_4 = SortList(Keys=flatten_4)  # -> Keys, ValuesA
item_3 = ListItem(List=sort_3.Keys, Index=lastdex_3, Wrap=True)
lastdex_4 = LastIndex(List=sort_4.Keys)
item_4 = ListItem(List=sort_4.Keys, Index=lastdex_4, Wrap=True)
addition_3 = Addition(A=item_3, B=y_adjustment_2)
addition_4 = Addition(A=item_4, B=x_adjustment_2)

# ----
area = Area(Geometry=geo)  # -> Area, Centroid; disabled
number_slider = Slider(4, range=0..10)  # disabled
sort_5 = SortList(Keys=area.Area, ValuesA=geo)  # -> Keys, ValuesA; disabled
partition = PartitionList(List=sort_5.ValuesA, Size=number_slider)  # disabled
bang = ExplodeTree(Data=partition)  # -> Branch0, Branch1, Branch2, Branch3, Branch4; disabled

area_2 = Area(Geometry=geo_2)  # -> Area, Centroid
sort_6 = SortList(Keys=area_2.Area, ValuesA=geo_2, ValuesB=brec_2.Bounding)  # -> Keys, ValuesA, ValuesB
partition_2 = PartitionList(List=sort_6.ValuesA, Size=size_of_list_partitions)
partition_3 = PartitionList(List=sort_6.ValuesB, Size=size_of_list_partitions)

tstat = TreeStatistics(Tree=partition_2)  # -> Paths, Length, Count
series = Series(Start=1, Step=1, Count=tstat.Count)
multiplication = Multiplication(A=addition_3, B=series)  # -> graft(Result)
pt = ConstructPoint(XCoordinate=0, YCoordinate=expr("x*1", multiplication), ZCoordinate=0)
area_3 = Area(Geometry=partition_2)  # -> Area, Centroid
move2pt = MoveToPoint(Geometry=partition_2, PointA=area_3.Centroid, PointB=pt)  # -> Moved, Vector, Transform
move2pt_2 = MoveToPoint(Geometry=partition_3, PointA=area_3.Centroid, PointB=pt)  # -> Moved, Vector, Transform
lng = ListLength(List=move2pt.Moved)
series_2 = Series(Start=0, Step=addition_4, Count=lng)
X = UnitX(Factor=series_2)
move = Move(Geometry=move2pt_2.Moved, Motion=X)  # -> Geometry, Transform
move_2 = Move(Geometry=move2pt.Moved, Motion=X)  # -> Geometry, Transform

pt_2 = ConstructPoint(XCoordinate=0, YCoordinate=expr("x*5", addition), ZCoordinate=0)  # disabled
area_4 = Area(Geometry=bang.Branch0)  # -> Area, Centroid; disabled
lng_2 = ListLength(List=bang.Branch0)  # disabled
move2pt_3 = MoveToPoint(Geometry=bang.Branch0, PointA=area_4.Centroid, PointB=pt_2)  # -> Moved, Vector, Transform; disabled
series_3 = Series(Start=0, Step=addition_2, Count=lng_2)  # disabled
X_2 = UnitX(Factor=series_3)  # disabled
move_3 = Move(Geometry=move2pt_3.Moved, Motion=X_2)  # -> Geometry, Transform; disabled

pt_3 = ConstructPoint(XCoordinate=0, YCoordinate=expr("x*4", addition), ZCoordinate=0)  # disabled
area_5 = Area(Geometry=bang.Branch1)  # -> Area, Centroid; disabled
lng_3 = ListLength(List=bang.Branch1)  # disabled
move2pt_4 = MoveToPoint(Geometry=bang.Branch1, PointA=area_5.Centroid, PointB=pt_3)  # -> Moved, Vector, Transform; disabled
series_4 = Series(Start=0, Step=addition_2, Count=lng_3)  # disabled
X_3 = UnitX(Factor=series_4)  # disabled
move_4 = Move(Geometry=move2pt_4.Moved, Motion=X_3)  # -> Geometry, Transform; disabled

pt_4 = ConstructPoint(XCoordinate=0, YCoordinate=expr("x*1", addition), ZCoordinate=0)  # disabled
area_6 = Area(Geometry=bang.Branch4)  # -> Area, Centroid; disabled
lng_4 = ListLength(List=bang.Branch4)  # disabled
move2pt_5 = MoveToPoint(Geometry=bang.Branch4, PointA=area_6.Centroid, PointB=pt_4)  # -> Moved, Vector, Transform; disabled
series_5 = Series(Start=0, Step=addition_2, Count=lng_4)  # disabled
X_4 = UnitX(Factor=series_5)  # disabled
move_5 = Move(Geometry=move2pt_5.Moved, Motion=X_4)  # -> Geometry, Transform; disabled

pt_5 = ConstructPoint(XCoordinate=0, YCoordinate=expr("x*3", addition), ZCoordinate=0)  # disabled
area_7 = Area(Geometry=bang.Branch2)  # -> Area, Centroid; disabled
lng_5 = ListLength(List=bang.Branch2)  # disabled
move2pt_6 = MoveToPoint(Geometry=bang.Branch2, PointA=area_7.Centroid, PointB=pt_5)  # -> Moved, Vector, Transform; disabled
series_6 = Series(Start=0, Step=addition_2, Count=lng_5)  # disabled
X_5 = UnitX(Factor=series_6)  # disabled
move_6 = Move(Geometry=move2pt_6.Moved, Motion=X_5)  # -> Geometry, Transform; disabled

pt_6 = ConstructPoint(XCoordinate=0, YCoordinate=expr("x*2", addition), ZCoordinate=0)  # disabled
area_8 = Area(Geometry=bang.Branch3)  # -> Area, Centroid; disabled
lng_6 = ListLength(List=bang.Branch3)  # disabled
move2pt_7 = MoveToPoint(Geometry=bang.Branch3, PointA=area_8.Centroid, PointB=pt_6)  # -> Moved, Vector, Transform; disabled
series_7 = Series(Start=0, Step=addition_2, Count=lng_6)  # disabled
X_6 = UnitX(Factor=series_7)  # disabled
move_7 = Move(Geometry=move2pt_7.Moved, Motion=X_6)  # -> Geometry, Transform; disabled

area_9 = Area(Geometry=[move_3.Geometry, move_4.Geometry, move_6.Geometry, move_7.Geometry, move_5.Geometry])  # -> Area, Centroid; disabled
panel = Panel(" m2")  # disabled
int = Integer(area_9.Area)  # disabled
concat = Concatenate(FragmentA=int, FragmentB=panel)  # disabled
tag = TextTag3D(Location=area_9.Centroid, Text=concat, Size=2, Justification=5)  # disabled

area_10 = Area(Geometry=move_2.Geometry)  # -> Area, Centroid
int_2 = Integer(area_10.Area)
concat_2 = Concatenate(FragmentA=int_2, FragmentB=" m2")
preview = CustomPreview(Geometry=move.Geometry, Material=ColourSwatch(SwatchColor=RGB(255, 207, 239)))
preview_2 = CustomPreview(Geometry=move_2.Geometry, Material=ColourSwatch(SwatchColor=RGB(0, 123, 255)))
tag_2 = TextTag3D(Location=area_10.Centroid, Text=concat_2, Size=2, Colour=ColourSwatch(SwatchColor=RGB(34, 0, 255)), Justification=5)
