# Grasshopper definition SortByArea_v1.1.gh (Grasshopper 1.0.7)
# plug-ins: Pufferfish

x_adjustment = Slider(0, range=-40..40)
y_adjustment = Slider(0, range=-40..40)
geo = Geometry([<curve referenced from the Rhino model> x19])

# ---- group: Finding Minimum X Y Values
brec = BoundingRectangle(Geometry=graft(geo), Plane=PlaneXY(0, 0, 0), Axis=0, Slide=0, Union=True)  # -> Bounding, DimensionX, DimensionY
flatten = FlattenTree(Tree=brec.DimensionY, Path="{0}")
flatten_2 = FlattenTree(Tree=brec.DimensionX, Path="{0}")
sort = SortList(Keys=flatten)  # -> Keys, ValuesA
lastdex = LastIndex(List=sort.Keys)
sort_2 = SortList(Keys=flatten_2)  # -> Keys, ValuesA
item = ListItem(List=sort.Keys, Index=lastdex, Wrap=True)
lastdex_2 = LastIndex(List=sort_2.Keys)
item_2 = ListItem(List=sort_2.Keys, Index=lastdex_2, Wrap=True)
addition = Addition(A=item, B=y_adjustment)
addition_2 = Addition(A=item_2, B=x_adjustment)

# ----
area = Area(Geometry=geo)  # -> Area, Centroid
sort_3 = SortList(Keys=area.Area, ValuesA=geo)  # -> Keys, ValuesA
partition = PartitionList(List=sort_3.ValuesA, Size=Slider(4, range=0..10))
bang = ExplodeTree(Data=partition)  # -> Branch0, Branch1, Branch2, Branch3, Branch4

pt = ConstructPoint(XCoordinate=0, YCoordinate=expr("x*5", addition), ZCoordinate=0)
area_2 = Area(Geometry=bang.Branch0)  # -> Area, Centroid
lng = ListLength(List=bang.Branch0)
move2pt = MoveToPoint(Geometry=bang.Branch0, PointA=area_2.Centroid, PointB=pt)  # -> Moved, Vector, Transform
series = Series(Start=0, Step=addition_2, Count=lng)
X = UnitX(Factor=series)
move = Move(Geometry=move2pt.Moved, Motion=X)  # -> Geometry, Transform

pt_2 = ConstructPoint(XCoordinate=0, YCoordinate=expr("x*4", addition), ZCoordinate=0)
area_3 = Area(Geometry=bang.Branch1)  # -> Area, Centroid
lng_2 = ListLength(List=bang.Branch1)
move2pt_2 = MoveToPoint(Geometry=bang.Branch1, PointA=area_3.Centroid, PointB=pt_2)  # -> Moved, Vector, Transform
series_2 = Series(Start=0, Step=addition_2, Count=lng_2)
X_2 = UnitX(Factor=series_2)
move_2 = Move(Geometry=move2pt_2.Moved, Motion=X_2)  # -> Geometry, Transform

pt_3 = ConstructPoint(XCoordinate=0, YCoordinate=expr("x*1", addition), ZCoordinate=0)
area_4 = Area(Geometry=bang.Branch4)  # -> Area, Centroid
lng_3 = ListLength(List=bang.Branch4)
move2pt_3 = MoveToPoint(Geometry=bang.Branch4, PointA=area_4.Centroid, PointB=pt_3)  # -> Moved, Vector, Transform
series_3 = Series(Start=0, Step=addition_2, Count=lng_3)
X_3 = UnitX(Factor=series_3)
move_3 = Move(Geometry=move2pt_3.Moved, Motion=X_3)  # -> Geometry, Transform

pt_4 = ConstructPoint(XCoordinate=0, YCoordinate=expr("x*3", addition), ZCoordinate=0)
area_5 = Area(Geometry=bang.Branch2)  # -> Area, Centroid
lng_4 = ListLength(List=bang.Branch2)
move2pt_4 = MoveToPoint(Geometry=bang.Branch2, PointA=area_5.Centroid, PointB=pt_4)  # -> Moved, Vector, Transform
series_4 = Series(Start=0, Step=addition_2, Count=lng_4)
X_4 = UnitX(Factor=series_4)
move_4 = Move(Geometry=move2pt_4.Moved, Motion=X_4)  # -> Geometry, Transform

pt_5 = ConstructPoint(XCoordinate=0, YCoordinate=expr("x*2", addition), ZCoordinate=0)
area_6 = Area(Geometry=bang.Branch3)  # -> Area, Centroid
lng_5 = ListLength(List=bang.Branch3)
move2pt_5 = MoveToPoint(Geometry=bang.Branch3, PointA=area_6.Centroid, PointB=pt_5)  # -> Moved, Vector, Transform
series_5 = Series(Start=0, Step=addition_2, Count=lng_5)
X_5 = UnitX(Factor=series_5)
move_5 = Move(Geometry=move2pt_5.Moved, Motion=X_5)  # -> Geometry, Transform

area_7 = Area(Geometry=[move.Geometry, move_2.Geometry, move_4.Geometry, move_5.Geometry, move_3.Geometry])  # -> Area, Centroid
int = Integer(area_7.Area)
concat = Concatenate(FragmentA=int, FragmentB=" m2")
tag = TextTag3D(Location=area_7.Centroid, Text=concat, Size=2, Justification=5)
