# Grasshopper definition sortbyarea_v1.0.gh (Grasshopper 1.0.7)
# plug-ins: Pufferfish

number_slider = Slider(19, range=0..100)
number_slider_2 = Slider(31, range=0..100)
geo = Geometry([<curve referenced from the Rhino model> x20])

area = Area(Geometry=geo)  # -> Area, Centroid
sort = SortList(Keys=area.Area, ValuesA=geo)  # -> Keys, ValuesA
partition = PartitionList(List=sort.ValuesA, Size=Slider(4, range=0..10))
bang = ExplodeTree(Data=partition)  # -> Branch0, Branch1, Branch2, Branch3, Branch4

pt = ConstructPoint(XCoordinate=0, YCoordinate=expr("x*5", number_slider), ZCoordinate=0)
area_2 = Area(Geometry=bang.Branch0)  # -> Area, Centroid
lng = ListLength(List=bang.Branch0)
move2pt = MoveToPoint(Geometry=bang.Branch0, PointA=area_2.Centroid, PointB=pt)  # -> Moved, Vector, Transform
series = Series(Start=0, Step=number_slider_2, Count=lng)
X = UnitX(Factor=series)
move = Move(Geometry=move2pt.Moved, Motion=X)  # -> Geometry, Transform

pt_2 = ConstructPoint(XCoordinate=0, YCoordinate=expr("x*4", number_slider), ZCoordinate=0)
area_3 = Area(Geometry=bang.Branch1)  # -> Area, Centroid
lng_2 = ListLength(List=bang.Branch1)
move2pt_2 = MoveToPoint(Geometry=bang.Branch1, PointA=area_3.Centroid, PointB=pt_2)  # -> Moved, Vector, Transform
series_2 = Series(Start=0, Step=number_slider_2, Count=lng_2)
X_2 = UnitX(Factor=series_2)
move_2 = Move(Geometry=move2pt_2.Moved, Motion=X_2)  # -> Geometry, Transform

pt_3 = ConstructPoint(XCoordinate=0, YCoordinate=expr("x*1", number_slider), ZCoordinate=0)
area_4 = Area(Geometry=bang.Branch4)  # -> Area, Centroid
lng_3 = ListLength(List=bang.Branch4)
move2pt_3 = MoveToPoint(Geometry=bang.Branch4, PointA=area_4.Centroid, PointB=pt_3)  # -> Moved, Vector, Transform
series_3 = Series(Start=0, Step=number_slider_2, Count=lng_3)
X_3 = UnitX(Factor=series_3)
move_3 = Move(Geometry=move2pt_3.Moved, Motion=X_3)  # -> Geometry, Transform

pt_4 = ConstructPoint(XCoordinate=0, YCoordinate=expr("x*3", number_slider), ZCoordinate=0)
area_5 = Area(Geometry=bang.Branch2)  # -> Area, Centroid
lng_4 = ListLength(List=bang.Branch2)
move2pt_4 = MoveToPoint(Geometry=bang.Branch2, PointA=area_5.Centroid, PointB=pt_4)  # -> Moved, Vector, Transform
series_4 = Series(Start=0, Step=number_slider_2, Count=lng_4)
X_4 = UnitX(Factor=series_4)
move_4 = Move(Geometry=move2pt_4.Moved, Motion=X_4)  # -> Geometry, Transform

pt_5 = ConstructPoint(XCoordinate=0, YCoordinate=expr("x*2", number_slider), ZCoordinate=0)
area_6 = Area(Geometry=bang.Branch3)  # -> Area, Centroid
lng_5 = ListLength(List=bang.Branch3)
move2pt_5 = MoveToPoint(Geometry=bang.Branch3, PointA=area_6.Centroid, PointB=pt_5)  # -> Moved, Vector, Transform
series_5 = Series(Start=0, Step=number_slider_2, Count=lng_5)
X_5 = UnitX(Factor=series_5)
move_5 = Move(Geometry=move2pt_5.Moved, Motion=X_5)  # -> Geometry, Transform

area_7 = Area(Geometry=[move.Geometry, move_2.Geometry, move_4.Geometry, move_5.Geometry, move_3.Geometry])  # -> Area, Centroid
int = Integer(area_7.Area)
concat = Concatenate(FragmentA=int, FragmentB=" m2")
tag = TextTag3D(Location=area_7.Centroid, Text=concat, Size=1, Justification=5)
