# Grasshopper definition squarepipe.gh (Grasshopper 1.0.7)

crv = Curve()
pframe = PerpFrame(Curve=reparameterize(crv), Parameter="0")
neg = Negative(Value=Slider(20, range=0..100))
num = Number(neg)
rectangle = Rectangle(Plane=pframe, XSize=num, YSize=num, Radius=0)  # -> Rectangle, Length
swp1 = Sweep1(Rail=crv, Sections=rectangle.Rectangle, Miter=1)
