# Grasshopper definition SquarePipe_v1.0.gh (Grasshopper 1.0.7)

squarepipe_v1_0 = Panel("Tom Dufficy 2023")

width = Slider(4, range=0..100)
crv = Curve(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)

neg = Negative(Value=width)
num = Number(neg)
pframe = PerpFrame(Curve=reparameterize(crv), Parameter="0")
rectangle = Rectangle(Plane=pframe, XSize=num, YSize=num, Radius=0)  # -> Rectangle, Length
swp1 = Sweep1(Rail=crv, Sections=rectangle.Rectangle, Miter=1)
geo = Geometry(swp1)
