# Grasshopper definition generatevectorshadows_tjd.gh (Grasshopper 1.0.7)

# ----
# Input BREP geometry here, and set desired sun angle & azimuth
# 
# Shadows require meshes, definition automatically converts to mesh.
# 
# Sun is positioned around origin
sun_azimuth = Slider(-43, range=-150..150)
sun_altitude = Slider(34, range=10..80)
input_breps = Geometry([<brep referenced from the Rhino model> x3])

# ---- group: Generating Sun Position
_100 = Integer(100)
pt = ConstructPoint(XCoordinate=0, YCoordinate=0, ZCoordinate=0)
Y = UnitY(Factor=1)
neg = Negative(Value=_100)
line = LineSDL(Start=pt, Direction=Y, Length=neg)
end = EndPoints(Curve=line)  # -> Start, End
X = UnitX(Factor=1)
neg_2 = Negative(Value=X)
line_2 = LineSDL(Start=pt, Direction=[X, neg_2], Length=_100)
join = JoinCurves(Curves=line_2, Preserve=False)
rad = Radians(Degrees=sun_altitude)
rotax = RotateAxis(Geometry=line, Angle=rad, Axis=join)  # -> Geometry, Transform
rad_2 = Radians(Degrees=sun_azimuth)
rot3d = Rotate3D(Geometry=rotax.Geometry, Angle=rad_2, Center=pt, Axis=Vector(0, 0, 1))  # -> Geometry, Transform
end_2 = EndPoints(Curve=rot3d.Geometry)  # -> Start, End
vec2pt = Vector2Pt(PointA=end_2.Start, PointB=end_2.End, Unitize=False)  # -> Vector, Length
mesh = MeshBrep(
    Brep=input_breps,
    Settings={GridMaxCount=0, GridMinCount=16, JaggedSeams=False, MaxEdgeLength=0, MinEdgeLength=0.0001, MinTolerance=0, Refine=True, RefineAngle=0, RelativeTolerance=0.65, SimplePlanes=True, Tolerance=0})
mshadow = MeshShadow(Mesh=mesh, Light=vec2pt.Vector, Plane=PlaneXY(0, 0, 0))

# ---- group: Visualise Sun Position
toggle = BooleanToggle(False)
sph = Sphere(Base=end_2.End, Radius=Slider(5, range=0..10))
rev = Reverse(Vector=vec2pt.Vector)
vdisex = VectorDisplayEx(Point=end_2.End, Vector=rev, Colour=RGB(207, 195, 87), Width=1)

# ----
shadows = Geometry(mshadow)
