# Grasshopper definition gradient_mapper_basic.gh (Grasshopper 1.0.4)

number_slider = Slider(12, range=0..100)
geo = Geometry([<curve referenced from the Rhino model> x6])
geo_2 = Geometry(<brep referenced from the Rhino model>)
len = Length(Curve=geo)
gradient = Gradient(
    LowerLimit=Slider(10000, range=0..10000),
    UpperLimit=Slider(20000, range=0..100000),
    Parameter=len,
    stops=[0: RGB(138, 173, 92), 0: RGB(8, 192, 124), 0.502: RGB(255, 175, 94), 1: RGB(220, 0, 40)])
panel = Panel(len)

divide = DivideDomain²(Domain=geo_2, UCount=number_slider, VCount=number_slider)
subsrf = Isotrim(Surface=geo_2, Domain=divide)
area = Area(Geometry=subsrf)  # -> Area, Centroid
srf_cp = SurfaceClosestPoint(Point=area.Centroid, Surface=subsrf)  # -> Point, UVPoint, Distance
evalsrf = EvaluateSurface(Surface=subsrf, Point=srf_cp.UVPoint)  # -> Point, Normal, Frame
devec = DeconstructVector(Vector=evalsrf.Normal)  # -> XComponent, YComponent, ZComponent

preview = CustomPreview(Geometry=geo, Shader=gradient)
gradient_2 = Gradient(
    LowerLimit=expr("-x", "1"),
    UpperLimit="1",
    Parameter=devec.ZComponent,
    stops=[0: RGB(130, 249, 255), 1: RGB(197, 0, 219)])
preview_2 = CustomPreview(Geometry=subsrf, Shader=gradient_2)
